# Grasshopper definition CAT2_ADVANCED_02_Pick_and_place_general_example.gh (Grasshopper 1.0.7)
# plug-ins: RobotComponentsABB

# ----
# Pick-up positions
pt = Point(Point(275.5907006, 330.1810831, 0))

# ----
# Place positions
pt_2 = Point(Point(246.4100735, -317.6734415, 0))

# ----
# Create boxes and pick and place points
number_slider = Slider(230, range=0..300)
number_slider_2 = Slider(30, range=0..300)
number_slider_3 = Slider(30, range=0..300)
box = DomainBox(Base=pt, X=number_slider, Y=number_slider_2, Z=number_slider_3)
box_2 = DomainBox(Base=pt_2, X=number_slider, Y=number_slider_2, Z=number_slider_3)
series = Series(Start=0, Step=number_slider_3, Count=Slider(6, range=0..10))
Z = UnitZ(Factor=series)
move = Move(Geometry=box, Motion=Z)  # -> Geometry, Transform
move_2 = Move(Geometry=box_2, Motion=Z)  # -> Geometry, Transform

# ----
# Robot Components info & documentation
I = Info()

# ----
# Create target planes
volume = Volume(Geometry=move.Geometry)  # -> Volume, Centroid
volume_2 = Volume(Geometry=move_2.Geometry)  # -> Volume, Centroid
xy = XYPlane(Origin=volume.Centroid)
xy_2 = XYPlane(Origin=volume_2.Centroid)
flip_plane_x = FlipPlaneX(Plane=xy)  # -> reverse(Plane)
flip_plane_x_2 = FlipPlaneX(Plane=xy_2)
Z_2 = UnitZ(Factor=Slider(224, range=0..1000))
item = ListItem(List=reverse(flip_plane_x_2), Index="0", Wrap=True)
item_2 = ListItem(List=flip_plane_x, Index="0", Wrap=True)
move_3 = Move(Geometry=item_2, Motion=Z_2)  # -> Geometry, Transform
move_4 = Move(Geometry=item, Motion=Z_2)  # -> Geometry, Transform

# ----
# Definitions: Robot Tool
pt_3 = Point(Point(0, 0, 0))
pt_4 = Point(Point(-0.0002136230469, 1.010101318, 140.9999847))
mesh = Mesh(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)
xy_3 = XYPlane(Origin=pt_4)
xy_4 = XYPlane(Origin=pt_3)
robtoool = RobotToolFromPlanes(Name="Gripper", Mesh=mesh, AttachmentPlane=xy_4, ToolPlane=xy_3)  # -> RobotTool, RobotToolCode

# ----
# Definitions: Robot
irb1200 = ABB_IRB1200707(PositionPlane=PlaneXY(0, 0, 0), RobotTool=robtoool.RobotTool)

# ----
# Code Generation: Target Definitions
# Defines target, name needs to be unique
number_slider_4 = Slider(0, range=0..7)
pln = Plane(Plane(origin=(573.9999847, 1.010101318, 791.1002136), x=(0, 0, -1), y=(0, 1, 0)))
T = ActionTarget(
    Name="PickUpTarget",
    Plane=flip_plane_x,
    AxisConfiguration=Slider(0, range=0..7),
    Override_External_Axis_Values=False,
    Set_Reference_Plane=False)  # -> graft(Target)
T_2 = ActionTarget(
    Name="DropDownTarget",
    Plane=flip_plane_x_2,
    AxisConfiguration=Slider(0, range=0..7),
    Override_External_Axis_Values=False,
    Set_Reference_Plane=False)  # -> graft(Target)
T_3 = ActionTarget(
    Name="Start",
    Plane=pln,
    AxisConfiguration=number_slider_4,
    Override_External_Axis_Values=False,
    Set_Reference_Plane=False)
T_4 = ActionTarget(
    Name="PickUpBasePlane",
    Plane=move_3.Geometry,
    AxisConfiguration=Slider(0, range=0..7),
    Override_External_Axis_Values=False,
    Set_Reference_Plane=False)
T_5 = ActionTarget(
    Name="DropDownBasePlane",
    Plane=move_4.Geometry,
    AxisConfiguration=Slider(0, range=0..7),
    Override_External_Axis_Values=False,
    Set_Reference_Plane=False)

# ----
# Code Generation: Custom speeddata
number_slider_5 = Slider(250, range=0..250)
sd = ActionSpeedData(Name="custom_speeddata", TCPVelocity=number_slider_5, ORIVelocity=500, LEAXVelocity=5000, REAXVelocity=1000)

# ----
# Deconstruct
derobinfo = DeconstructRobotInfo(RobotInfo=irb1200)  # -> Name, Meshes, AxisPlanes, AxisLimits, PositionPlane, MountingFrame, ToolPlane, RobotTool, ExternalAxis
derobtool = DeconstructRobotTool(RobotTool=robtoool.RobotTool)  # -> Name, Mesh, AttachmentPlane, ToolPlane

# ----
# Simulation: Forward Kinematics / Robot Debugging
number_slider_6 = Slider(0, range=-360..360)
merge = Merge(
    Data1=number_slider_6,
    Data2=Slider(0, range=-360..360),
    Data3=Slider(0, range=-360..360),
    Data4=Slider(0, range=-360..360),
    Data5=Slider(0, range=-360..360),
    Data6=Slider(0, range=-360..360))
fk = ForwardKinematics(RobotInfo=irb1200, InternalAxisValues=merge, ExternalAxisValues=[0, 0, 0, 0, 0, 0], Set_Hide_Mesh=False)  # -> RobotMesh, EndPlane, ExternalAxisPlanes

# ----
# Utility: Plane visualizer
pv = PlaneVisualizer(Plane=derobinfo.ToolPlane)

list = ValueList({"MoveAbsJ": 0, "MoveL": 1, "MoveJ": 2}, selected="MoveAbsJ")

# ----
# If the precision value is set to a negative value - the movement will be fine.
panel = Panel("-1")

# ----
# Code Generation: Robot actions
# In this example DO_1 would open and close the
# defined robot tool (gripper) depending on its state
panel_2 = Panel("! new block placement")
list_2 = ValueList({"MoveAbsJ": 0, "MoveL": 1, "MoveJ": 2}, selected="MoveAbsJ")
list_3 = ValueList({"MoveAbsJ": 0, "MoveL": 1, "MoveJ": 2}, selected="MoveAbsJ")
list_4 = ValueList({"MoveAbsJ": 0, "MoveL": 1, "MoveJ": 2}, selected="MoveJ")
list_5 = ValueList({"MoveAbsJ": 0, "MoveL": 1, "MoveJ": 2}, selected="MoveL")
list_6 = ValueList({"MoveAbsJ": 0, "MoveL": 1, "MoveJ": 2}, selected="MoveL")
list_7 = ValueList({"MoveAbsJ": 0, "MoveL": 1, "MoveJ": 2}, selected="MoveL")
list_8 = ValueList({"MoveAbsJ": 0, "MoveL": 1, "MoveJ": 2}, selected="MoveL")
aac = ActionAutoAxisConfigurator(IsActive=Toggle(True))
M = ActionMovement(
    Target=T_3,
    SpeedData=sd,
    MovementType=list_2,
    Precision=0,
    Override_Robot_Tool=False,
    Override_Work_Object=False,
    Set_Digital_Output=False)
M_2 = ActionMovement(
    Target=T_4,
    SpeedData=sd,
    MovementType=list_3,
    Precision=0,
    Override_Robot_Tool=False,
    Override_Work_Object=False,
    Set_Digital_Output=False)
M_3 = ActionMovement(
    Target=T,
    SpeedData=Slider(100, range=0..250),
    MovementType=list_6,
    Precision=panel,
    Override_Robot_Tool=False,
    Override_Work_Object=False,
    Set_Digital_Output=False)
M_4 = ActionMovement(
    Target=T_4,
    SpeedData=sd,
    MovementType=list_8,
    Precision=0,
    Override_Robot_Tool=False,
    Override_Work_Object=False,
    Set_Digital_Output=False)
M_5 = ActionMovement(
    Target=T_2,
    SpeedData=Slider(100, range=0..250),
    MovementType=list_7,
    Precision=0,
    Override_Robot_Tool=False,
    Override_Work_Object=False,
    Set_Digital_Output=False)
M_6 = ActionMovement(
    Target=T_5,
    SpeedData=sd,
    MovementType=list_5,
    Precision=0,
    Override_Robot_Tool=False,
    Override_Work_Object=False,
    Set_Digital_Output=False)
do = ActionDigitalOutput(Name="DO_1", State=Toggle(True))
do_2 = ActionDigitalOutput(Name="DO_1", State=Toggle(False))
do_3 = ActionDigitalOutput(Name="DO_1", State=Toggle(True))
cl = ActionCodeLine(Code=panel_2)
T_6 = ActionTimer(Duration="0.5")
T_7 = ActionTimer(Duration="0.5")
T_8 = ActionTimer(Duration="0.5")
T_9 = ActionTimer(Duration="0.5")

M_7 = ActionMovement(
    Target=T_5,
    SpeedData=sd,
    MovementType=list_4,
    Precision=0,
    Override_Robot_Tool=False,
    Override_Work_Object=False,
    Set_Digital_Output=False)

# ----
# Code Generation: Bundeling
weave = Weave(
    Pattern=[0, 1, 2, 3, 4, 5, 6, 7, 8, 9, 10, 11, 12, 13],
    Stream0=cl,
    Stream1=M_2,
    Stream2=do,
    Stream3=M_3,
    Stream4=T_6,
    Stream5=do_2,
    Stream6=T_7,
    Stream7=M_4,
    Stream8=M_7,
    Stream9=M_5,
    Stream10=T_8,
    Stream11=do_3,
    Stream12=T_9,
    Stream13=M_6,
    NullGaps=False)
merge_2 = Merge(Data1=flatten(aac), Data2=flatten(M), Data3=flatten(weave))

# ----
# Utilities: Visualization
toggle = BooleanToggle(True)
tv = TargetVisualizer(
    Actions=weave,
    DisplayNames=Toggle(True),
    DisplayPoints=True,
    DisplayDirection=toggle,
    Color=RGB(0, 0, 0),
    TextSize=6,
    PointSize=3)

# ----
# Simulation: Path generator
number_slider_7 = Slider(0, range=0..1)
pg = PathGenerator(
    RobotInfo=irb1200,
    Action=merge_2,
    Interpolations=Slider(5, range=0..10),
    AnimationSlider=number_slider_7,
    DisplayPath=Toggle(True),
    Update=Button())  # -> Target, InternalAxisValues, ExternalAxisValues, MovementPaths
fk_2 = ForwardKinematics(
    RobotInfo=irb1200,
    InternalAxisValues=pg.InternalAxisValues,
    ExternalAxisValues=pg.ExternalAxisValues,
    Set_Hide_Mesh=False)  # -> RobotMesh, EndPlane, ExternalAxisPlanes

# ----
# Code Generation: Base and Main Code Generation
# Contains Robot Movement Instructions
# Contains Robot Tool Definitions
rg = RAPIDGenerator(RobotInfo=irb1200, Action=merge_2, ModuleName="MainModule", FilePath="null", SaveToFile=False, Update=True)  # -> MainCode, BaseCode
panel_3 = Panel(rg.MainCode)
panel_4 = Panel(rg.BaseCode)

# ----
# Pick controller
button = Button()
gc = GetController(Update=button)

# ----
# Remote connection: RAPID code upload
toggle_2 = BooleanToggle(True)
remote_connection = RemoteConnection(
    RobotController=gc,
    Connect=toggle_2,
    Upload=Button(),
    Run=Button(),
    Stop=Button(),
    MainCode=rg.MainCode,
    BaseCode=rg.BaseCode)
panel_5 = Panel(remote_connection)

# ----
# Simulation: Realtime robot pose visualization
timer = Timer(TimerInterval=20, Target=ga)  # disabled
ga = GetAxisValues(RobotController=gc)  # -> InternalAxisValues, ExternalAxisValues
fk_3 = ForwardKinematics(
    RobotInfo=irb1200,
    InternalAxisValues=ga.InternalAxisValues,
    ExternalAxisValues=ga.ExternalAxisValues,
    Set_Hide_Mesh=False)  # -> RobotMesh, EndPlane, ExternalAxisPlanes

# ----
# Read the state of a digital input
panel_6 = Panel("DI_1")
getdi = GetDigitalInput(RobotController=gc, DIName=panel_6)  # -> Signal, State

# ----
# Read the state of a digital output
panel_7 = Panel("DO_1")
getdo = GetDigitalOutput(RobotController=gc, DOName=panel_7)  # -> Signal, State

# ----
# Set the state of a digital input
panel_8 = Panel("DI_1")
setdi = SetDigitalInput(RobotController=gc, DIName=panel_8, State=Toggle(False), Update=Button())

# ----
# Set the state of a digital output
panel_9 = Panel("DO_1")
setdo = SetDigitalOutput(RobotController=gc, DOName=panel_9, State=Toggle(False), Update=Button())

# ----
# Controller Utility: Realtime Connection
panel_10 = Panel(getdi.State)
panel_11 = Panel(getdo.State)
