# Grasshopper definition CAT2_ADVANCED_04_Override_external_axis_values_example.gh (Grasshopper 1.0.7)
# plug-ins: RobotComponentsABB

# ----
# Movement direction
X = UnitX(Factor=1)

# ----
# Axis limits
panel = Panel("0")
dom = ConstructDomain(DomainStart=panel, DomainEnd="9400")

# ----
# Base mesh
brep = Brep(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)
mesh = Mesh(brep)

# ----
# Link mesh
# defined for axis value 0
brep_2 = Brep(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)
mesh_2 = Mesh(brep_2)

# ----
# Robot attachment plane
# defined for axis value 0
pt = Point(Point(300, 500, 200))
xy = XYPlane(Origin=pt)
prot = RotatePlane(Plane=xy, Angle=degrees("90"))

# ----
# Definition for external linear axis
external_linear_axis = ExternalLinearAxis(Name="default_ela", AttachmentPlane=prot, Axis=X, AxisLimits=dom, BaseMesh=mesh, LinkMesh=mesh_2)

# ----
# Robot definition
irb4600 = ABB_IRB460040255(PositionPlane=PlaneXY(0, 0, 0), ExternalAxis=external_linear_axis)

# ----
# Override external axis values
number_slider = Slider(3500, range=0..10000)
merge = Merge(Data1=number_slider, Data2=Slider(6000, range=0..10000))

# ----
# Select this component
# to move the point in Rhino
pt_2 = Point(Point(5104.876473, 1966.638238, 486.9971185))

filter = StreamFilter(Gate=Toggle(True), Stream0="9e9", Stream1=merge)

# ----
# Target creation
xy_2 = XYPlane(Origin=pt_2)
flip_plane_x = FlipPlaneX(Plane=xy_2)
T = ActionTarget(
    Name="target",
    Plane=flip_plane_x,
    AxisConfiguration=Slider(0, range=0..7),
    ExternalAxisValueA=filter,
    Override_External_Axis_Values=True,
    Set_Reference_Plane=False)

# ----
# Movement creation
list = ValueList({"MoveAbsJ": 0, "MoveL": 1, "MoveJ": 2}, selected="MoveAbsJ")
list_2 = ValueList({"MoveAbsJ": 0, "MoveL": 1, "MoveJ": 2}, selected="MoveL")
merge_2 = Merge(Data1=list, Data2=list_2)  # -> graft(Result)
M = ActionMovement(
    Target=T,
    SpeedData=Slider(200, range=0..200),
    MovementType=merge_2,
    Precision=0,
    Override_Robot_Tool=False,
    Override_Work_Object=False,
    Set_Digital_Output=False)  # -> flatten(Movement)
split = SplitList(List=M, Index="3")  # -> ListA, ListB

# ----
# Path generator
number_slider_2 = Slider(0, range=0..1)
pg = PathGenerator(
    RobotInfo=irb4600,
    Action=split.ListA,
    Interpolations=Slider(10, range=0..100),
    AnimationSlider=number_slider_2,
    DisplayPath=Toggle(True),
    Update=True)  # -> Target, InternalAxisValues, ExternalAxisValues, MovementPaths
fk = ForwardKinematics(
    RobotInfo=irb4600,
    InternalAxisValues=pg.InternalAxisValues,
    ExternalAxisValues=pg.ExternalAxisValues,
    Set_Hide_Mesh=False)  # -> RobotMesh, EndPlane, ExternalAxisPlanes

# ----
# Rapid generator
rg = RAPIDGenerator(RobotInfo=irb4600, Action=split.ListA, ModuleName="MainModule", FilePath="null", SaveToFile=False, Update=True)  # -> MainCode, BaseCode
panel_2 = Panel(rg.MainCode)
