# Grasshopper definition CAT1_BASIC_01_Tool_mount_example.gh (Grasshopper 1.0.7)
# plug-ins: RobotComponents

# ----
# Robot tool definition
pt = Point(Point(0, 0, 0))
pt_2 = Point(Point(-0.0002136230469, 1.010101318, 140.9999847))
mesh = Mesh(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)
xy = XYPlane(Origin=pt_2)
xy_2 = XYPlane(Origin=pt)
robtoool = RobotToolFromPlanes(Name="Gripper", Mesh=mesh, AttachmentPlane=xy_2, ToolPlane=xy)  # -> RobotTool, RobotToolCode

# ----
# Plane Visualization
pv = PlaneVisualizer(Plane=[xy, xy_2])

# ----
# Robot definition
pt_3 = Point(Point(0, 500, 0))
xy_3 = XYPlane(Origin=pt_3)
irb1200 = ABB_IRB1200509(PositionPlane=xy_3, RobotTool=robtoool.RobotTool)
