# Grasshopper definition CAT1_BASIC_03_Setup_of_external_linear_axis.gh (Grasshopper 1.0.7)
# plug-ins: RobotComponentsABB

# ----
# Robot attachment plane
# defined for axis value 0
pt = Point(Point(300, 500, 200))
xy = XYPlane(Origin=pt)
prot = RotatePlane(Plane=xy, Angle=degrees("90"))

# ----
# Movement direction
X = UnitX(Factor=1)

# ----
# Axis limits
panel = Panel("0")
dom = ConstructDomain(DomainStart=panel, DomainEnd="9400")

# ----
# Base mesh
brep = Brep(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)
mesh = Mesh(brep)

# ----
# Link mesh
# defined for axis value 0
brep_2 = Brep(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)
mesh_2 = Mesh(brep_2)

# ----
# Definition for external linear axis
# If you disconnect the mesh input
# the exteranal linear axis component
# will display the axis curve
external_linear_axis = EXPERIMENTALExternalLinearAxis(AttachmentPlane=prot, Axis=X, Limits=dom, BaseMesh=mesh, LinkMesh=mesh_2)

# ----
# Robot definition
irb4600 = ABB_IRB460040255(PositionPlane=PlaneXY(0, 0, 0), ExternalLinearAxis=external_linear_axis)

# ----
# Select this component
# to move the point in Rhino
pt_2 = Point(Point(7633.104899, 1966.638238, 486.9971185))

# ----
# Target creation
xy_2 = XYPlane(Origin=pt_2)
flip_plane_x = FlipPlaneX(Plane=xy_2)
T = ActionTarget(Name="target", Plane=flip_plane_x, AxisConfiguration=0, Override_External_Axis_Values=False, Set_Reference_Plane=False)

# ----
# Robot pose display
ik = InverseKinematics(RobotInfo=irb4600, Movement=T)  # -> InternalAxisValues, ExternalAxisValues
fk = ForwardKinematics(
    RobotInfo=irb4600,
    InternalAxisValues=ik.InternalAxisValues,
    ExternalAxisValues=ik.ExternalAxisValues,
    Set_Hide_Mesh=False)  # -> RobotMesh, EndPlane, ExternalAxisPlanes

# ----
# Calculated internal axis values
panel_2 = Panel(ik.InternalAxisValues)
# Calculated external axis values
panel_3 = Panel(ik.ExternalAxisValues)
