# Grasshopper definition CAT2_ADVANCED_01_Asynchronous _data_creation.gh (Grasshopper 1.0.7)
# plug-ins: RobotComponents

# ----
# Custom speeddata
number_slider = Slider(125, range=0..250)
# Asynchronous speeddata creation
panel = Panel("PickUpSpeedData")
merge = Merge(Data1=panel, Data2="DropDownSpeedData")
merge_2 = Merge(Data1=number_slider, Data2=Slider(130, range=0..250), Data3=Slider(135, range=0..250))
sd = ActionSpeedData(Name=merge, TCPVelocity=merge_2, ORIVelocity=500, LEAXVelocity=5000, REAXVelocity=1000)

# ----
# Asynchronous target creation
number_slider_2 = Slider(7, range=0..10)
point = Point(Point(499.0106621, -69.71670937, 570.8622966))
point_2 = Point(Point(284.6998504, 288.8819987, 351.775219))
xy = XYPlane(Origin=point)
xz = XZPlane(Origin=point_2)
series = Series(Start=0, Step=1, Count=number_slider_2)
flip_plane_x = FlipPlaneX(Plane=xy)
flip_plane_x_2 = FlipPlaneX(Plane=xz)
Y = UnitY(Factor=series)
move = Move(Geometry=flip_plane_x_2, Motion=Y)  # -> Geometry, Transform
merge_3 = Merge(Data1=flip_plane_x, Data2=move.Geometry)  # -> flatten(Result)
merge_4 = Merge(Data1="PickUpTarget", Data2="DropDownTarget")
merge_5 = Merge(Data1=Slider(0, range=0..7), Data2=Slider(5, range=0..7))
T = ActionTarget(Name=merge_4, Plane=merge_3, AxisConfiguration=merge_5)

# ----
# Deconstruct speeddata
deconspeed = DeconstructSpeedData(SpeedData=sd)  # -> Name, TCPVelocity, ORIVelocity, LEAXVelocity, REAXVelocity
panel_2 = Panel(deconspeed.Name)
panel_3 = Panel(deconspeed.TCPVelocity)
panel_4 = Panel(deconspeed.ORIVelocity)
panel_5 = Panel(deconspeed.LEAXVelocity)
panel_6 = Panel(deconspeed.REAXVelocity)

# ----
# Deconstruct target
decontar = DeconstructTarget(Target=T)  # -> Name, Plane, AxisConfiguration
panel_7 = Panel(decontar.Name)
panel_8 = Panel(decontar.Plane)
panel_9 = Panel(decontar.AxisConfiguration)

# ----
# Add ABB predefined speeddata
number_slider_3 = Slider(100, range=0..250)
merge_6 = Merge(Data1=sd, Data2=number_slider_3, Data3=Slider(50, range=0..250))

list = ValueList({"MoveAbsJ": 0, "MoveL": 1, "MoveJ": 2}, selected="MoveAbsJ")
list_2 = ValueList({"MoveAbsJ": 0, "MoveL": 1, "MoveJ": 2}, selected="MoveJ")
list_3 = ValueList({"MoveAbsJ": 0, "MoveL": 1, "MoveJ": 2}, selected="MoveL")

# ----
# Asynchronous movement creation
number_slider_4 = Slider(0, range=-1..10)
merge_7 = Merge(Data1=number_slider_4, Data2=Slider(-1, range=-1..10), Data3=Slider(5, range=-1..10), Data4=Slider(-1, range=-1..10))
merge_8 = Merge(Data1=list, Data2=list_2, Data3=list_3)
panel_10 = Panel(merge_8)

M = ActionMovement(Target=T, SpeedData=merge_6, MovementType=panel_10, Precision=merge_7)
deconmove = DeconstructMovement(Movement=M)  # -> Target, SpeedData, MovementType, Precision

# ----
# Deconstruct movement
panel_11 = Panel(deconmove.Precision)
panel_12 = Panel(deconmove.Target)
panel_13 = Panel(deconmove.SpeedData)
panel_14 = Panel(deconmove.MovementType)

# ----
# Deconstruct speeddata
deconspeed_2 = DeconstructSpeedData(SpeedData=deconmove.SpeedData)  # -> Name, TCPVelocity, ORIVelocity, LEAXVelocity, REAXVelocity
panel_15 = Panel(deconspeed_2.Name)
panel_16 = Panel(deconspeed_2.TCPVelocity)
panel_17 = Panel(deconspeed_2.ORIVelocity)
panel_18 = Panel(deconspeed_2.LEAXVelocity)
panel_19 = Panel(deconspeed_2.REAXVelocity)

# ----
# Deconstruct target
decontar_2 = DeconstructTarget(Target=deconmove.Target)  # -> Name, Plane, AxisConfiguration
panel_20 = Panel(decontar_2.Plane)
panel_21 = Panel(decontar_2.AxisConfiguration)
panel_22 = Panel(decontar_2.Name)
