# Grasshopper definition CAT2_ADVANCED_03_Work_object_example.gh (Grasshopper 1.0.7)
# plug-ins: RobotComponentsABB

# ----
# Reference plane
pt = Point(Point(183, 1016, 0))
xy = XYPlane(Origin=pt)
pv = PlaneVisualizer(Plane=xy)

# ----
# Input geometry
# Curve for tool path
crv = Curve(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)

# ----
# Work object surface
srf = Surface(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)

# ----
# Robot end-effector
number_slider = Slider(100, range=0..200)
xy_2 = XYPlane(Origin=Point(0, 0, 0))
cone = Cone(Base=xy_2, Radius=Slider(25, range=0..200), Length=number_slider)  # -> Cone, Tip
Z = UnitZ(Factor=number_slider)
mesh = Mesh(cone.Cone)
move = Move(Geometry=xy_2, Motion=Z)  # -> Geometry, Transform
robtoool = RobotToolFromPlanes(Name="example_tool", Mesh=mesh, AttachmentPlane=xy_2, ToolPlane=move.Geometry)  # -> RobotTool, RobotToolCode

# ----
# Target creation
crv_2 = Curve(crv)
divide = DivideCurve(Curve=crv_2, Count=Slider(100, range=0..100), Kinks=False)  # -> Points, Tangents, Parameters
xy_3 = XYPlane(Origin=divide.Points)
pt_2 = Point(Point(591.169353, -113, 555.4776077))
xy_4 = XYPlane(Origin=pt_2)
align = AlignPlane(Plane=xy_3, Direction=divide.Tangents)  # -> Plane, Angle
flip_plane_y = FlipPlaneY(Plane=xy_4)
flip_plane_y_2 = FlipPlaneY(Plane=align.Plane)
T = ActionTarget(
    Name="initial_target",
    Plane=flip_plane_y,
    AxisConfiguration=0,
    Override_External_Axis_Values=True,
    Set_Reference_Plane=False)
T_2 = ActionTarget(
    Name="targets",
    Plane=flip_plane_y_2,
    ReferencePlane=xy,
    AxisConfiguration=0,
    Override_External_Axis_Values=True,
    Set_Reference_Plane=True)

# ----
# Second calibration point: defines the x-axis orientation
pt_3 = Point(Point(806.2503798, -308.2574692, 158.626591))

# ----
# First calibration point: defines origin of work object
pt_4 = Point(Point(421.4347365, -346.8857475, 143.1679246))

# ----
# Third calibration point
pt_5 = Point(Point(369.9890749, 275.5203288, 177.7390044))

# ----
# Work object creation
pl_3pt = Plane3Pt(PointA=pt_4, PointB=pt_3, PointC=pt_5)
vec2pt = Vector2Pt(PointA=pt_4, PointB=pt_3, Unitize=False)  # -> Vector, Length
align_2 = AlignPlane(Plane=pl_3pt, Direction=vec2pt.Vector)  # -> Plane, Angle
pl_origin = PlaneOrigin(Base=align_2.Plane, Origin=pt_4)
workobj = WorkObject(Name="wobj1", Plane=pl_origin)

# ----
# Robot definition
irb1200 = ABB_IRB1200509(PositionPlane=PlaneXY(0, 0, 0), RobotTool=robtoool.RobotTool)

# ----
# Orient geometry
orient = Orient(Geometry=[srf, crv], Source=xy, Target=pl_origin)  # -> Geometry, Transform

split = SplitList(List=T_2, Index="1")  # -> ListA, ListB

# ----
# Movement creation
number_slider_2 = Slider(100, range=0..100)
list = ValueList({"MoveAbsJ": 0, "MoveL": 1, "MoveJ": 2}, selected="MoveAbsJ")
list_2 = ValueList({"MoveAbsJ": 0, "MoveL": 1, "MoveJ": 2}, selected="MoveL")
M = ActionMovement(
    Target=split.ListB,
    SpeedData=Slider(100, range=0..100),
    MovementType=list_2,
    Precision=0,
    WorkObject=workobj,
    Override_Robot_Tool=False,
    Override_Work_Object=True,
    Set_Digital_Output=False)
M_2 = ActionMovement(
    Target=T,
    SpeedData=number_slider_2,
    MovementType=list,
    Precision=0,
    Override_Robot_Tool=False,
    Override_Work_Object=False,
    Set_Digital_Output=False)

list_3 = ValueList({"MoveAbsJ": 0, "MoveL": 1, "MoveJ": 2}, selected="MoveJ")
M_3 = ActionMovement(
    Target=split.ListA,
    SpeedData=Slider(100, range=0..100),
    MovementType=list_3,
    Precision=0,
    WorkObject=workobj,
    Override_Robot_Tool=False,
    Override_Work_Object=True,
    Set_Digital_Output=False)

# ----
# Combine actions
merge = Merge(Data1=flatten(M_2), Data2=flatten(M_3), Data3=flatten(M), Data4=flatten(M_2))

# ----
# Rapid generator
rg = RAPIDGenerator(RobotInfo=irb1200, Actions=merge, ModuleName="MainModule", FilePath="null", SaveToFile=False, Update=True)  # -> MainCode, BaseCode
panel = Panel(rg.MainCode)
panel_2 = Panel(rg.BaseCode)

# ----
# Path generator
number_slider_3 = Slider(0, range=0..1)
pg = PathGenerator(
    RobotInfo=irb1200,
    Actions=merge,
    Interpolations=Slider(5, range=0..100),
    AnimationSlider=number_slider_3,
    DisplayPath=Toggle(True),
    Update=Button())  # -> Target, InternalAxisValues, ExternalAxisValues, MovementPaths
fk = ForwardKinematics(
    RobotInfo=irb1200,
    InternalAxisValues=pg.InternalAxisValues,
    ExternalAxisValues=pg.ExternalAxisValues,
    Set_Hide_Mesh=False)  # -> RobotMesh, EndPlane, ExternalAxisPlanes
