# Grasshopper definition BASIC_02_Move_along_curve.gh (Grasshopper 1.0.7)
# plug-ins: RobotComponentsABB

# ----
# Robot end-effector
number_slider = Slider(100, range=0..200)
xy = XYPlane(Origin=Point(0, 0, 0))
cone = Cone(Base=xy, Radius=Slider(25, range=0..200), Length=number_slider)  # -> Cone, Tip
Z = UnitZ(Factor=number_slider)
mesh = Mesh(cone.Cone)
move = Move(Geometry=xy, Motion=Z)  # -> Geometry, Transform
robtoool = RobotToolFromPlanes(Name="example_tool", Mesh=mesh, AttachmentPlane=xy, ToolPlane=move.Geometry)  # -> RobotTool, RobotToolCode

# ----
# Path Generation
crv = Curve(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)
divide = DivideCurve(Curve=crv, Count=10, Kinks=False)  # -> Points, Tangents, Parameters
xy_2 = XYPlane(Origin=divide.Points)
flip_plane_y = FlipPlaneY(Plane=xy_2)
list = ValueList({"MoveAbsJ": 0, "MoveL": 1, "MoveJ": 2}, selected="MoveAbsJ")
T = ActionTarget(
    Name="defaultTar",
    Plane=flip_plane_y,
    AxisConfiguration=0,
    Override_External_Axis_Values=False,
    Set_Reference_Plane=False)
M = ActionMovement(
    Target=T,
    SpeedData=Slider(100, range=0..100),
    MovementType=list,
    ZoneData=0,
    Override_Robot_Tool=False,
    Override_Work_Object=False,
    Set_Digital_Output=False)

# ----
# Robot definition
irb1200_5_0_9 = ABB_IRB1200509(BasePlane=PlaneXY(0, 0, 0), RobotTool=robtoool.RobotTool)

# ----
# Robot Simulation
# It allows to compute the robot path and simulate its execution. For programs
# with large number of targets, a button can be plugged in the U input, to avoid
# recomputing the toolpath at every stage.
# 
# !!! WARNING !!!
# While RobotComponents toolpath generator is fairly accurate, there is no
# provided guarantee that the simulated toolpath will not differ when executing
# on a real robot. Always use a suitable simulation engine (e.g. RobotStudio)
# before uploading code to a real robot.
number_slider_2 = Slider(0, range=0..1)
pg = PathGenerator(RobotInfo=irb1200_5_0_9, Action=M, Interpolations=5, AnimationSlider=number_slider_2, DisplayPath=False, Update=True)  # -> Plane, InternalAxisValues, ExternalAxisValues, MovementPaths
fk = ForwardKinematics(
    RobotInfo=irb1200_5_0_9,
    InternalAxisValues=pg.InternalAxisValues,
    ExternalAxisValues=pg.ExternalAxisValues,
    Set_Hide_Mesh=False)  # -> PosedMeshes, EndPlane, ExternalAxisPlanes
