# Grasshopper definition BASIC_03_Simple movements.gh (Grasshopper 1.0.7)
# plug-ins: RobotComponentsABB

# ----
# Robot end-effector
number_slider = Slider(100, range=0..200)
xy = XYPlane(Origin=Point(0, 0, 0))
cone = Cone(Base=xy, Radius=Slider(25, range=0..200), Length=number_slider)  # -> Cone, Tip
Z = UnitZ(Factor=number_slider)
mesh = Mesh(cone.Cone)
move = Move(Geometry=xy, Motion=Z)  # -> Geometry, Transform
robtoool = RobotToolFromPlanes(Name="example_tool", Mesh=mesh, AttachmentPlane=xy, ToolPlane=move.Geometry)  # -> RobotTool, RobotToolCode

# ----
# Input curves
crv = Curve([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])

# ----
# Create target planes
# Start
# Planes for joint movement
# Plane above start
# End
# Planes for linear movement
# Plane above end
disc = Discontinuity(Curve=crv, Level=1)  # -> Points, Parameters
xy_2 = XYPlane(Origin=disc.Points)
flip_plane_x = FlipPlaneX(Plane=xy_2)
item = ListItem(List=flip_plane_x, Index=0, Wrap=True)
item_2 = ListItem(List=flip_plane_x, Index="-1", Wrap=True)
Z_2 = UnitZ(Factor=Slider(50, range=0..100))
move_2 = Move(Geometry=item_2, Motion=Z_2)  # -> Geometry, Transform
move_3 = Move(Geometry=item, Motion=Z_2)  # -> Geometry, Transform
merge = Merge(Data1=flip_plane_x, Data2=move_2.Geometry)
pln = Plane(move_3.Geometry)

# ----
# Robot definition
irb1200_5_0_9 = ABB_IRB1200509(BasePlane=PlaneXY(0, 0, 0), RobotTool=robtoool.RobotTool)

# ----
# Plane vizualizer
pv = PlaneVisualizer(Plane=[pln, merge])

# ----
# Custom speeddata
# If using one of the default speeds (e.g. v100) defined on the controller,
# you can simply plug a number slider with the speed in the  Movement
# component. If you want to define a custom speed instead, you can use
# the Action: Speed Data component.
number_slider_2 = Slider(46, range=0..250)
sd = ActionSpeedData(Name="speed", TCPVelocity=number_slider_2, ORIVelocity=500, LEAXVelocity=5000, REAXVelocity=1000)

# ----
# Comment line
# You can add comment lines to document your
# Rapid code. These lines will appear in the generated
# code, but will be ignored during execution.
panel = Panel("new line")
C = ActionComment(Text=panel)

list = ValueList({"MoveAbsJ": 0, "MoveL": 1, "MoveJ": 2}, selected="MoveAbsJ")
list_2 = ValueList({"MoveAbsJ": 0, "MoveL": 1, "MoveJ": 2}, selected="MoveL")

# ----
# Targets and Movements
# Each Target must have a unique naming. When using structured data trees in the Plane input,
# the Target Naming component can be used to automatically generate unique target names.
# RobotComponents enables the creation of multiple Movement types:
# - MoveAbsJ is a movement defined in absolute joint coordinates. Robot will always reach the target,
#   but motion will not be linear. All other data (Work object, tool offset) will be ignored.
# - MoveL is a movement defined in a straight line from start to end. Robot might not be able to
#   perform the motion in certain configurations.
# - MoveJ is non-straight movement between two point, which still accounts for tool and workobject offsets.
panel_2 = Panel("robot_targets")
N = Naming(Name=panel_2, DT=merge)
T = ActionTarget(
    Name="joint_targets",
    Plane=flatten(pln),
    AxisConfiguration=0,
    Override_External_Axis_Values=False,
    Set_Reference_Plane=False)  # -> graft(Target)
T_2 = ActionTarget(Name=N, Plane=merge, AxisConfiguration=0, Override_External_Axis_Values=False, Set_Reference_Plane=False)
M = ActionMovement(
    Target=T,
    SpeedData=Slider(200, range=0..250),
    MovementType=list,
    Precision=0,
    Override_Robot_Tool=False,
    Override_Work_Object=False,
    Set_Digital_Output=False)
M_2 = ActionMovement(
    Target=T_2,
    SpeedData=sd,
    MovementType=list_2,
    Precision=0,
    Override_Robot_Tool=False,
    Override_Work_Object=False,
    Set_Digital_Output=False)

# ----
# Combine actions in the right order
weave = Weave(Pattern=[0, 1, 2], Stream0=C, Stream1=M, Stream2=M_2, NullGaps=False)  # -> flatten(Weave)

# ----
# Code generator
# If you want to save the
# RAPID code to a file
# you can right-click on
# the component and
# select one of the menu
# items.
rg = RAPIDGenerator(RobotInfo=irb1200_5_0_9, Action=weave, ProgramName="MainModule", SystemName="BASE", Update=True)  # -> ProgramModule, SystemModule
main_module = Panel(rg.ProgramModule)
base_module = Panel(rg.SystemModule)

# ----
# Path Generator
# It allows to compute the robot path and simulate its execution. For programs
# with large number of targets, a button can be plugged in the U input, to avoid
# recomputing the toolpath at every stage.
# 
# !!! WARNING !!!
# While RobotComponents toolpath generator is fairly accurate, there is no
# provided guarantee that the simulated toolpath will not differ when executing
# on a real robot. Always use a suitable simulation engine (e.g. RobotStudio)
# before uploading code to a real robot.
number_slider_3 = Slider(0, range=0..1)
pg = PathGenerator(
    RobotInfo=irb1200_5_0_9,
    Action=weave,
    Interpolations=5,
    AnimationSlider=number_slider_3,
    DisplayPath=Toggle(True),
    Update=True)  # -> Target, InternalAxisValues, ExternalAxisValues, MovementPaths
fk = ForwardKinematics(
    RobotInfo=irb1200_5_0_9,
    InternalAxisValues=pg.InternalAxisValues,
    ExternalAxisValues=pg.ExternalAxisValues,
    Set_Hide_Mesh=False)  # -> RobotMesh, EndPlane, ExternalAxisPlanes
