# Grasshopper definition BASIC_01_Tool_mount_example.gh (Grasshopper 1.0.7)
# plug-ins: RobotComponentsABB

# ----
# Robot tool definition
attachment_plane_origin = Point(Point(0, 0, 0))
tool_center_origin = Point(Point(-0.0002136230469, 1.010101318, 140.9999847))
mesh = Mesh(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)
xy = XYPlane(Origin=tool_center_origin)
xy_2 = XYPlane(Origin=attachment_plane_origin)
robtoool = RobotToolFromPlanes(Name="Gripper", Mesh=mesh, AttachmentPlane=xy_2, ToolPlane=xy)  # -> RobotTool, RobotToolCode

# ----
# Plane Visualization
pv = PlaneVisualizer(Plane=xy)

# ----
# Robot definition
robot_origin = Point(Point(0, 500, 0))
xy_3 = XYPlane(Origin=robot_origin)
irb1200 = ABB_IRB1200509(PositionPlane=xy_3, RobotTool=robtoool.RobotTool)
