# Grasshopper definition ADVANCED_04_Movable_work_object_example.gh (Grasshopper 1.0.7)
# plug-ins: RobotComponentsABB

# ----
# Axis limits
number_slider = Slider(720, range=0..720)
neg = Negative(Value=number_slider)
dom = ConstructDomain(DomainStart=number_slider, DomainEnd=neg)

# ----
# Axis plane
xy = XYPlane(Origin=Point(0, 0, 0))

# ----
# Link mesh
mesh = Mesh(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)

# ----
# Base mesh
mesh_2 = Mesh(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)

# ----
# Work piece positioner as external rotational axis
panel = Panel("axis_name_as_it_is_definied_in_the_controller")
external_rotational_axis = ExternalRotationalAxis(Name=panel, AxisPlane=xy, AxisLimits=dom, BaseMesh=mesh_2, LinkMesh=mesh)

# ----
# Robot end-effector
number_slider_2 = Slider(100, range=0..200)
xy_2 = XYPlane(Origin=Point(0, 0, 0))
cone = Cone(Base=xy_2, Radius=Slider(25, range=0..200), Length=number_slider_2)  # -> Cone, Tip
Z = UnitZ(Factor=number_slider_2)
mesh_3 = Mesh(cone.Cone)
move = Move(Geometry=xy_2, Motion=Z)  # -> Geometry, Transform
robtoool = RobotToolFromPlanes(Name="example_tool", Mesh=mesh_3, AttachmentPlane=xy_2, ToolPlane=move.Geometry)  # -> RobotTool, RobotToolCode

# ----
# Target creation
# Target planes
crv = Curve(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)
divide = DivideCurve(Curve=crv, Count=Slider(200, range=0..1000), Kinks=False)  # -> Points, Tangents, Parameters
xy_3 = XYPlane(Origin=divide.Points)
align = AlignPlane(Plane=xy_3, Direction=divide.Tangents)  # -> Plane, Angle
flip_plane_y = FlipPlaneY(Plane=align.Plane)

# ----
# Reference plane
rec = Rectangle({Plane=Plane(origin=(1017, 1242, 0), x=(0, 1, 0), y=(-1, 0, 0)), Size=Domain2(u=-400..400, v=-400..400)})
pcen = PolygonCenter(Polyline=rec)  # -> CenterV, CenterE, CenterA
xy_4 = XYPlane(Origin=pcen.CenterV)

# ----
# Orient to calibrated position
# Calibrated axis plane
pt = Point(Point(801, 18, 300))
pt_2 = Point(Point(1161, 102.3869096, 402.4800073))
pt_3 = Point(Point(692, 355, 228.9929861))
pl_3pt = Plane3Pt(PointA=pt, PointB=pt_2, PointC=pt_3)
orient = Orient(Geometry=external_rotational_axis, Source=PlaneXY(0, 0, 0), Target=pl_3pt)  # -> Geometry, Transform
era = ExternalRotationalAxis(orient.Geometry)

# ----
# Calculate external axis value for each target
vec2pt = Vector2Pt(PointA=xy_4, PointB=divide.Points, Unitize=False)  # -> Vector, Length
X = UnitX(Factor=1)
neg_2 = Negative(Value=X)
angle = Angle(VectorA=neg_2, VectorB=vec2pt.Vector, Plane=xy_4)  # -> Angle, Reflex
deg = Degrees(Radians=angle.Angle)
python = GhPythonScript(x=deg)  # -> out, a; inputs x: list
# ---------- python: Python ----------
# This python components ensure that that step size 
# between two axes angles is never bigger or smaller
# than 180 degrees. 

def main(_x):
    
    for i in range(len(_x) - 1):
        counter = 0
        difference = _x[i+1] - _x[i]
        
        while ((difference <  -180) & (counter < 10000)):
            x[i+1] += 360
            difference = _x[i+1] - _x[i]
            counter += 1
            
        while ((difference >  180) & (counter < 10000)):
            x[i+1] -= 360
            difference = _x[i+1] - _x[i]
            counter += 1
            
    return _x

a = main(x)
# ---------- end python ----------
neg_3 = Negative(Value=python.a)

# ----
# Work object creation
panel_2 = Panel("wobj1_ext")
xy_5 = XYPlane(Origin=Point(0, 0, 0))
workobj = WorkObject(Name=panel_2, Plane=xy_5, ExternalRotationalAxis=era)

# ----
# Robot definition
irb1200 = ABB_IRB1200707(PositionPlane=PlaneXY(0, 0, 0), RobotTool=robtoool.RobotTool, ExternalAxis=era)

# ----
# Initial target
number_slider_3 = Slider(0, range=0..500)
pln = Plane(Plane(origin=(533, 0, 791.1), x=(0, 0, -1), y=(0, 1, 0)))
T = ActionTarget(
    Name="initial_target",
    Plane=pln,
    AxisConfiguration=Slider(1, range=0..7),
    ExternalAxisValueA=number_slider_3,
    Override_External_Axis_Values=True,
    Set_Reference_Plane=False)

# ----
# Targets on movable work object
panel_3 = Panel("targets")
T_2 = ActionTarget(
    Name=panel_3,
    Plane=flip_plane_y,
    ReferencePlane=xy_4,
    AxisConfiguration=0,
    ExternalAxisValueA=neg_3,
    Override_External_Axis_Values=True,
    Set_Reference_Plane=True)

pv = PlaneVisualizer(Plane=workobj)

# ----
# A target can be casted to a plane.
# This plane is the target plane in work
# object coordinate space.
pln_2 = Plane(T_2)
pv_2 = PlaneVisualizer(Plane=pln_2)

# ----
# Movement creation
panel_4 = Panel("1")
split = SplitList(List=T_2, Index=panel_4)  # -> ListA, ListB
list = ValueList({"MoveAbsJ": 0, "MoveL": 1, "MoveJ": 2}, selected="MoveAbsJ")
list_2 = ValueList({"MoveAbsJ": 0, "MoveL": 1, "MoveJ": 2}, selected="MoveAbsJ")
list_3 = ValueList({"MoveAbsJ": 0, "MoveL": 1, "MoveJ": 2}, selected="MoveL")
M = ActionMovement(
    Target=split.ListA,
    SpeedData=Slider(100, range=0..100),
    MovementType=list_2,
    WorkObject=workobj,
    Override_Robot_Tool=False,
    Override_Work_Object=True,
    Set_Digital_Output=False)
M_2 = ActionMovement(
    Target=split.ListB,
    SpeedData=Slider(100, range=0..100),
    MovementType=list_3,
    WorkObject=workobj,
    Override_Robot_Tool=False,
    Override_Work_Object=True,
    Set_Digital_Output=False)
M_3 = ActionMovement(
    Target=T,
    SpeedData=Slider(100, range=0..100),
    MovementType=list,
    Override_Robot_Tool=False,
    Override_Work_Object=False,
    Set_Digital_Output=False)

# ----
# Enable auto axis configutation
aac = ActionAutoAxisConfigurator(IsActive=True)

# ----
# A movement can be casted to a plane.
# This plane is the target plane in robot
# coordinate space. In case of a movable
# work object the this plane is always posed
# for an external axis value of 0.
pln_3 = Plane(M_2)
pv_3 = PlaneVisualizer(Plane=pln_3)

# ----
# Combine actions
merge = Merge(Data1=flatten(aac), Data2=flatten(M_3), Data3=flatten(M), Data4=flatten(M_2), Data5=flatten(M_3))

# ----
# Path generator
number_slider_4 = Slider(0, range=0..1)
pg = PathGenerator(
    RobotInfo=irb1200,
    Action=merge,
    Interpolations=Slider(5, range=0..100),
    AnimationSlider=number_slider_4,
    DisplayPath=Toggle(True),
    Update=Button())  # -> Target, InternalAxisValues, ExternalAxisValues, MovementPaths
fk = ForwardKinematics(
    RobotInfo=irb1200,
    InternalAxisValues=pg.InternalAxisValues,
    ExternalAxisValues=pg.ExternalAxisValues,
    Set_Hide_Mesh=False)  # -> RobotMesh, EndPlane, ExternalAxisPlanes

# ----
# Rapid generator
rg = RAPIDGenerator(RobotInfo=irb1200, Action=merge, ProgramName="MainModule", SystemName="BASE", Update=True)  # -> ProgramModule, SystemModule
panel_5 = Panel(rg.ProgramModule)
panel_6 = Panel(rg.SystemModule)

orient_2 = Orient(Geometry=crv, Source=xy_4, Target=fk.ExternalAxisPlanes)  # -> Geometry, Transform
orient_3 = Orient(Geometry=pln_3, Source=workobj, Target=fk.ExternalAxisPlanes)  # -> Geometry, Transform
pv_4 = PlaneVisualizer(Plane=fk.EndPlane)
crv_2 = Curve(orient_2.Geometry)
pv_5 = PlaneVisualizer(Plane=orient_3.Geometry)
