# Grasshopper definition BASIC_02_Move_along_curve.gh (Grasshopper 1.0.7)
# plug-ins: RobotComponentsABB

# ----
# Robot end-effector
number_slider = Slider(100, range=0..200)
xy = XYPlane(Origin=Point(0, 0, 0))
cone = Cone(Base=xy, Radius=Slider(25, range=0..200), Length=number_slider)  # -> Cone, Tip
Z = UnitZ(Factor=number_slider)
mesh = Mesh(cone.Cone)
move = Move(Geometry=xy, Motion=Z)  # -> Geometry, Transform
robtoool = RobotToolFromPlanes(Name="example_tool", Mesh=mesh, AttachmentPlane=xy, ToolPlane=move.Geometry)  # -> RobotTool, RobotToolCode

# ----
# Target and movement generation
crv = Curve(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)
divide = DivideCurve(Curve=crv, Count="25", Kinks=False)  # -> Points, Tangents, Parameters
xy_2 = XYPlane(Origin=divide.Points)
flip_plane_y = FlipPlaneY(Plane=xy_2)
list = ValueList({"MoveAbsJ": 0, "MoveL": 1, "MoveJ": 2}, selected="MoveAbsJ")
T = ActionTarget(
    Name="defaultTar",
    Plane=flip_plane_y,
    AxisConfiguration=0,
    Override_External_Axis_Values=False,
    Set_Reference_Plane=False)
M = ActionMovement(
    Target=T,
    SpeedData=Slider(100, range=0..100),
    MovementType=list,
    Override_Robot_Tool=False,
    Override_Work_Object=False,
    Set_Digital_Output=False)

# ----
# Robot definition
irb1200_5_0_9 = ABB_IRB1200509(BasePlane=PlaneXY(0, 0, 0), RobotTool=robtoool.RobotTool)

# ----
# Robot Simulation
# It allows to compute the robot path and simulate its execution. For programs
# with large number of targets, a button can be plugged in the U input, to avoid
# recomputing the toolpath at every stage.
# 
# !!! WARNING !!!
# While RobotComponents toolpath generator is fairly accurate, there is no
# provided guarantee that the simulated toolpath will not differ when executing
# on a real robot. Always use a suitable simulation engine (e.g. RobotStudio)
# before uploading code to a real robot.
number_slider_2 = Slider(0.491, range=0..1)
pg = PathGenerator(
    RobotInfo=irb1200_5_0_9,
    Action=M,
    Interpolations=5,
    AnimationSlider=number_slider_2,
    Update=True,
    Set_Preview_Curve=False,
    Set_Preview_Mesh=True)  # -> Plane, ExternalAxisPlanes, InternalAxisValues, ExternalAxisValues, ToolPath

# ----
# Code generator
# If you want to save the
# RAPID code to a file
# you can right-click on
# the component and
# select one of the menu
# items.
rg = RAPIDGenerator(RobotInfo=irb1200_5_0_9, Action=M, ProgramName="MainModule", SystemName="BASE", Update=True)  # -> ProgramModule, SystemModule
main_module = Panel(rg.ProgramModule)
base_module = Panel(rg.SystemModule)
