# Grasshopper definition BASIC_04_Setup_of_external_linear_axis.gh (Grasshopper 1.0.7)
# plug-ins: RobotComponentsABB

# ----
# Robot attachment plane
# defined for axis value 0
pt = Point(Point(300, 500, 200))
xy = XYPlane(Origin=pt)
prot = RotatePlane(Plane=xy, Angle=degrees("90"))

# ----
# Axis limits
panel = Panel("0")
dom = ConstructDomain(DomainStart=panel, DomainEnd="9400")

# ----
# Base mesh
brep = Brep(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)
mesh = Mesh(brep)

# ----
# Link mesh
# defined for axis value 0
brep_2 = Brep(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)
mesh_2 = Mesh(brep_2)

# ----
# Axis Direction
X = UnitX(Factor=1)

# ----
# Definition for external linear axis
external_linear_axis = ExternalLinearAxis(Name="default_ela", AttachmentPlane=prot, Axis=X, AxisLimits=dom, BaseMesh=mesh, LinkMesh=mesh_2)

# ----
# An external linear axis can be casted to an
# curve that represents the movement limits
# and direction. The domain of the curve is
# equal to the axis limits.
crv = Curve(external_linear_axis)

# ----
# Robot definition
irb4600 = ABB_IRB460040255(PositionPlane=PlaneXY(0, 0, 0), ExternalAxis=external_linear_axis)

# ----
# Target creation
number_slider = Slider(1875, range=0..10000)
pt_2 = ConstructPoint(XCoordinate=Slider(6051, range=0..10000), YCoordinate=number_slider, ZCoordinate=Slider(735, range=0..10000))
xy_2 = XYPlane(Origin=pt_2)
flip_plane_x = FlipPlaneX(Plane=xy_2)
T = ActionTarget(Name="target", Plane=flip_plane_x, AxisConfiguration=0, Override_External_Axis_Values=False, Set_Reference_Plane=False)

# ----
# Robot pose display
# By default, the external linear axis will move to the value which
# brings the robot base the closest to the given target.
# If you need to set specific axis values, see the example:
# "ADVANCED_04_Override_external_axis_values_example.gh"
ik = InverseKinematics(RobotInfo=irb4600, Movement=T)  # -> InternalAxisValues, ExternalAxisValues
fk = ForwardKinematics(
    RobotInfo=irb4600,
    InternalAxisValues=ik.InternalAxisValues,
    ExternalAxisValues=ik.ExternalAxisValues,
    Set_Hide_Mesh=False)  # -> RobotMesh, EndPlane, ExternalAxisPlanes

# ----
# Calculated internal axis values
panel_2 = Panel(ik.InternalAxisValues)
# Calculated external axis values
panel_3 = Panel(ik.ExternalAxisValues)
