# Grasshopper definition ADVANCED_03_Override_external_axis_values_example.gh (Grasshopper 1.0.7)
# plug-ins: RobotComponentsABB

# ----
# Movement direction
X = UnitX(Factor=1)

# ----
# Axis limits
panel = Panel("0")
dom = ConstructDomain(DomainStart=panel, DomainEnd="9400")

# ----
# Base mesh
brep = Brep(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)
mesh = Mesh(brep)

# ----
# Robot attachment plane
# defined for axis value 0
pt = Point(Point(300, 500, 200))
xy = XYPlane(Origin=pt)
prot = RotatePlane(Plane=xy, Angle=degrees("90"))

# ----
# Link mesh
# defined for axis value 0
brep_2 = Brep(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)
mesh_2 = Mesh(brep_2)

# ----
# Definition for external linear axis
external_linear_axis = ExternalLinearAxis(Name="default_ela", AttachmentPlane=prot, Axis=X, AxisLimits=dom, BaseMesh=mesh, LinkMesh=mesh_2)

# ----
# Robot definition
irb4600 = ABB_IRB460040255(PositionPlane=PlaneXY(0, 0, 0), ExternalAxis=external_linear_axis)

# ----
# Override external axis values
number_slider = Slider(3500, range=0..10000)
merge = Merge(Data1=number_slider, Data2=Slider(6000, range=0..10000))

# ----
# Select this component
# to move the point in Rhino
pt_2 = Point(Point(5104.876473, 1966.638238, 486.9971185))

filter = StreamFilter(Gate=Toggle(True), Stream0="9e9", Stream1=merge)

# ----
# Target creation
xy_2 = XYPlane(Origin=pt_2)
flip_plane_x = FlipPlaneX(Plane=xy_2)
T = ActionTarget(
    Name="target",
    Plane=flip_plane_x,
    AxisConfiguration=Slider(0, range=0..7),
    ExternalAxisValueA=filter,
    Override_External_Axis_Values=True,
    Set_Reference_Plane=False)

# ----
# Movement creation
list = ValueList({"MoveAbsJ": 0, "MoveL": 1, "MoveJ": 2}, selected="MoveAbsJ")
list_2 = ValueList({"MoveAbsJ": 0, "MoveL": 1, "MoveJ": 2}, selected="MoveL")
merge_2 = Merge(Data1=list, Data2=list_2)  # -> graft(Result)
M = ActionMovement(
    Target=T,
    SpeedData=Slider(200, range=0..200),
    MovementType=merge_2,
    Override_Robot_Tool=False,
    Override_Work_Object=False,
    Set_Digital_Output=False)  # -> flatten(Movement)
split = SplitList(List=M, Index="3")  # -> ListA, ListB

# ----
# Path generator
# It allows to compute the robot path and simulate its execution. For programs
# with large number of targets, a button can be plugged in the U input, to avoid
# recomputing the toolpath at every stage.
# 
# !!! WARNING !!!
# While RobotComponents toolpath generator is fairly accurate, there is no
# provided guarantee that the simulated toolpath will not differ when executing
# on a real robot. Always use a suitable simulation engine (e.g. RobotStudio)
# before uploading code to a real robot.
number_slider_2 = Slider(0, range=0..1)
pg = PathGenerator(
    RobotInfo=irb4600,
    Action=split.ListA,
    Interpolations=Slider(10, range=0..100),
    AnimationSlider=number_slider_2,
    Update=True,
    Set_Preview_Curve=True,
    Set_Preview_Mesh=True)  # -> Plane, ExternalAxisPlanes, InternalAxisValues, ExternalAxisValues, ToolPath

# ----
# Rapid generator
rg = RAPIDGenerator(RobotInfo=irb4600, Action=split.ListA, ProgramName="MainModule", SystemName="BASE", Update=True)  # -> ProgramModule, SystemModule
panel_2 = Panel(rg.ProgramModule)
