# Grasshopper definition BASIC_04_Setup_of_external_linear_axis.gh (Grasshopper 1.0.7)
# plug-ins: RobotComponentsABB

# ----
# Robot attachment plane
# defined for axis value 0
pt = Point(Point(300, 500, 200))
xy = XYPlane(Origin=pt)
prot = RotatePlane(Plane=xy, Angle=degrees("90"))

# ----
# Axis limits
panel = Panel("0")
dom = ConstructDomain(DomainStart=panel, DomainEnd="9400")

# ----
# Base mesh
brep = Brep(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)
mesh = Mesh(brep)

# ----
# Link mesh
# defined for axis value 0
brep_2 = Brep(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)
mesh_2 = Mesh(brep_2)

# ----
# Axis Direction
X = UnitX(Factor=1)

# ----
# Definition for external linear axis
external_linear_axis = ExternalLinearAxis(Name="default_ela", AttachmentPlane=prot, Axis=X, AxisLimits=dom, BaseMesh=mesh, LinkMesh=mesh_2)

# ----
# Robot definition
irb4600 = ABB_IRB460040255(PositionPlane=PlaneXY(0, 0, 0), ExternalAxis=external_linear_axis)

# ----
# Target creation
number_slider = Slider(1959, range=0..10000)
pt_2 = ConstructPoint(XCoordinate=Slider(6183, range=0..10000), YCoordinate=number_slider, ZCoordinate=Slider(735, range=0..10000))
xy_2 = XYPlane(Origin=pt_2)
flip_plane_x = FlipPlaneX(Plane=xy_2)
rt = RobotTarget(Name="target", Plane=flip_plane_x, AxisConfiguration=0, Set_External_Joint_Position=False, Set_Reference_Plane=False)

# ----
# An external linear axis can be casted to a
# curve that represents the movement limits
# and direction. The domain of the curve is
# equal to the axis limits.
crv = Curve(external_linear_axis)

# ----
# A robot target can be casted to a point.
# This point is the origin of the plane in
# work object coordinate space.
pt_3 = Point(rt)

# ----
# Robot pose display
# By default, the external linear axis will move to the value which
# brings the robot base the closest to the given target.
# If you need to set specific axis values, see the example:
# "ADVANCED_04_Override_external_axis_values_example.gh"
ik = InverseKinematics(Robot=irb4600, Movement=rt)  # -> RobotJointPosition, ExternalJointPosition
fk = ForwardKinematics(
    Robot=irb4600,
    RobotJointPosition=ik.RobotJointPosition,
    ExternalJointPosition=ik.ExternalJointPosition,
    Set_Hide_Mesh=False)  # -> PosedMeshes, EndPlane, ExternalAxisPlanes

# ----
# Calculated internal axis values
deconrobjoint = DeconstructRobotJointPosition(RobotJointPosition=ik.RobotJointPosition)  # -> RobotAxisValue1, RobotAxisValue2, RobotAxisValue3, RobotAxisValue4, RobotAxisValue5, RobotAxisValue6
panel_2 = Panel(deconrobjoint.RobotAxisValue1)
panel_3 = Panel(deconrobjoint.RobotAxisValue2)
panel_4 = Panel(deconrobjoint.RobotAxisValue3)
panel_5 = Panel(deconrobjoint.RobotAxisValue4)
panel_6 = Panel(deconrobjoint.RobotAxisValue5)
panel_7 = Panel(deconrobjoint.RobotAxisValue6)

# ----
# Calculated external axis values
deconextjoint = DeconstructExternalJointPosition(ExternalJointPosition=ik.ExternalJointPosition)  # -> ExternalAxisValueA, ExternalAxisValueB, ExternalAxisValueC, ExternalAxisValueD, ExternalAxisValueE, ExternalAxisValueF
panel_8 = Panel(deconextjoint.ExternalAxisValueB)
panel_9 = Panel(deconextjoint.ExternalAxisValueA)
panel_10 = Panel(deconextjoint.ExternalAxisValueC)
panel_11 = Panel(deconextjoint.ExternalAxisValueD)
panel_12 = Panel(deconextjoint.ExternalAxisValueE)
panel_13 = Panel(deconextjoint.ExternalAxisValueF)

# ----
# This is the default implementation for
# calculating the external linear axis
# value in Robot Components. The robot
# moves to the closest position on the
# external linear axis to reach the target.
crv_cp = CurveClosestPoint(Point=pt_3, Curve=crv)  # -> Point, Parameter, Distance
panel_14 = Panel(crv_cp.Parameter)
