# Grasshopper definition EXPERT_02_Multi_move_with_synced_movements.gh (Grasshopper 1.0.7)
# plug-ins: RobotComponents.Gh

# ----
# License info
# MULTI MOVE PROGRAMMING - WORK IN PROGRESS
# This file shows the current state on how to program multi move systems with Robot Components. The current
# approach is not perfect and in development. However, this file shows the easiest method on how to do this with the
# current release of Robot Components. The further integration of multi move programming is currently in discussion
# in our development team. You can reach out to us if you want to join the discussion or if you want to contribute to the
# development. You are welcome to share your ideas.
I = Info()
panel = Panel(I)

# ----
# Robot tool 1
panel_2 = Panel("0")
pt = ConstructPoint(XCoordinate=panel_2, YCoordinate="0", ZCoordinate="250")
xy = XYPlane(Origin=pt)
cone = Cone(Base=PlaneXY(0, 0, 0), Radius="60", Length="250")  # -> Cone, Tip
robtool = RobotToolFromPlanes(
    Name="tool1",
    Mesh=cone.Cone,
    AttachmentPlane=PlaneXY(0, 0, 0),
    ToolPlane=xy,
    Set_Center_of_Gravity=False,
    Set_Mass=False,
    Set_Moment_of_Inertia=False)

# ----
# Robot tool 2
panel_3 = Panel("0")
pt_2 = ConstructPoint(XCoordinate=panel_3, YCoordinate="0", ZCoordinate="300")
xy_2 = XYPlane(Origin=pt_2)
cone_2 = Cone(Base=PlaneXY(0, 0, 0), Radius="80", Length="300")  # -> Cone, Tip
robtool_2 = RobotToolFromPlanes(
    Name="tool2",
    Mesh=cone_2.Cone,
    AttachmentPlane=PlaneXY(0, 0, 0),
    ToolPlane=xy_2,
    Set_Center_of_Gravity=False,
    Set_Mass=False,
    Set_Moment_of_Inertia=False)

# ----
# Multi move custom code lines
panel_4 = Panel("""VAR syncident sync1;
VAR syncident sync2;
VAR syncident sync3;
PERS tasks all_tasks{2}:=[["T_ROB1"],["T_ROB2"]];
  """)
panel_5 = Panel("""WaitSyncTask sync1, all_tasks;
SyncMoveOn sync2, all_tasks;""")
list = ValueList({"Instruction": 0, "Declaration": 1}, selected="Declaration")
list_2 = ValueList({"Instruction": 0, "Declaration": 1}, selected="Instruction")
list_3 = ValueList({"Instruction": 0, "Declaration": 1}, selected="Instruction")
cl = CodeLine(Code=panel_5, Type=list_2)
cl_2 = CodeLine(Code="SyncMoveOff sync3;", Type=list_3)
cl_3 = CodeLine(Code=panel_4, Type=list)

# ----
# Curve to follow
number_slider = Slider(11, range=0..100)
crv = Curve(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)
divide = DivideCurve(Curve=crv, Count=number_slider, Kinks=False)  # -> Points, Tangents, Parameters
yz = YZPlane(Origin=divide.Points)

# ----
# Position of ROB1
# This has to match with
# the position as defined
# in the virtual or physical
# controller
panel_6 = Panel("600")
qtop = QuaternionToPlane(
    CoordX=panel_6,
    CoordY="-800",
    CoordZ="0.000",
    QuaternionA="1.000",
    QuaternionB="0.000",
    QuaternionC="0.000",
    QuaternionD="1.000")

# ----
# Position of ROB2
# This has to match with
# the position as defined
# in the virtual or physical
# controller
panel_7 = Panel("4000")
qtop_2 = QuaternionToPlane(
    CoordX=panel_7,
    CoordY="0.000",
    CoordZ="0.000",
    QuaternionA="0.000",
    QuaternionB="0.000",
    QuaternionC="0.000",
    QuaternionD="1.000")

# ----
# ROB1
robpres = RobotPreset(PositionPlane=qtop, RobotTool=robtool)

# ----
# ROB2
robpres_2 = RobotPreset(PositionPlane=qtop_2, RobotTool=robtool_2)

# ----
# Sync ID numbers
lng = ListLength(List=yz)
series = Series(Start="10", Step="10", Count=lng)

# ----
# Get axis values and pose real time
button = Button()
gc = GetController(Update=button)
timer = Timer(TimerInterval=20, Target=ga)  # disabled
ga = GetAxisValues(RobotController=gc)  # -> RobotJointPosition, ExternalAxisValues
bang = ExplodeTree(Data=simplify(graft(ga.RobotJointPosition)))  # -> Branch0, Branch1

# ----
# ROB2
ri = Robot(robpres_2)
fk = ForwardKinematics(Robot=ri, RobotJointPosition=bang.Branch1, Set_Hide_Mesh=False)  # -> PosedMeshes, EndPlane, ExternalAxisPlanes

# ----
# ROB1
ri_2 = Robot(robpres)
fk_2 = ForwardKinematics(Robot=ri_2, RobotJointPosition=bang.Branch0, Set_Hide_Mesh=False)  # -> PosedMeshes, EndPlane, ExternalAxisPlanes

# ----
# ROB2
ri_3 = Robot(robpres_2)

# ----
# ROB1
ri_4 = Robot(robpres)

# ----
# NOTE: This only works since both robots
# have the same amount of move instructions!
panel_8 = Panel("MultiMoveProgram")

# ----
# Robot instructions ROB2
pln = Plane(yz)
flip_plane_y = FlipPlaneY(Plane=pln)
item = ListItem(List=flip_plane_y, Index="0", Wrap=True)
item_2 = ListItem(List=flip_plane_y, Index="-1", Wrap=True)
neg = Negative(Value=Slider(300, range=0..1000))
pl_offset = PlaneOffset(BasePlane=item, Offset=neg)
pl_offset_2 = PlaneOffset(BasePlane=item_2, Offset=neg)
rt = RobotTarget(Name="start_rob2", Plane=pl_offset, AxisConfiguration=0, Set_External_Joint_Position=False, Set_Reference_Plane=False)
rt_2 = RobotTarget(Name="curve_rob2", Plane=flip_plane_y, AxisConfiguration=0, Set_External_Joint_Position=False, Set_Reference_Plane=False)
rt_3 = RobotTarget(Name="end_rob2", Plane=pl_offset_2, AxisConfiguration=0, Set_External_Joint_Position=False, Set_Reference_Plane=False)
jt = JointTarget(Name="home_rob2")
list_4 = ValueList({"MoveAbsJ": 0, "MoveL": 1, "MoveJ": 2}, selected="MoveJ")
list_5 = ValueList({"MoveAbsJ": 0, "MoveL": 1, "MoveJ": 2}, selected="MoveL")
list_6 = ValueList({"MoveAbsJ": 0, "MoveL": 1, "MoveJ": 2}, selected="MoveL")
list_7 = ValueList({"MoveAbsJ": 0, "MoveL": 1, "MoveJ": 2}, selected="MoveAbsJ")
list_8 = ValueList({"v5": 5, "v10": 10, "v20": 20, "v30": 30, "v40": 40, "v50": 50, "v60": 60, "v80": 80, "v100": 100, "v150": 150, "v200": 200, "v300": 300, "v400": 400, "v500": 500, "v600": 600, "v800": 800, "v1000": 1000, "v1500": 1500, "v2000": 2000, "v2500": 2500, "v3000": 3000, "v4000": 4000, "v5000": 5000, "v6000": 6000, "v7000": 7000}, selected="v50")
list_9 = ValueList({"v5": 5, "v10": 10, "v20": 20, "v30": 30, "v40": 40, "v50": 50, "v60": 60, "v80": 80, "v100": 100, "v150": 150, "v200": 200, "v300": 300, "v400": 400, "v500": 500, "v600": 600, "v800": 800, "v1000": 1000, "v1500": 1500, "v2000": 2000, "v2500": 2500, "v3000": 3000, "v4000": 4000, "v5000": 5000, "v6000": 6000, "v7000": 7000}, selected="v200")
list_10 = ValueList({"v5": 5, "v10": 10, "v20": 20, "v30": 30, "v40": 40, "v50": 50, "v60": 60, "v80": 80, "v100": 100, "v150": 150, "v200": 200, "v300": 300, "v400": 400, "v500": 500, "v600": 600, "v800": 800, "v1000": 1000, "v1500": 1500, "v2000": 2000, "v2500": 2500, "v3000": 3000, "v4000": 4000, "v5000": 5000, "v6000": 6000, "v7000": 7000}, selected="v200")
list_11 = ValueList({"v5": 5, "v10": 10, "v20": 20, "v30": 30, "v40": 40, "v50": 50, "v60": 60, "v80": 80, "v100": 100, "v150": 150, "v200": 200, "v300": 300, "v400": 400, "v500": 500, "v600": 600, "v800": 800, "v1000": 1000, "v1500": 1500, "v2000": 2000, "v2500": 2500, "v3000": 3000, "v4000": 4000, "v5000": 5000, "v6000": 6000, "v7000": 7000}, selected="v200")
M = Move(
    Target=jt,
    SpeedData=list_10,
    MovementType=list_7,
    Override_Robot_Tool=False,
    Override_Work_Object=False,
    Set_Digital_Output=False)
M_2 = Move(
    Target=rt,
    SpeedData=list_11,
    MovementType=list_4,
    Override_Robot_Tool=False,
    Override_Work_Object=False,
    Set_Digital_Output=False)
M_3 = Move(
    Target=rt_2,
    SpeedData=list_8,
    MovementType=list_5,
    Override_Robot_Tool=False,
    Override_Work_Object=False,
    Set_Digital_Output=False)
M_4 = Move(
    Target=rt_3,
    SpeedData=list_9,
    MovementType=list_6,
    Override_Robot_Tool=False,
    Override_Work_Object=False,
    Set_Digital_Output=False)

# ----
# Assign sync ID
python = GhPythonScript(M=M_3, id=series)  # -> out, M; inputs id: Int32
# ---------- python: Python ----------
M.SyncID = id
# ---------- end python ----------

merge = Merge(
    Data1=flatten(cl_3),
    Data2=flatten(M),
    Data3=flatten(M_2),
    Data4=flatten(cl),
    Data5=flatten(python.M),
    Data6=flatten(cl_2),
    Data7=flatten(M_4),
    Data8=flatten(M))

rg = RAPIDGenerator(Robot=ri_3, Action=merge, ProgramName="MultiMoveProgram", SystemName="MultiMoveSys", Update=True)  # -> ProgramModule, SystemModule
panel_9 = Panel(rg.ProgramModule)
panel_10 = Panel(rg.SystemModule)

# ----
# Robot instructions ROB2
pln_2 = Plane(yz)
item_3 = ListItem(List=pln_2, Index="0", Wrap=True)
item_4 = ListItem(List=pln_2, Index="-1", Wrap=True)
neg_2 = Negative(Value=Slider(300, range=0..1000))
pl_offset_3 = PlaneOffset(BasePlane=item_3, Offset=neg_2)
pl_offset_4 = PlaneOffset(BasePlane=item_4, Offset=neg_2)
rt_4 = RobotTarget(Name="start_rob1", Plane=pl_offset_3, AxisConfiguration=0, Set_External_Joint_Position=False, Set_Reference_Plane=False)
rt_5 = RobotTarget(Name="curve_rob1", Plane=pln_2, AxisConfiguration=0, Set_External_Joint_Position=False, Set_Reference_Plane=False)
rt_6 = RobotTarget(Name="end_rob1", Plane=pl_offset_4, AxisConfiguration=0, Set_External_Joint_Position=False, Set_Reference_Plane=False)
jt_2 = JointTarget(Name="home_rob1")
list_12 = ValueList({"MoveAbsJ": 0, "MoveL": 1, "MoveJ": 2}, selected="MoveAbsJ")
list_13 = ValueList({"MoveAbsJ": 0, "MoveL": 1, "MoveJ": 2}, selected="MoveJ")
list_14 = ValueList({"MoveAbsJ": 0, "MoveL": 1, "MoveJ": 2}, selected="MoveL")
list_15 = ValueList({"MoveAbsJ": 0, "MoveL": 1, "MoveJ": 2}, selected="MoveL")
list_16 = ValueList({"v5": 5, "v10": 10, "v20": 20, "v30": 30, "v40": 40, "v50": 50, "v60": 60, "v80": 80, "v100": 100, "v150": 150, "v200": 200, "v300": 300, "v400": 400, "v500": 500, "v600": 600, "v800": 800, "v1000": 1000, "v1500": 1500, "v2000": 2000, "v2500": 2500, "v3000": 3000, "v4000": 4000, "v5000": 5000, "v6000": 6000, "v7000": 7000}, selected="v200")
list_17 = ValueList({"v5": 5, "v10": 10, "v20": 20, "v30": 30, "v40": 40, "v50": 50, "v60": 60, "v80": 80, "v100": 100, "v150": 150, "v200": 200, "v300": 300, "v400": 400, "v500": 500, "v600": 600, "v800": 800, "v1000": 1000, "v1500": 1500, "v2000": 2000, "v2500": 2500, "v3000": 3000, "v4000": 4000, "v5000": 5000, "v6000": 6000, "v7000": 7000}, selected="v200")
list_18 = ValueList({"v5": 5, "v10": 10, "v20": 20, "v30": 30, "v40": 40, "v50": 50, "v60": 60, "v80": 80, "v100": 100, "v150": 150, "v200": 200, "v300": 300, "v400": 400, "v500": 500, "v600": 600, "v800": 800, "v1000": 1000, "v1500": 1500, "v2000": 2000, "v2500": 2500, "v3000": 3000, "v4000": 4000, "v5000": 5000, "v6000": 6000, "v7000": 7000}, selected="v50")
list_19 = ValueList({"v5": 5, "v10": 10, "v20": 20, "v30": 30, "v40": 40, "v50": 50, "v60": 60, "v80": 80, "v100": 100, "v150": 150, "v200": 200, "v300": 300, "v400": 400, "v500": 500, "v600": 600, "v800": 800, "v1000": 1000, "v1500": 1500, "v2000": 2000, "v2500": 2500, "v3000": 3000, "v4000": 4000, "v5000": 5000, "v6000": 6000, "v7000": 7000}, selected="v200")
M_5 = Move(
    Target=jt_2,
    SpeedData=list_17,
    MovementType=list_12,
    Override_Robot_Tool=False,
    Override_Work_Object=False,
    Set_Digital_Output=False)
M_6 = Move(
    Target=rt_4,
    SpeedData=list_16,
    MovementType=list_13,
    Override_Robot_Tool=False,
    Override_Work_Object=False,
    Set_Digital_Output=False)
M_7 = Move(
    Target=rt_5,
    SpeedData=list_18,
    MovementType=list_14,
    Override_Robot_Tool=False,
    Override_Work_Object=False,
    Set_Digital_Output=False)
M_8 = Move(
    Target=rt_6,
    SpeedData=list_19,
    MovementType=list_15,
    Override_Robot_Tool=False,
    Override_Work_Object=False,
    Set_Digital_Output=False)

# ----
# Assign sync ID
python_2 = GhPythonScript(M=M_7, id=series)  # -> out, M; inputs id: Int32; same code as python

merge_2 = Merge(
    Data1=flatten(cl_3),
    Data2=flatten(M_5),
    Data3=flatten(M_6),
    Data4=flatten(cl),
    Data5=flatten(python_2.M),
    Data6=flatten(cl_2),
    Data7=flatten(M_8),
    Data8=flatten(M_5))

# ----
# Path generators
number_slider_2 = Slider(0.534, range=0..1)
pg = PathGenerator(
    Robot=ri_4,
    Action=merge_2,
    Interpolations=5,
    AnimationSlider=number_slider_2,
    Update=True,
    Output_Error_Messages=False,
    Output_External_Axis_Planes=False,
    Output_External_Joint_Position=False,
    Output_External_Joint_Positions=False,
    Output_Robot_End_Plane=False,
    Output_Robot_End_Planes=False,
    Output_Robot_Joint_Position=False,
    Output_Robot_Joint_Positions=False,
    Set_Preview_Mesh=True)
pg_2 = PathGenerator(
    Robot=ri_3,
    Action=merge,
    Interpolations=5,
    AnimationSlider=number_slider_2,
    Update=True,
    Output_Error_Messages=False,
    Output_External_Axis_Planes=False,
    Output_External_Joint_Position=False,
    Output_External_Joint_Positions=False,
    Output_Robot_End_Plane=False,
    Output_Robot_End_Planes=False,
    Output_Robot_Joint_Position=False,
    Output_Robot_Joint_Positions=False,
    Set_Preview_Mesh=True)

rg_2 = RAPIDGenerator(Robot=ri_4, Action=merge_2, ProgramName=panel_8, SystemName="MultiMoveSys", Update=True)  # -> ProgramModule, SystemModule
panel_11 = Panel(rg_2.ProgramModule)
panel_12 = Panel(rg_2.SystemModule)
