# Grasshopper definition BASIC_05_Setup_of_robot_info_IRB120.gh (Grasshopper 1.0.7)
# plug-ins: Robot Components

# ----
# License info
I = Info()
panel = Panel(I)

# ----
# Tool mounting frame
number_slider = Slider(1, range=0..1)
vec = VectorXYZ(XComponent=number_slider, YComponent=Slider(0, range=0..1), ZComponent=Slider(0, range=0..1))  # -> Vector, Length
pt = ConstructPoint(XCoordinate="374", YCoordinate="0", ZCoordinate="630")
pl = PlaneNormal(Origin=pt, ZAxis=vec.Vector)
Z = UnitZ(Factor=1)
neg = Negative(Value=Z)
align = AlignPlane(Plane=pl, Direction=neg)  # -> Plane, Angle

# ----
# Name
# Robot mesh
panel_2 = Panel("IRB120-3/0.58")

pt_2 = ConstructPoint(XCoordinate="0", YCoordinate="0", ZCoordinate="290")
vec_2 = VectorXYZ(XComponent=Slider(0, range=0..1), YComponent=Slider(1, range=0..1), ZComponent=Slider(0, range=0..1))  # -> Vector, Length
pl_2 = PlaneNormal(Origin=pt_2, ZAxis=vec_2.Vector)

vec_3 = VectorXYZ(XComponent=Slider(0, range=0..1), YComponent=Slider(0, range=0..1), ZComponent=Slider(1, range=0..1))  # -> Vector, Length
pt_3 = ConstructPoint(XCoordinate="0", YCoordinate="0", ZCoordinate="0")
pl_3 = PlaneNormal(Origin=pt_3, ZAxis=vec_3.Vector)

vec_4 = VectorXYZ(XComponent=Slider(0, range=0..1), YComponent=Slider(1, range=0..1), ZComponent=Slider(0, range=0..1))  # -> Vector, Length
pt_4 = ConstructPoint(XCoordinate="302", YCoordinate="0", ZCoordinate="630")
pl_4 = PlaneNormal(Origin=pt_4, ZAxis=vec_4.Vector)

# ----
# Position plane
xy = XYPlane(Origin=Point(0, 0, 0))

vec_5 = VectorXYZ(XComponent=Slider(1, range=0..1), YComponent=Slider(0, range=0..1), ZComponent=Slider(0, range=0..1))  # -> Vector, Length
pt_5 = ConstructPoint(XCoordinate="149.6", YCoordinate="0", ZCoordinate="630")
pl_5 = PlaneNormal(Origin=pt_5, ZAxis=vec_5.Vector)

pt_6 = ConstructPoint(XCoordinate="0", YCoordinate="0", ZCoordinate="560")
vec_6 = VectorXYZ(XComponent=Slider(0, range=0..1), YComponent=Slider(1, range=0..1), ZComponent=Slider(0, range=0..1))  # -> Vector, Length
pl_6 = PlaneNormal(Origin=pt_6, ZAxis=vec_6.Vector)

# ----
# Axis limits
panel_3 = Panel("-165")
dom = ConstructDomain(DomainStart=panel_3, DomainEnd="165")
dom_2 = ConstructDomain(DomainStart="-110", DomainEnd="110")
dom_3 = ConstructDomain(DomainStart="-110", DomainEnd="70")
dom_4 = ConstructDomain(DomainStart="-160", DomainEnd="160")
dom_5 = ConstructDomain(DomainStart="-120", DomainEnd="120")
dom_6 = ConstructDomain(DomainStart="-400", DomainEnd="400")
merge = Merge(Data1=dom, Data2=dom_2, Data3=dom_3, Data4=dom_4, Data5=dom_5, Data6=dom_6)  # -> flatten(Result)

vec_7 = VectorXYZ(XComponent=Slider(1, range=0..1), YComponent=Slider(0, range=0..1), ZComponent=Slider(0, range=0..1))  # -> Vector, Length
pt_7 = ConstructPoint(XCoordinate="374", YCoordinate="0", ZCoordinate="630")
pl_7 = PlaneNormal(Origin=pt_7, ZAxis=vec_7.Vector)

# ----
# Mesh settings
number_slider_2 = Slider(0, range=0..500)
custom_mesh_settings = SettingsCustom(
    StitchSeams=True,
    SimplePlanes=Toggle(True),
    Refine=Toggle(False),
    MinCount=Slider(0, range=0..50),
    MaxCount=Slider(0, range=0..50),
    AspectRatio=number_slider_2,
    MaxDistance=Slider(0, range=0..10),
    MaxAngle=Slider(0, range=0..360),
    MinEdge=Slider(5, range=0..20),
    MaxEdge=Slider(0, range=0..500))

pipeline = GeometryPipeline(
    GroupByLayer=False,
    GroupByType=False,
    IncludeHidden=True,
    IncludeLocked=True,
    LayerFilter="4",
    NameFilter="*",
    SublayerFiltering=True,
    TypeFilter=1073741848)
pipeline_2 = GeometryPipeline(
    GroupByLayer=False,
    GroupByType=False,
    IncludeHidden=True,
    IncludeLocked=True,
    LayerFilter="3",
    NameFilter="*",
    SublayerFiltering=True,
    TypeFilter=1073741848)
pipeline_3 = GeometryPipeline(
    GroupByLayer=False,
    GroupByType=False,
    IncludeHidden=True,
    IncludeLocked=True,
    LayerFilter="2",
    NameFilter="*",
    SublayerFiltering=True,
    TypeFilter=1073741848)
pipeline_4 = GeometryPipeline(
    GroupByLayer=False,
    GroupByType=False,
    IncludeHidden=True,
    IncludeLocked=True,
    LayerFilter="5",
    NameFilter="*",
    SublayerFiltering=True,
    TypeFilter=1073741848)
pipeline_5 = GeometryPipeline(
    GroupByLayer=False,
    GroupByType=False,
    IncludeHidden=True,
    IncludeLocked=True,
    LayerFilter="6",
    NameFilter="*",
    SublayerFiltering=True,
    TypeFilter=1073741848)
pipeline_6 = GeometryPipeline(
    GroupByLayer=False,
    GroupByType=False,
    IncludeHidden=True,
    IncludeLocked=True,
    LayerFilter="1",
    NameFilter="*",
    SublayerFiltering=True,
    TypeFilter=1073741848)
pipeline_7 = GeometryPipeline(
    GroupByLayer=False,
    GroupByType=False,
    IncludeHidden=True,
    IncludeLocked=True,
    LayerFilter="0",
    NameFilter="*",
    SublayerFiltering=True,
    TypeFilter=1073741848)
brep = Brep(pipeline_7)
brep_2 = Brep(pipeline_6)
brep_3 = Brep(pipeline_3)
brep_4 = Brep(pipeline_2)
brep_5 = Brep(pipeline_4)
brep_6 = Brep(pipeline_5)
brep_7 = Brep(pipeline)
mesh = MeshBrep(Brep=brep, Settings=custom_mesh_settings)  # -> flatten(Mesh)
mesh_2 = MeshBrep(Brep=brep_2, Settings=custom_mesh_settings)  # -> flatten(Mesh)
mesh_3 = MeshBrep(Brep=brep_3, Settings=custom_mesh_settings)  # -> flatten(Mesh)
mesh_4 = MeshBrep(Brep=brep_4, Settings=custom_mesh_settings)  # -> flatten(Mesh)
mesh_5 = MeshBrep(Brep=brep_7, Settings=custom_mesh_settings)  # -> flatten(Mesh)
mesh_6 = MeshBrep(Brep=brep_5, Settings=custom_mesh_settings)  # -> flatten(Mesh)
mesh_7 = MeshBrep(Brep=brep_6, Settings=custom_mesh_settings)  # -> flatten(Mesh)
mjoin = MeshJoin(Meshes=mesh)
mjoin_2 = MeshJoin(Meshes=mesh_2)
mjoin_3 = MeshJoin(Meshes=mesh_3)
mjoin_4 = MeshJoin(Meshes=mesh_4)
mjoin_5 = MeshJoin(Meshes=mesh_5)
mjoin_6 = MeshJoin(Meshes=mesh_6)
mjoin_7 = MeshJoin(Meshes=mesh_7)
merge_2 = Merge(Data1=mjoin, Data2=mjoin_2, Data3=mjoin_3, Data4=mjoin_4, Data5=mjoin_5, Data6=mjoin_6, Data7=mjoin_7)  # -> flatten(Result)

# ----
# Axis planes
merge_3 = Merge(Data1=pl_3, Data2=pl_2, Data3=pl_6, Data4=pl_5, Data5=pl_4, Data6=pl_7)  # -> flatten(Result)

# ----
# Robot end-effector: for debugging purposes
number_slider_3 = Slider(60, range=0..200)
xy_2 = XYPlane(Origin=Point(0, 0, 0))
cone = Cone(Base=xy_2, Radius=Slider(20, range=0..200), Length=number_slider_3)  # -> Cone, Tip
Z_2 = UnitZ(Factor=number_slider_3)
mesh_8 = Mesh(cone.Cone)
move = Move(Geometry=xy_2, Motion=Z_2)  # -> Geometry, Transform
robtool = RobotToolFromPlanes(
    Name="debug_tool",
    Mesh=mesh_8,
    AttachmentPlane=xy_2,
    ToolPlane=move.Geometry,
    Set_Center_of_Gravity=False,
    Set_Mass=False,
    Set_Moment_of_Inertia=False)

# ----
# Robot info
robinfo = RobotInfo(
    Name=panel_2,
    Meshes=merge_2,
    AxisPlanes=merge_3,
    AxisLimits=merge,
    PositionPlane=xy,
    MountingFrame=align.Plane,
    RobotTool=robtool)

# ----
# Deconstruct robot info and show axis planes
derob = DeconstructRobot(Robot=robinfo)  # -> Name, Meshes, AxisPlanes, AxisLimits, PositionPlane, MountingFrame, RobotTool, ExternalAxis
pv = PlaneVisualizer(Plane=derob.AxisPlanes)

# ----
# Inverse kinematics
pt_8 = Point(Point(304.5225622, -275.9572768, 154.7679203))
flip_plane_x = FlipPlaneX(Plane=pt_8)
rt = RobotTarget(
    Plane=flip_plane_x,
    AxisConfiguration=Slider(0, range=0..7),
    Set_External_Joint_Position=False,
    Set_Reference_Plane=False)
ik = InverseKinematics(Robot=robinfo, Movement=rt, Closest_Robot_Joint_Position=False, Set_Hide_Mesh=False)  # -> RobotJointPosition, ExternalJointPosition

# ----
# Forward kinematics
number_slider_4 = Slider(25, range=-180..180)

rj = RobotJointPosition(
    RobotJointPosition1=number_slider_4,
    RobotJointPosition2=Slider(50, range=-180..180),
    RobotJointPosition3=Slider(-2, range=-180..180),
    RobotJointPosition4=Slider(102, range=-180..180),
    RobotJointPosition5=Slider(55, range=-180..180),
    RobotJointPosition6=Slider(-152, range=-180..180))
fk = ForwardKinematics(Robot=robinfo, RobotJointPosition=rj, Set_Hide_Mesh=False)  # -> PosedMeshes, EndPlane, ExternalAxisPlanes

pv_2 = PlaneVisualizer(Plane=fk.EndPlane)
