# Grasshopper definition ADVANCED_01_Pick_and_place_general_example.gh (Grasshopper 1.0.7)
# plug-ins: Robot Components

# ----
# License info
I = Info()
panel = Panel(I)

# ----
# Pick-up positions
pt = Point(Point(275.5907006, 330.1810831, 0))

# ----
# Place positions
pt_2 = Point(Point(246.4100735, -317.6734415, 0))

# ----
# Create boxes and pick and place points
number_slider = Slider(230, range=0..300)
number_slider_2 = Slider(30, range=0..300)
number_slider_3 = Slider(30, range=0..300)
box = DomainBox(Base=pt, X=number_slider, Y=number_slider_2, Z=number_slider_3)
box_2 = DomainBox(Base=pt_2, X=number_slider, Y=number_slider_2, Z=number_slider_3)
series = Series(Start=0, Step=number_slider_3, Count=Slider(6, range=0..10))
Z = UnitZ(Factor=series)
move = Move(Geometry=box, Motion=Z)  # -> Geometry, Transform
move_2 = Move(Geometry=box_2, Motion=Z)  # -> Geometry, Transform

# ----
# Create target planes
volume = Volume(Geometry=move.Geometry)  # -> Volume, Centroid
volume_2 = Volume(Geometry=move_2.Geometry)  # -> Volume, Centroid
xy = XYPlane(Origin=volume.Centroid)
xy_2 = XYPlane(Origin=volume_2.Centroid)
flip_plane_x = FlipPlaneX(Plane=xy)  # -> reverse(Plane)
flip_plane_x_2 = FlipPlaneX(Plane=xy_2)
Z_2 = UnitZ(Factor=Slider(224, range=0..1000))
item = ListItem(List=reverse(flip_plane_x_2), Index="0", Wrap=True)
item_2 = ListItem(List=flip_plane_x, Index="0", Wrap=True)
move_3 = Move(Geometry=item_2, Motion=Z_2)  # -> Geometry, Transform
move_4 = Move(Geometry=item, Motion=Z_2)  # -> Geometry, Transform

# ----
# Definitions: Robot Tool
pt_3 = Point(Point(0, 0, 0))
pt_4 = Point(Point(-0.0002136230469, 1.010101318, 140.9999847))
mesh = Mesh(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)
xy_3 = XYPlane(Origin=pt_4)
xy_4 = XYPlane(Origin=pt_3)
robtool = RobotTool(
    Name="gripper",
    Mesh=mesh,
    AttachmentPlane=xy_4,
    ToolPlane=xy_3,
    Set_Center_of_Gravity=False,
    Set_Mass=False,
    Set_Moment_of_Inertia=False)

# ----
# Definitions: Robot
robpres = RobotPreset(PositionPlane=PlaneXY(0, 0, 0), RobotTool=robtool)

# ----
# Code Generation: Custom speeddata
number_slider_4 = Slider(250, range=0..250)
sd = SpeedData(Name="custom_speeddata", TCPVelocity=number_slider_4, ORIVelocity=500, LEAXVelocity=5000, REAXVelocity=1000)

# ----
# Code Generation: Target Definitions
# Defines target, name needs to be unique
number_slider_5 = Slider(0, range=0..7)

rt = RobotTarget(
    Name="PickUpTarget",
    Plane=flip_plane_x,
    AxisConfiguration=number_slider_5,
    Set_External_Joint_Position=False,
    Set_Reference_Plane=False)
rt_2 = RobotTarget(
    Name="PickUpBasePlane",
    Plane=move_3.Geometry,
    AxisConfiguration=Slider(0, range=0..7),
    Set_External_Joint_Position=False,
    Set_Reference_Plane=False)
rt_3 = RobotTarget(
    Name="DropDownTarget",
    Plane=flip_plane_x_2,
    AxisConfiguration=Slider(0, range=0..7),
    Set_External_Joint_Position=False,
    Set_Reference_Plane=False)
rt_4 = RobotTarget(
    Name="DropDownBasePlane",
    Plane=move_4.Geometry,
    AxisConfiguration=Slider(0, range=0..7),
    Set_External_Joint_Position=False,
    Set_Reference_Plane=False)
jt = JointTarget(Name="Start")

do = ActionDigitalOutput(Name="DO_01", State=Toggle(True))
T = ActionTimer(Duration="0.5")
T_2 = ActionTimer(Duration="0.5")
merge = Merge(Data1=T, Data2=do, Data3=T_2)
group = GroupActions(Name="Close gripper", Action=merge)

# ----
# In this example DO_01 would open and close the
# defined robot tool (gripper) depending on its state
panel_2 = Panel("0.5")
do_2 = ActionDigitalOutput(Name="DO_01", State=Toggle(False))
T_3 = ActionTimer(Duration=panel_2)
T_4 = ActionTimer(Duration="0.5")
merge_2 = Merge(Data1=T_3, Data2=do_2, Data3=T_4)
group_2 = GroupActions(Name="Open gripper", Action=merge_2)

# ----
# Simulation: Forward kinematics / robot debugging
number_slider_6 = Slider(42, range=-360..360)
rj = RobotJointPosition(
    RobotJointPosition1=Slider(-104, range=-360..360),
    RobotJointPosition2=number_slider_6,
    RobotJointPosition3=Slider(-135, range=-360..360),
    RobotJointPosition4=Slider(-5, range=-360..360),
    RobotJointPosition5=Slider(46, range=-360..360),
    RobotJointPosition6=Slider(-31, range=-360..360))
fk = ForwardKinematics(Robot=robpres, RobotJointPosition=rj, Set_Hide_Mesh=False)  # -> PosedMeshes, EndPlane, ExternalAxisPlanes

# ----
# Deconstruct
derob = DeconstructRobot(Robot=robpres)  # -> Name, Meshes, AxisPlanes, AxisLimits, PositionPlane, MountingFrame, RobotTool, ExternalAxis
derobtool = DeconstructRobotTool(RobotTool=derob.RobotTool)  # -> Name, Mesh, AttachmentPlane, ToolPlane, Mass, CenterOfGravity, MomentOfInertia

# ----
# Code Generation: Robot actions
panel_3 = Panel("! new block placement")
toggle = BooleanToggle(False)
list = ValueList({"Instruction": 0, "Declaration": 1}, selected="Instruction")
list_2 = ValueList({"Instruction": 0, "Declaration": 1}, selected="Instruction")
list_3 = ValueList({"MoveAbsJ": 0, "MoveL": 1, "MoveJ": 2}, selected="MoveL")
list_4 = ValueList({"MoveAbsJ": 0, "MoveL": 1, "MoveJ": 2}, selected="MoveL")
list_5 = ValueList({"MoveAbsJ": 0, "MoveL": 1, "MoveJ": 2}, selected="MoveJ")
list_6 = ValueList({"MoveAbsJ": 0, "MoveL": 1, "MoveJ": 2}, selected="MoveL")
list_7 = ValueList({"MoveAbsJ": 0, "MoveL": 1, "MoveJ": 2}, selected="MoveL")
list_8 = ValueList({"MoveAbsJ": 0, "MoveL": 1, "MoveJ": 2}, selected="MoveJ")
list_9 = ValueList({"MoveAbsJ": 0, "MoveL": 1, "MoveJ": 2}, selected="MoveAbsJ")
list_10 = ValueList({"v5": 5, "v10": 10, "v20": 20, "v30": 30, "v40": 40, "v50": 50, "v60": 60, "v80": 80, "v100": 100, "v150": 150, "v200": 200, "v300": 300, "v400": 400, "v500": 500, "v600": 600, "v800": 800, "v1000": 1000, "v1500": 1500, "v2000": 2000, "v2500": 2500, "v3000": 3000, "v4000": 4000, "v5000": 5000, "v6000": 6000, "v7000": 7000}, selected="v100")
list_11 = ValueList({"v5": 5, "v10": 10, "v20": 20, "v30": 30, "v40": 40, "v50": 50, "v60": 60, "v80": 80, "v100": 100, "v150": 150, "v200": 200, "v300": 300, "v400": 400, "v500": 500, "v600": 600, "v800": 800, "v1000": 1000, "v1500": 1500, "v2000": 2000, "v2500": 2500, "v3000": 3000, "v4000": 4000, "v5000": 5000, "v6000": 6000, "v7000": 7000}, selected="v100")
list_12 = ValueList({"fine": -1, "z0": 0, "z1": 1, "z5": 5, "z10": 10, "z15": 15, "z20": 20, "z30": 30, "z40": 40, "z50": 50, "z60": 60, "z80": 80, "z100": 100, "z150": 150, "z200": 200}, selected="fine")
slcc = SetLinearConfigurationControl(IsActive=toggle)
sjcc = SetJointConfigurationControl(IsActive=toggle)
sjcc_2 = SetJointConfigurationControl(IsActive=Toggle(True))
sjcc_3 = SetJointConfigurationControl(IsActive=Toggle(False))
M = Move(
    Type=list_9,
    Target=jt,
    SpeedData=sd,
    Override_Robot_Tool=False,
    Override_Work_Object=False,
    Set_Digital_Output=False,
    Set_Movement_Time=False)
M_2 = Move(
    Type=list_8,
    Target=rt_2,
    SpeedData=sd,
    Override_Robot_Tool=False,
    Override_Work_Object=False,
    Set_Digital_Output=False,
    Set_Movement_Time=False)
M_3 = Move(
    Type=list_7,
    Target=rt,
    SpeedData=list_11,
    ZoneData=list_12,
    Override_Robot_Tool=False,
    Override_Work_Object=False,
    Set_Digital_Output=False,
    Set_Movement_Time=False)
M_4 = Move(
    Type=list_4,
    Target=rt_2,
    SpeedData=sd,
    Override_Robot_Tool=False,
    Override_Work_Object=False,
    Set_Digital_Output=False,
    Set_Movement_Time=False)
M_5 = Move(
    Type=list_5,
    Target=rt_4,
    SpeedData=sd,
    Override_Robot_Tool=False,
    Override_Work_Object=False,
    Set_Digital_Output=False,
    Set_Movement_Time=False)
M_6 = Move(
    Type=list_6,
    Target=rt_3,
    SpeedData=list_10,
    Override_Robot_Tool=False,
    Override_Work_Object=False,
    Set_Digital_Output=False,
    Set_Movement_Time=False)
M_7 = Move(
    Type=list_3,
    Target=rt_4,
    SpeedData=sd,
    Override_Robot_Tool=False,
    Override_Work_Object=False,
    Set_Digital_Output=False,
    Set_Movement_Time=False)
cl = CodeLine(Code=panel_3, Type=list)
C = Code(Code=" ", Type=list_2)

# ----
# Utility: Plane visualizer
pv = PlaneVisualizer(Plane=derobtool.ToolPlane)

# ----
# Code Generation: Bundeling
weave = Weave(
    Pattern=[0, 1, 2, 3, 4, 5, 6, 7, 8, 9, 10, 11],
    Stream0=cl,
    Stream1=sjcc_2,
    Stream2=M_2,
    Stream3=sjcc_3,
    Stream4=graft(M_3),
    Stream5=group_2,
    Stream6=M_4,
    Stream7=M_5,
    Stream8=graft(M_6),
    Stream9=group,
    Stream10=M_7,
    Stream11=C,
    NullGaps=False)
merge_3 = Merge(Data1=flatten(slcc), Data2=flatten(sjcc), Data3=flatten(M), Data4=flatten(weave), Data5=flatten(M))

# ----
# Path Generator
# It allows to compute the robot path and simulate its execution. For programs
# with large number of targets, a button can be plugged in the U input, to avoid
# recomputing the toolpath at every stage.
# 
# !!! WARNING !!!
# While RobotComponents toolpath generator is fairly accurate, there is no
# provided guarantee that the simulated toolpath will not differ when executing
# on a real robot. Always use a suitable simulation engine (e.g. RobotStudio)
# before uploading code to a real robot.
number_slider_7 = Slider(0.5, range=0..1)
# Right-click on the component to add more
# output parameters via the menu-items.
pg = PathGenerator(
    Robot=robpres,
    Action=merge_3,
    Interpolations=Slider(10, range=0..10),
    AnimationSlider=number_slider_7,
    Update=Button(),
    Output_Error_Messages=False,
    Output_External_Axis_Planes=False,
    Output_External_Joint_Position=False,
    Output_External_Joint_Positions=False,
    Output_Movement=False,
    Output_Movements=False,
    Output_Robot_End_Plane=False,
    Output_Robot_End_Planes=False,
    Output_Robot_Joint_Position=False,
    Output_Robot_Joint_Positions=True,
    Set_Preview_Mesh=True)  # -> RobotJointPosition, Path

# ----
# Code Generation: Base and Main Code Generation
# Contains Robot Movement Instructions
# If you want to save the
# RAPID code to a file
# you can right-click on
# the component and
# select one of the menu
# items.
# Contains Robot Tool Definitions
rg = RAPIDGenerator(
    Robot=robpres,
    Action=merge_3,
    Custom_System_Code_Lines=False,
    Program_Module_Name=False,
    RAPID_Procedure_Name=False,
    System_Module_Name=False)  # -> ProgramModule, SystemModule
panel_4 = Panel(rg.ProgramModule)
panel_5 = Panel(rg.SystemModule)

# ----
# Pick controller
button = Button()
gc = GetController(Update=button)

# ----
# Remote connection: RAPID code upload
toggle_2 = BooleanToggle(True)
remote_connection = RemoteConnection(
    RobotController=gc,
    Connect=toggle_2,
    Upload=Button(),
    Run=Button(),
    Stop=Button(),
    MainCode=rg.ProgramModule,
    BaseCode=rg.SystemModule)
panel_6 = Panel(remote_connection)

# ----
# Simulation: Realtime robot pose visualization
timer = Timer(TimerInterval=20, Target=ga)  # disabled
ga = GetAxisValues(RobotController=gc)  # -> RobotJointPosition, ExternalAxisValues
fk_2 = ForwardKinematics(Robot=robpres, RobotJointPosition=ga.RobotJointPosition, Set_Hide_Mesh=False)  # -> PosedMeshes, EndPlane, ExternalAxisPlanes

# ----
# Read the state of a digital input
panel_7 = Panel("DI_1")
getdi = GetDigitalInput(RobotController=gc, DIName=panel_7)

# ----
# Read the state of a digital output
panel_8 = Panel("DO_1")
getdo = GetDigitalOutput(RobotController=gc, DOName=panel_8)

# ----
# Set the state of a digital input
panel_9 = Panel("DI_1")
setdi = SetDigitalInput(RobotController=gc, DIName=panel_9, State=Toggle(False), Update=Button())

# ----
# Set the state of a digital output
panel_10 = Panel("DO_1")
setdo = SetDigitalOutput(RobotController=gc, DOName=panel_10, State=Toggle(False), Update=Button())

# ----
# Controller Utility: Realtime Connection
panel_11 = Panel(getdi)

bool = Boolean(getdi)

# ----
# Display robot joint positions of the whole path
deconrobjoint = DeconstructRobotJointPosition(RobotJointPosition=pg.RobotJointPosition)  # -> Name, RobotJointPosition1, RobotJointPosition2, RobotJointPosition3, RobotJointPosition4, RobotJointPosition5, RobotJointPosition6
graph = QuickGraph(deconrobjoint.RobotJointPosition1, SortOrder=0)
graph_2 = QuickGraph(deconrobjoint.RobotJointPosition2, SortOrder=0)
graph_3 = QuickGraph(deconrobjoint.RobotJointPosition3, SortOrder=0)
graph_4 = QuickGraph(deconrobjoint.RobotJointPosition4, SortOrder=0)
graph_5 = QuickGraph(deconrobjoint.RobotJointPosition5, SortOrder=0)
graph_6 = QuickGraph(deconrobjoint.RobotJointPosition6, SortOrder=0)
