# Grasshopper definition CALIBRATION_03_Multi_move_two_robots.gh (Grasshopper 1.0.7)
# plug-ins: Robot Components

# ----
# World coordinate space
xy = XYPlane(Origin=Point(0, 0, 0))
pv = PlaneVisualizer(Plane=xy)

# ----
# License info
I = Info()
panel = Panel(I)

# ----
# (1) T_ROB1 positioned at world XY
robpres = RobotPreset(PositionPlane=PlaneXY(0, 0, 0))

# ----
# (3) Get the three points in robot coordinate space of the second robot T_ROB2
# Jog with the second robot tcp to same points and internalize them
gc = GetController(Update=True)  # disabled
list = ValueList({"World": 1, "Base": 2, "Work Object": 4}, selected="Base")
timer = Timer(Interval=20, TimerInterval=20, Target=gp)  # disabled
gp = GetPlane(RobotController=gc, CoordinateSystem=list)  # -> Plane, Name
pt = Point(gp.Plane)

# ----
# (2) Get three points in world coordinate space of T_ROB1
# Jog with the robot tcp to three these points and internalize them
gc_2 = GetController(Update=True)  # disabled
list_2 = ValueList({"World": 1, "Base": 2, "Work Object": 4}, selected="World")
timer_2 = Timer(Interval=20, TimerInterval=20, Target=gp_2)  # disabled
gp_2 = GetPlane(RobotController=gc_2, CoordinateSystem=list_2)  # -> Plane, Name
item = ListItem(List=gp_2.Plane, Index="0", Wrap=True)
pt_2 = Point(item)

pt_3 = Point(Point(1477.436921, -237.1942168, -0.6981222769))
pt_4 = Point(Point(719.1739709, 286.6789492, -11.15588617))
pt_5 = Point(Point(851.6907408, -352.4099077, -0.08295969486))
pl_3pt = Plane3Pt(PointA=pt_5, PointB=pt_3, PointC=pt_4)

pt_6 = Point(Point(811.1467156, 500.6426722, 0))
pt_7 = Point(Point(847.2984293, -134.5945818, 0))
pt_8 = Point(Point(1461.877561, 552.2879774, 0))
pl_3pt_2 = Plane3Pt(PointA=pt_6, PointB=pt_7, PointC=pt_8)

# ----
# ALTERNATIVE:
# Or if you used the calibration procedure
# of ABB and you defined the robot position
# through the flex pendant you can convert
# the obtained values to a plane.
panel_2 = Panel("1301.64")
qtop = QuaternionToPlane(
    CoordX="1267.12",
    CoordY=panel_2,
    CoordZ="7.843",
    QuaternionA="-0.661445",
    QuaternionB="-0.006381",
    QuaternionC="0.005628",
    QuaternionD="0.749945")

# ----
# (4) Orient the XY base frame to the real location in the world coordinate space
xy_2 = XYPlane(Origin=Point(0, 0, 0))
orient = Orient(Geometry=xy_2, Source=pl_3pt, Target=pl_3pt_2)  # -> Geometry, Transform
robpres_2 = RobotPreset(PositionPlane=orient.Geometry)

orient_2 = Orient(Geometry=pl_3pt, Source=PlaneXY(0, 0, 0), Target=orient.Geometry)  # -> Geometry, Transform
pv_2 = PlaneVisualizer(Plane=orient_2.Geometry)

# ----
# OPTIONAL: This data can also be used to make a work object
panel_3 = Panel("wobj1")
workobj = WorkObject(Name=panel_3, Plane=pl_3pt_2)
rec_3pt = Rectangle3Pt(PointA=pt_6, PointB=pt_7, PointC=pt_8)  # -> Rectangle, Length
srf = Surface(rec_3pt.Rectangle)

# ----
# Base frame T_ROB2
ptoq = PlaneToQuaternion(Plane=orient.Geometry, ReferencePlane=PlaneXY(0, 0, 0))  # -> CoordX, CoordY, CoordZ, QuaternionA, QuaternionB, QuaternionC, QuaternionD
panel_4 = Panel(ptoq.QuaternionB)
panel_5 = Panel(ptoq.CoordX)
panel_6 = Panel(ptoq.CoordY)
panel_7 = Panel(ptoq.CoordZ)
panel_8 = Panel(ptoq.QuaternionA)
panel_9 = Panel(ptoq.QuaternionC)
panel_10 = Panel(ptoq.QuaternionD)
