# Grasshopper definition BASIC_06_Circular_movements.gh (Grasshopper 1.0.7)
# plug-ins: Robot Components

# ----
# License info
I = Info()
panel = Panel(I)

# ----
# Create planes, targets and movements
pt = Point(Point(623.3059869, 779.1108148, 152.1753504))
pt_2 = Point(Point(917.5321519, 662.6019026, 237.6860439))
pt_3 = Point(Point(772.108758, 209.2674172, 222.2502355))
flip_plane_x = FlipPlaneX(Plane=pt_2)
xy = XYPlane(Origin=pt)
xz = XZPlane(Origin=pt_3)
prot = RotatePlane(Plane=xy, Angle=degrees(Slider(-15, range=-180..180)))
prot_2 = RotatePlane(Plane=xz, Angle=degrees(Slider(-91, range=-180..180)))
flip_plane_y = FlipPlaneY(Plane=prot)
flip_plane_y_2 = FlipPlaneY(Plane=prot_2)
rt = RobotTarget(
    Name="start_point",
    Plane=flip_plane_y,
    AxisConfiguration=0,
    Set_External_Joint_Position=False,
    Set_Reference_Plane=False)
rt_2 = RobotTarget(
    Name="interior_point",
    Plane=flip_plane_x,
    AxisConfiguration=0,
    Set_External_Joint_Position=False,
    Set_Reference_Plane=False)
rt_3 = RobotTarget(
    Name="end_point",
    Plane=flip_plane_y_2,
    AxisConfiguration=0,
    Set_External_Joint_Position=False,
    Set_Reference_Plane=False)
list = ValueList({"PathFrame": 0, "ObjectFrame": 1, "CirPointOri": 2, "Wrist45": 3, "Wrist46": 4, "Wrist56": 5}, selected="PathFrame")
list_2 = ValueList({"MoveAbsJ": 0, "MoveL": 1, "MoveJ": 2, "MoveC": 3}, selected="MoveAbsJ")
list_3 = ValueList({"MoveAbsJ": 0, "MoveL": 1, "MoveJ": 2, "MoveC": 3}, selected="MoveJ")
list_4 = ValueList({"MoveAbsJ": 0, "MoveL": 1, "MoveJ": 2, "MoveC": 3}, selected="MoveC")
list_5 = ValueList({"v5": 5, "v10": 10, "v20": 20, "v30": 30, "v40": 40, "v50": 50, "v60": 60, "v80": 80, "v100": 100, "v150": 150, "v200": 200, "v300": 300, "v400": 400, "v500": 500, "v600": 600, "v800": 800, "v1000": 1000, "v1500": 1500, "v2000": 2000, "v2500": 2500, "v3000": 3000, "v4000": 4000, "v5000": 5000, "v6000": 6000, "v7000": 7000}, selected="v200")
list_6 = ValueList({"v5": 5, "v10": 10, "v20": 20, "v30": 30, "v40": 40, "v50": 50, "v60": 60, "v80": 80, "v100": 100, "v150": 150, "v200": 200, "v300": 300, "v400": 400, "v500": 500, "v600": 600, "v800": 800, "v1000": 1000, "v1500": 1500, "v2000": 2000, "v2500": 2500, "v3000": 3000, "v4000": 4000, "v5000": 5000, "v6000": 6000, "v7000": 7000}, selected="v200")
list_7 = ValueList({"v5": 5, "v10": 10, "v20": 20, "v30": 30, "v40": 40, "v50": 50, "v60": 60, "v80": 80, "v100": 100, "v150": 150, "v200": 200, "v300": 300, "v400": 400, "v500": 500, "v600": 600, "v800": 800, "v1000": 1000, "v1500": 1500, "v2000": 2000, "v2500": 2500, "v3000": 3000, "v4000": 4000, "v5000": 5000, "v6000": 6000, "v7000": 7000}, selected="v100")
cpm = CirclePathMode(Mode=list)
M = Move(
    Type=list_2,
    Target="0,0,0,0,45,0",
    SpeedData=list_5,
    Override_Robot_Tool=False,
    Override_Work_Object=False,
    Set_Circular_Point=False,
    Set_Digital_Output=False,
    Set_Movement_Time=False)
M_2 = Move(
    Type=list_3,
    Target=rt,
    SpeedData=list_6,
    Override_Robot_Tool=False,
    Override_Work_Object=False,
    Set_Circular_Point=False,
    Set_Digital_Output=False,
    Set_Movement_Time=False)
# Right-click on the component to add or
# remove the circular point input parameter.
M_3 = Move(
    Type=list_4,
    RobotTarget=rt_2,
    Target=rt_3,
    SpeedData=list_7,
    Override_Robot_Tool=False,
    Override_Work_Object=False,
    Set_Circular_Point=True,
    Set_Digital_Output=False,
    Set_Movement_Time=False)

# ----
# Robot end-effector
pt_4 = Point(Point(-20, 0, 60))
xy_2 = XYPlane(Origin=pt_4)
brep = Brep([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])
prot_3 = RotatePlane(Plane=xy_2, Angle=degrees("180"))
mesh = Mesh(brep)
robtool = RobotTool(
    Name="tool1",
    Mesh=mesh,
    AttachmentPlane=PlaneXY(0, 0, 0),
    ToolPlane=prot_3,
    Set_Center_of_Gravity=False,
    Set_Mass=False,
    Set_Moment_of_Inertia=False)

# ----
# Robot definition
irb1600 = ABBIRB1600X145(PositionPlane=PlaneXY(0, 0, 0), RobotTool=robtool)

merge = Merge(Data1=flatten(cpm), Data2=flatten(M), Data3=flatten(M_2), Data4=flatten(M_3), Data5=flatten(M))

# ----
# Path Generator
# It allows to compute the robot path and simulate its execution. For programs
# with large number of targets, a button can be plugged in the U input, to avoid
# recomputing the toolpath at every stage.
# 
# !!! WARNING !!!
# While RobotComponents toolpath generator is fairly accurate, there is no
# provided guarantee that the simulated toolpath will not differ when executing
# on a real robot. Always use a suitable simulation engine (e.g. RobotStudio)
# before uploading code to a real robot.
number_slider = Slider(0.5155, range=0..1)
pg = PathGenerator(
    Robot=irb1600,
    Action=merge,
    Interpolations=Slider(100, range=0..100),
    AnimationSlider=number_slider,
    Update=True,
    Output_Error_Messages=False,
    Output_External_Axis_Planes=False,
    Output_External_Joint_Position=False,
    Output_External_Joint_Positions=False,
    Output_Movement=False,
    Output_Movements=False,
    Output_Path=True,
    Output_Posed_Meshes=False,
    Output_Robot_End_Plane=True,
    Output_Robot_End_Planes=False,
    Output_Robot_Joint_Position=False,
    Output_Robot_Joint_Positions=False,
    Preview_Path=True,
    Preview_Posed_Meshes=True)  # -> Path, RobotEndPlane

# ----
# Code generator
# If you want to save the
# RAPID code to a file
# you can right-click on
# the component and
# select one of the menu
# items.
rg = RAPIDGenerator(
    Robot=irb1600,
    Action=merge,
    Add_tooldata=False,
    Add_wobjdata=False,
    Module_Name=False,
    Output_tooldata=False,
    Output_wobjdata=False,
    Routine_Name=False)
panel_2 = Panel(rg)

# ----
# Right-click on the component to add more
# output parameters via the menu-items.
pv = PlaneVisualizer(Plane=pg.RobotEndPlane)

# ----
# Controller Utility: Connect to a physical or virtual controller
button = Button()
getcont = GetController(Update=button, From_Menu=False)
timer = Timer(TimerInterval=20, Target=getjp)  # disabled
getjp = GetRobotJointPositions(Controller=getcont)  # -> Name, RobotJointPosition
up = UploadProgram(Controller=getcont, Upload=Button(), Module=rg, From_Menu=False, Task_Name="T_ROB1")
rp = RunProgram(Controller=getcont, Run=Button(), Stop=Button(), Reset=Button())
fk = ForwardKinematics(Robot=irb1600, RobotJointPosition=getjp.RobotJointPosition, Hide_Posed_Meshes=False, Output_Posed_Meshes=False)  # -> EndPlane, ExternalAxisPlanes
panel_3 = Panel(up)
panel_4 = Panel(rp)
pv_2 = PlaneVisualizer(Plane=fk.EndPlane)

rec = DataRecorder(fk.EndPlane, DataLimit=-10, RecordData=False)
pv_3 = PlaneVisualizer(Plane=rec)
