# Grasshopper definition BASIC_07_Casting_methods.gh (Grasshopper 1.0.7)
# plug-ins: Robot Components

# ----
# License info
I = Info()
panel = Panel(I)

# ----
# Actions
# Action and Action Group
toggle = BooleanToggle(False)
sdo = SetDigitalOutput(Name="DO_01", State=Toggle(True))
wt = WaitForTime(InPosition=toggle, Duration="2.0")
merge = Merge(Data1=wt, Data2=sdo, Data3=wt)
group = Group(Objects=merge)
A = Action(group)
ag = ActionGroup(group)
ungroup = UngroupActions(ActionGroup=ag)
panel_2 = Panel(A)
panel_3 = Panel(ungroup)

# ----
# Robot Target
panel_4 = Panel("VAR robtarget target2 := [[500.54, -343.13, 89.98], [0.707107, 0.707107, 0, 0], [0,0,0,0], [9E9, 6000, 9E9, 9E9, 9E9, 9E9]];")
panel_5 = Panel("[[500.54, -343.13, 89.98], [0.707107, 0.707107, 0, 0], [0,0,0,0], [2400.1, 9E9, 9E9, 9E9, 9E9, 9E9]]")
pt = ConstructPoint(
    XCoordinate=Slider(-217, range=-1000..1000),
    YCoordinate=Slider(323, range=-1000..1000),
    ZCoordinate=Slider(-18, range=-1000..1000))
xy = XYPlane(Origin=Point(0, 0, 0))
merge_2 = Merge(Data1=xy, Data2=pt, Data3=panel_5, Data4=panel_4)
rt = RobotTarget(merge_2)
pln = Plane(rt)
cd = ConfigurationData(rt)
pt_2 = Point(rt)
ej = ExternalJointPosition(rt)
panel_6 = Panel(pln)
panel_7 = Panel(ej)
panel_8 = Panel(cd)
panel_9 = Panel(pt_2)

# ----
# Declarations
# External Joint Position
panel_10 = Panel("[9E9, 867.5, 893.2, 9E9, 9E9, 9E9]")
panel_11 = Panel("LOCAL CONST extjoint pos2 := [9E9, 9E9, 9E9, 9E9, 9E9, 456.7];")
merge_3 = Merge(
    Data1=Slider(450.5, range=0..1000),
    Data2=panel_10,
    Data3="CONST extjoint pos1 := [9E9, 9E9, 9E9, 9E9, 6001.97, 9E9];",
    Data4=panel_11)
ej_2 = ExternalJointPosition(merge_3)
panel_12 = Panel(ej_2)

# ----
# Robot Joint Position
panel_13 = Panel("0.0, 0.0, 0.0, 0.0, 45.0, 0.0")
panel_14 = Panel("TASK VAR robjoint pos4 := [0.0, -45.0, 45.0, 0.0, 45.0, 0.0];")
merge_4 = Merge(Data1=panel_13, Data2="CONST robjoint pos3 := [45.0, 0.0, 0.0, 90.0, 45.0, 0.0];", Data3=panel_14)
rj = RobotJointPosition(merge_4)
panel_15 = Panel(rj)

# ----
# Target
panel_16 = Panel("LOCAL CONST jointtarget target3 := [[0, 30, -30, 0, 45, 0], [9E9, 9E9, 9E9, 9E9, 9E9, 9E9]];")
panel_17 = Panel("[[0, 30, -30, 0, 45, 0], [9E9, 9E9, 300.45, 9E9, 9E9, 9E9]]")
panel_18 = Panel("VAR robtarget target4 := [[500.54, -343.13, 89.98], [0.707107, 0.707107, 0, 0], [0,0,0,0], [9E9, 9E9, 9E9, 9E9, 9E9, 9E9]];")
panel_19 = Panel("[[500.54, -343.13, 89.98], [0.707107, 0.707107, 0, 0], [0,0,0,0], [9E9, 9E9, 9E9, 9E9, 9E9, 9E9]]")
xy_2 = XYPlane(Origin=Point(0, 0, 0))
rt_2 = RobotTarget(Plane=xy_2, Set_External_Joint_Position=False, Set_Reference_Plane=False)
jt = JointTarget()
pt_3 = ConstructPoint(
    XCoordinate=Slider(-217, range=-1000..1000),
    YCoordinate=Slider(323, range=-1000..1000),
    ZCoordinate=Slider(-18, range=-1000..1000))
xy_3 = XYPlane(Origin=Point(0, 0, 0))
merge_5 = Merge(
    Data1=rt_2,
    Data2=jt,
    Data3=xy_3,
    Data4=pt_3,
    Data5=panel_16,
    Data6=panel_17,
    Data7="0, 0, 0, 0, 45, 0",
    Data8=panel_18,
    Data9=panel_19)
T = Target(merge_5)
jt_2 = JointTarget(T)
rt_3 = RobotTarget(T)
ej_3 = ExternalJointPosition(T)
panel_20 = Panel(jt_2)
panel_21 = Panel(rt_3)
panel_22 = Panel(ej_3)

# ----
# Joint Target
panel_23 = Panel("LOCAL CONST jointtarget target1 := [[0, 30, -30, 0, 45, 0], [9E9, 9E9, 9E9, 9E9, 9E9, 9E9]];")
rj_2 = RobotJointPosition(
    RobotJointPosition1=0,
    RobotJointPosition2=0,
    RobotJointPosition3=0,
    RobotJointPosition4=0,
    RobotJointPosition5=0,
    RobotJointPosition6=0)
merge_6 = Merge(Data1=rj_2, Data2=panel_23, Data3="[0, 0, 0, 0, 90, 0], [9E9, 9E9, 300.45, 9E9, 9E9, 9E9]", Data4="0, 0, 0, 0, 45, 0")
jt_3 = JointTarget(merge_6)
rj_3 = RobotJointPosition(jt_3)
ej_4 = ExternalJointPosition(jt_3)
panel_24 = Panel(rj_3)
panel_25 = Panel(ej_4)

# ----
# Speed Data
panel_26 = Panel("VAR speeddata speed1 := [5, 500, 5000, 1000];")
list = ValueList({"v5": 5, "v10": 10, "v20": 20, "v30": 30, "v40": 40, "v50": 50, "v60": 60, "v80": 80, "v100": 100, "v150": 150, "v200": 200, "v300": 300, "v400": 400, "v500": 500, "v600": 600, "v800": 800, "v1000": 1000, "v1500": 1500, "v2000": 2000, "v2500": 2500, "v3000": 3000, "v4000": 4000, "v5000": 5000, "v6000": 6000, "v7000": 7000}, selected="v5")
merge_7 = Merge(Data1=list, Data2="v100", Data3="200", Data4=panel_26, Data5="150.5, 500, 5000, 1000")
sd = SpeedData(merge_7)
panel_27 = Panel(sd)

# ----
# Configuration Data
panel_28 = Panel("CONST confdata conf1 := [0, 0, 0, 1];")
merge_8 = Merge(Data1=Slider(2, range=0..7), Data2=panel_28, Data3="[0, 0, 0, 4]")
cd_2 = ConfigurationData(merge_8)
int = Integer(cd_2)
num = Number(cd_2)
panel_29 = Panel(num)
panel_30 = Panel(int)

# ----
# Zone Data
panel_31 = Panel("LOCAL CONST zonedata zone1 := [FALSE, 5, 8, 8, 0.8, 8, 0.8];")
list_2 = ValueList({"z0": 0, "z1": 1, "z5": 5, "z10": 10, "z15": 15, "z20": 20, "z30": 30, "z40": 40, "z50": 50, "z60": 60, "z80": 80, "z100": 100, "z150": 150, "z200": 200, "fine": -1}, selected="z1")
merge_9 = Merge(Data1=list_2, Data2="z1", Data3="10", Data4=panel_31, Data5="FALSE, 1, 2, 6, 1.6, 16, 1.8")
zd = ZoneData(merge_9)
panel_32 = Panel(zd)

# ----
# Overwrite Robot Tool
robtool = RobotTool(Name="tool1", AttachmentPlane=PlaneXY(0, 0, 0), ToolPlane=PlaneXY(0, 0, 0))
ort = OverrideRobotTool(robtool)
rt_4 = RobotTool(ort)
panel_33 = Panel(rt_4)

# ----
# Pulse Digital Output
number_slider = Slider(10, range=0..10)
pdo = PulseDigitalOutput(High=Toggle(False), Length=number_slider, Name="DO_01")
pdop = PulseDigitalOutput(pdo)
num_2 = Number(pdop)
bool = Boolean(pdop)
panel_34 = Panel(num_2)
panel_35 = Panel(bool)

# ----
# Set Analog Output
number_slider_2 = Slider(4.9, range=0..10)
sao = SetAnalogOutput(Name="AO_01", Value=number_slider_2)
saop = SetAnalogOutput(sao)
num_3 = Number(saop)
panel_36 = Panel(num_3)

# ----
# Acceleration Set
asp = AccelerationSet()

# ----
# Joint Configuration Control
toggle_2 = BooleanToggle(True)
jccp = JointConfigurationControl(toggle_2)
bool_2 = Boolean(jccp)
panel_37 = Panel(bool_2)

# ----
# Linear Configuration Control
toggle_3 = BooleanToggle(False)
lccp = LinearConfigurationControl(toggle_3)
bool_3 = Boolean(lccp)
panel_38 = Panel(bool_3)

# ----
# Wait for Time
number_slider_3 = Slider(2, range=0..10)
wt_2 = WaitForTime(number_slider_3)
num_4 = Number(wt_2)
bool_4 = Boolean(wt_2)
panel_39 = Panel(num_4)
panel_40 = Panel(bool_4)

# ----
# Velocity Set
vsp = VelocitySet()

# ----
# Path Acceleration Limitation
palp = PathAccelerationLimitation()

# ----
# Circle Path Mode
cpmp = CirclePathMode()

# ----
# Wait for Analog Input
number_slider_4 = Slider(4.9, range=0..10)
list_3 = ValueList({"LT": 0, "GT": 1}, selected="GT")
wai = WaitForAnalogInput(Name="AI_01", Value=number_slider_4, Inequalty=list_3)
wai_2 = WaitForAnalogInput(wai)
num_5 = Number(wai_2)
panel_41 = Panel(num_5)

# ----
# Set Digital Output
toggle_4 = BooleanToggle(True)
sdo_2 = SetDigitalOutput(Name="DO_01", State=toggle_4)
sdop = SetDigitalOutput(sdo_2)
bool_5 = Boolean(sdop)
panel_42 = Panel(bool_5)

# ----
# Wait for Digital Input
toggle_5 = BooleanToggle(True)
wdi = WaitForDigitalInput(Name="DI_01", State=toggle_5)
wdi_2 = WaitForDigitalInput(wdi)
bool_6 = Boolean(wdi_2)
panel_43 = Panel(bool_6)

# ----
# Comment
panel_44 = Panel("Comment (instruction by default)")
C = Comment(panel_44)
panel_45 = Panel(C)

# ----
# Dynamic
# Code Line
panel_46 = Panel("! Custom code line (instruction by default)")
clp = CodeLine(panel_46)
panel_47 = Panel(clp)

# ----
# Task List
panel_48 = Panel("PERS tasks my_tasks{2} := [[\"T_ROB1\"], [\"T_ROB2\"]];")
tl = TaskList(panel_48)
panel_49 = Panel(tl)

# ----
# Wait Sync Task
wst = WaitSyncTask()

# ----
# Multi Move
# Sync Move On
smon = SyncMoveOn()

# ----
# Sync Move Off
smoff = SyncMoveOff()

# ----
# Load Data
panel_50 = Panel("[0.001, [0, 0, 0.001], [1, 0, 0, 0], 0, 0, 0]")
panel_51 = Panel("PERS loaddata my_load := [2.1, [20.1, 90.7, 3.1], [0.5, 0, 0, 0.5], 0, 0, 0]")
loda = LoadData(Name="load1", Mass=0.001)
merge_10 = Merge(Data1=loda, Data2=panel_51, Data3=panel_50)
ldp = LoadData(merge_10)
num_6 = Number(ldp)
pt_4 = Point(ldp)
vec = Vector(ldp)
panel_52 = Panel(num_6)
panel_53 = Panel(vec)
panel_54 = Panel(pt_4)

# ----
# Robot Tool
panel_55 = Panel("PERS tooldata parallel_gripper := [TRUE, [[215.448, 3.171, 102.332], [0.5, 0.5, 0.5, 0.5]], [0.001, [0, 0, 0.001], [1, 0, 0, 0], 0, 0, 0]];")
rt_5 = RobotTool(panel_55)
mesh = Mesh(rt_5)
pln_2 = Plane(rt_5)
pt_5 = Point(rt_5)
vec_2 = Vector(rt_5)
ldp_2 = LoadData(rt_5)
panel_56 = Panel(mesh)
panel_57 = Panel(pln_2)
panel_58 = Panel(pt_5)
panel_59 = Panel(ldp_2)
panel_60 = Panel(vec_2)

# ----
# Work Object
panel_61 = Panel("PERS wobjdata wobj1 := [FALSE, TRUE, \"\", [[0, 0, 0], [1, 0, 0, 0]], [[0.0009, -0.0082, 8.0304], [0.9999999, 0.0005131, 0.0000556, 0]]];")
wo = WorkObject(panel_61)
ea = ExternalAxis(wo)
pln_3 = Plane(wo)
pt_6 = Point(wo)
panel_62 = Panel(ea)
panel_63 = Panel(pln_3)
panel_64 = Panel(pt_6)

# ----
# External Axis
number_slider_5 = Slider(2, range=0..10)
# Definitions
panel_65 = Panel("linear_axis")
xy_4 = XYPlane(Origin=Point(0, 0, 0))
xy_5 = XYPlane(Origin=Point(0, 0, 0))
Z = UnitZ(Factor=1)
external_rotational_axis = ExternalRotationalAxis(Name="rotational_axis", AxisPlane=xy_5, AxisLimits="-360 To 360", Set_Axis_Logic_Number=False, Set_Moves_Robot=False)
external_linear_axis = ExternalLinearAxis(
    Name=panel_65,
    AttachmentPlane=xy_4,
    Axis=Z,
    AxisLimits="0 To 1000",
    AxisLogicNumber=number_slider_5,
    MovesRobot=Toggle(True),
    Set_Axis_Logic_Number=True,
    Set_Moves_Robot=True)
merge_11 = Merge(Data1=external_linear_axis, Data2=external_rotational_axis)
ea_2 = ExternalAxis(merge_11)
pln_4 = Plane(ea_2)
pt_7 = Point(ea_2)
vec_3 = Vector(ea_2)
bool_7 = Boolean(ea_2)
domain = Domain(ea_2)
num_7 = Number(ea_2)
panel_66 = Panel(bool_7)
panel_67 = Panel(pln_4)
panel_68 = Panel(pt_7)
panel_69 = Panel(vec_3)
panel_70 = Panel(domain)
panel_71 = Panel(num_7)

# ----
# Robot
irb1010 = ABBIRB101015037(PositionPlane=PlaneXY(0, 0, 0))
R = Robot(irb1010)
rt_6 = RobotTool(R)
panel_72 = Panel(rt_6)

# ----
# Mechanical Unit
mu = MechanicalUnit()

# ----
# External Rotational Axis
panel_73 = Panel("rotational_axis")
xy_6 = XYPlane(Origin=Point(0, 0, 0))
external_rotational_axis_2 = ExternalRotationalAxis(
    Name=panel_73,
    AxisPlane=xy_6,
    AxisLimits="-360 To 360",
    AxisLogicNumber="c",
    MovesRobot=Toggle(False),
    Set_Axis_Logic_Number=True,
    Set_Moves_Robot=True)
era = ExternalRotationalAxis(external_rotational_axis_2)
pln_5 = Plane(era)
pt_8 = Point(era)
vec_4 = Vector(era)
domain_2 = Domain(era)
bool_8 = Boolean(era)
num_8 = Number(era)
panel_74 = Panel(pt_8)
panel_75 = Panel(domain_2)
panel_76 = Panel(bool_8)
panel_77 = Panel(pln_5)
panel_78 = Panel(vec_4)
panel_79 = Panel(num_8)

# ----
# External Linear Axis
toggle_6 = BooleanToggle(False)
xy_7 = XYPlane(Origin=Point(0, 0, 0))
Z_2 = UnitZ(Factor=1)
external_linear_axis_2 = ExternalLinearAxis(
    Name="linear_axis",
    AttachmentPlane=xy_7,
    Axis=Z_2,
    AxisLimits="0 To 2000",
    AxisLogicNumber="b",
    MovesRobot=toggle_6,
    Set_Axis_Logic_Number=True,
    Set_Moves_Robot=True)
ela = ExternalLinearAxis(external_linear_axis_2)
vec_5 = Vector(ela)
domain_3 = Domain(ela)
bool_9 = Boolean(ela)
pln_6 = Plane(ela)
pt_9 = Point(ela)
num_9 = Number(ela)
crv = Curve(ela)
panel_80 = Panel(pln_6)
panel_81 = Panel(domain_3)
panel_82 = Panel(num_9)
panel_83 = Panel(pt_9)
panel_84 = Panel(vec_5)
panel_85 = Panel(bool_9)
panel_86 = Panel(crv)

# ----
# Practical example #4
button = Button()
getcont = GetController(Update=button, From_Menu=False)
timer = Timer(TimerInterval=20, Target=readrapid)  # disabled
readrapid = ReadRapidDomain(Controller=getcont, Task="T_ROB1", Module="MainModule", Symbol="my_robot_target")
rt_7 = RobotTarget(readrapid)

# ----
# Pratical examples
# Practical example #1
panel_87 = Panel("LOCAL CONST robtarget my_target := [[500.54, -343.13, 89.98], [0.707107, 0.707107, 0, 0], [0,0,0,0], [9E9, 9E9, 9E9, 9E9, 9E9, 9E9]];")
panel_88 = Panel("LOCAL CONST zonedata my_zone := [FALSE, 5, 8, 8, 0.8, 8, 0.8];")
list_4 = ValueList({"MoveAbsJ": 0, "MoveL": 1, "MoveJ": 2}, selected="MoveJ")
M = Move(
    Type=list_4,
    Target=panel_87,
    SpeedData="LOCAL CONST speeddata my_speed := [5, 500, 5000, 1000];",
    ZoneData=panel_88,
    Override_Robot_Tool=False,
    Override_Work_Object=False,
    Set_Circular_Point=False,
    Set_Digital_Output=False,
    Set_Movement_Time=False)
irb1600 = ABBIRB1600X145(PositionPlane=PlaneXY(0, 0, 0))
pv = PlaneVisualizer(Plane=M)
ik = InverseKinematics(Robot=irb1600, Movement=M, Closest_Robot_Joint_Position=False, Output_Posed_Meshes=False, Set_Hide_Mesh=False)  # -> RobotJointPosition, ExternalJointPosition
rg = RAPIDGenerator(
    Robot=irb1600,
    Action=M,
    Add_loaddata=False,
    Add_tooldata=False,
    Add_wobjdata=False,
    Module_Name=False,
    Output_loaddata=False,
    Output_tooldata=False,
    Output_wobjdata=False,
    Routine_Name=False)
panel_89 = Panel(rg)

# ----
# Practical example #3
panel_90 = Panel("-90, -30, 30, 0, 0, 0")
jt_4 = JointTarget()
irb7600 = ABBIRB760034028(PositionPlane=PlaneXY(0, 0, 0))
merge_12 = Merge(Data1=jt_4, Data2=panel_90)
fk = ForwardKinematics(Robot=irb7600, RobotJointPosition=merge_12, Hide_Posed_Meshes=False, Output_Posed_Meshes=False)  # -> EndPlane, ExternalAxisPlanes

# ----
# Practical example #2
number_slider_6 = Slider(0, range=0..7)
pt_10 = Point(Point(855.1384115, 1147.847858, 685.1009636))
flip_plane_y = FlipPlaneY(Plane=pt_10)
rt_8 = RobotTarget(Plane=flip_plane_y, ConfigurationData=number_slider_6, Set_External_Joint_Position=False, Set_Reference_Plane=False)
irb4600 = ABBIRB460040255(PositionPlane=PlaneXY(0, 0, 0))
ik_2 = InverseKinematics(Robot=irb4600, Movement=rt_8, Closest_Robot_Joint_Position=False, Output_Posed_Meshes=False, Set_Hide_Mesh=False)  # -> RobotJointPosition, ExternalJointPosition

# ----
# Move
panel_91 = Panel("LOCAL CONST jointtarget target3 := [[0, 30, -30, 0, 45, 0], [9E9, 9E9, 9E9, 9E9, 9E9, 9E9]];")
panel_92 = Panel("[[0, 30, -30, 0, 45, 0], [9E9, 9E9, 300.45, 9E9, 9E9, 9E9]]")
panel_93 = Panel("VAR robtarget target4 := [[500.54, -343.13, 89.98], [0.707107, 0.707107, 0, 0], [0,0,0,0], [9E9, 9E9, 9E9, 9E9, 9E9, 9E9]];")
panel_94 = Panel("[[500.54, -343.13, 89.98], [0.707107, 0.707107, 0, 0], [0,0,0,0], [9E9, 9E9, 9E9, 9E9, 9E9, 9E9]]")
xy_8 = XYPlane(Origin=Point(0, 0, 0))
rt_9 = RobotTarget(Plane=xy_8, AxisConfiguration=0, Set_External_Joint_Position=False, Set_Reference_Plane=False)
jt_5 = JointTarget()
xy_9 = XYPlane(Origin=Point(0, 0, 0))
merge_13 = Merge(
    Data1=jt_5,
    Data2=rt_9,
    Data3=xy_9,
    Data4=panel_91,
    Data5=panel_92,
    Data6="0, 0, 0, 0, 45, 0",
    Data7=panel_93,
    Data8=panel_94)
M_2 = Movement(merge_13)
jt_6 = JointTarget(M_2)
rt_10 = RobotTarget(M_2)
wo_2 = WorkObject(M_2)
pt_11 = Point(M_2)
T_2 = Target(M_2)
sd_2 = SpeedData(M_2)
zd_2 = ZoneData(M_2)
ej_5 = ExternalJointPosition(M_2)
rt_11 = RobotTool(M_2)
pln_7 = Plane(M_2)
panel_95 = Panel(jt_6)
panel_96 = Panel(rt_10)
panel_97 = Panel(sd_2)
panel_98 = Panel(ej_5)
panel_99 = Panel(wo_2)
panel_100 = Panel(T_2)
panel_101 = Panel(zd_2)
panel_102 = Panel(rt_11)
panel_103 = Panel(pln_7)
panel_104 = Panel(pt_11)

# ----
# Instructions
sdop_2 = SetDigitalOutput(M_2)

panel_105 = Panel(sdop_2)
