# Grasshopper definition CALIBRATION_01_Tool.gh (Grasshopper 1.0.7)
# plug-ins: Robot Components

# ----
# Robot Tool defined from 3D model
pt = Point(Point(360, 0, 530))
pt_2 = Point(Point(-100, 0, 70))
vec2pt = Vector2Pt(PointA=pt_2, PointB=pt, Unitize=False)  # -> Vector, Length
xy = XYPlane(Origin=Point(0, 0, 0))
pl = PlaneNormal(Origin=pt, ZAxis=vec2pt.Vector)
brep = Brep(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)
robtool = RobotTool(
    Name="tool1",
    Mesh=brep,
    AttachmentPlane=xy,
    ToolPlane=pl,
    Set_Center_of_Gravity=False,
    Set_Mass=False,
    Set_Moment_of_Inertia=False)

# ----
# License info
I = Info()
panel = Panel(I)

# ----
# Obtain at least four different joint positions
# interalise the joint positions
button = Button()
getcont = GetController(Update=button, From_Menu=True)
timer = Timer(TimerInterval=20, Target=grjp)  # disabled
grjp = GetRobotJointPositions(Controller=getcont)  # -> Name, RobotJointPosition
rj = RobotJointPosition(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)
rj_2 = RobotJointPosition(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)
rj_3 = RobotJointPosition(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)
rj_4 = RobotJointPosition(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)
merge = Merge(Data1=rj, Data2=rj_2, Data3=rj_3, Data4=rj_4)

# ----
# Robot preset
robpres = RobotPreset(PositionPlane=PlaneXY(0, 0, 0), RobotTool=robtool, Robot_Preset_Number=21)

# ----
# Run Robot Tool Calibration
toolcal = RobotToolCalibration(Robot=robpres, RobotJointPosition=merge)  # -> TCP, Errors
panel_2 = Panel(toolcal.TCP)
panel_3 = Panel(toolcal.Errors)

# ----
# Display calibration positions
fk = ForwardKinematics(Robot=robpres, RobotJointPosition=rj, Hide_Posed_Meshes=False, Output_Posed_Meshes=False)  # -> EndPlane, ExternalAxisPlanes
fk_2 = ForwardKinematics(Robot=robpres, RobotJointPosition=rj_2, Hide_Posed_Meshes=False, Output_Posed_Meshes=False)  # -> EndPlane, ExternalAxisPlanes
fk_3 = ForwardKinematics(Robot=robpres, RobotJointPosition=rj_3, Hide_Posed_Meshes=False, Output_Posed_Meshes=False)  # -> EndPlane, ExternalAxisPlanes
fk_4 = ForwardKinematics(Robot=robpres, RobotJointPosition=rj_4, Hide_Posed_Meshes=False, Output_Posed_Meshes=False)  # -> EndPlane, ExternalAxisPlanes
pv = PlaneVisualizer(Plane=fk_4.EndPlane)
pv_2 = PlaneVisualizer(Plane=fk_2.EndPlane)
pv_3 = PlaneVisualizer(Plane=fk.EndPlane)
pv_4 = PlaneVisualizer(Plane=fk_3.EndPlane)

pt_3 = Point(panel_2)

# ----
# Calibrated Robot Tool
panel_4 = Panel("tool1_calibrated")
xy_2 = XYPlane(Origin=Point(0, 0, 0))
pl_2 = PlaneNormal(Origin=pt_3, ZAxis=vec2pt.Vector)
brep_2 = Brep(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)
robtool_2 = RobotTool(
    Name=panel_4,
    Mesh=brep_2,
    AttachmentPlane=xy_2,
    ToolPlane=pl_2,
    Set_Center_of_Gravity=False,
    Set_Mass=False,
    Set_Moment_of_Inertia=False)

# ----
# ALTERNATIVE:
# Or if you used the calibration procedure
# of ABB and you defined the TCP
# through the flex pendant you can convert
# the obtained values to a TCP plane.
panel_5 = Panel("0.382683")
xy_3 = XYPlane(Origin=Point(0, 0, 0))
qtop = QuaternionToPlane(
    CoordX="358.3",
    CoordY="-1.1",
    CoordZ="530.0",
    QuaternionA="0",
    QuaternionB=panel_5,
    QuaternionC="0",
    QuaternionD="0.92388")
brep_3 = Brep(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)
robtool_3 = RobotTool(
    Name="tool1_calibrated_abb",
    Mesh=brep_3,
    AttachmentPlane=xy_3,
    ToolPlane=qtop,
    Set_Center_of_Gravity=False,
    Set_Mass=False,
    Set_Moment_of_Inertia=False)
