# Grasshopper definition BASIC_04_Setup_of_external_linear_axis.gh (Grasshopper 1.0.8)
# plug-ins: Robot Components

# ----
# License info
I = Info()
panel = Panel(I)

# ----
# Axis limits
panel_2 = Panel("0")
dom = ConstructDomain(DomainStart=panel_2, DomainEnd="9400")

# ----
# Base mesh
brep = Brep(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)
mesh = Mesh(brep)

# ----
# Link mesh
# defined for axis value 0
brep_2 = Brep(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)
mesh_2 = Mesh(brep_2)

# ----
# Robot attachment plane
# defined for axis value 0
pt = Point(Point(300, 500, 200))
xy = XYPlane(Origin=pt)
prot = RotatePlane(Plane=xy, Angle=degrees("90"))

# ----
# Axis Direction
X = UnitX(Factor=1)

# ----
# Definition for external linear axis
external_linear_axis = ExternalLinearAxis(
    Name="default_ela",
    AttachmentPlane=prot,
    Axis=X,
    AxisLimits=dom,
    BaseMesh=mesh,
    LinkMesh=mesh_2,
    Set_Axis_Logic_Number=False,
    Set_Moves_Robot=False)

# ----
# Target creation
number_slider = Slider(4470, range=0..10000)
pt_2 = ConstructPoint(XCoordinate=number_slider, YCoordinate=Slider(1848, range=0..10000), ZCoordinate=Slider(591, range=0..10000))
xy_2 = XYPlane(Origin=pt_2)
flip_plane_x = FlipPlaneX(Plane=xy_2)
rt = RobotTarget(Name="target", Plane=flip_plane_x, Set_External_Joint_Position=False, Set_Reference_Plane=False)

# ----
# An external linear axis can be casted to a
# curve that represents the movement limits
# and direction. The domain of the curve is
# equal to the axis limits.
crv = Curve(external_linear_axis)

# ----
# Robot definition
robpres = RobotPreset(PositionPlane=PlaneXY(0, 0, 0), ExternalAxis=external_linear_axis, Robot_Preset_Number=18)

# ----
# A robot target can be casted to a point.
# This point is the origin of the plane in
# work object coordinate space.
pt_3 = Point(rt)

ik = InverseKinematics(
    Robot=robpres,
    Movement=rt,
    Closest_Robot_Joint_Position=False,
    Output_Configuration_Data=False,
    Output_Posed_Meshes=False,
    Set_Hide_Mesh=False)  # -> RobotJointPosition, ExternalJointPosition

# ----
# Robot pose display
# By default, the external linear axis will move to the value which
# brings the robot base the closest to the given target.
# If you need to set specific axis values, see the example:
# "ADVANCED_04_Override_external_axis_values_example.gh"
# Calculated internal axis values
deconrobjoint = DeconstructRobotJointPosition(RobotJointPosition=ik.RobotJointPosition)  # -> Name, RobotJointPosition1, RobotJointPosition2, RobotJointPosition3, RobotJointPosition4, RobotJointPosition5, RobotJointPosition6
panel_3 = Panel(deconrobjoint.RobotJointPosition1)
panel_4 = Panel(deconrobjoint.RobotJointPosition2)
panel_5 = Panel(deconrobjoint.RobotJointPosition3)
panel_6 = Panel(deconrobjoint.RobotJointPosition4)
panel_7 = Panel(deconrobjoint.RobotJointPosition5)
panel_8 = Panel(deconrobjoint.RobotJointPosition6)

# ----
# Calculated external axis values
deconextjoint = DeconstructExternalJointPosition(ExternalJointPosition=ik.ExternalJointPosition)  # -> Name, ExternalJointPositionA, ExternalJointPositionB, ExternalJointPositionC, ExternalJointPositionD, ExternalJointPositionE, ExternalJointPositionF
panel_9 = Panel(deconextjoint.ExternalJointPositionA)
panel_10 = Panel(deconextjoint.ExternalJointPositionB)
panel_11 = Panel(deconextjoint.ExternalJointPositionC)
panel_12 = Panel(deconextjoint.ExternalJointPositionD)
panel_13 = Panel(deconextjoint.ExternalJointPositionE)
panel_14 = Panel(deconextjoint.ExternalJointPositionF)

# ----
# This is the default implementation for
# calculating the external linear axis
# value in Robot Components. The robot
# moves to the closest position on the
# external linear axis to reach the target.
crv_cp = CurveClosestPoint(Point=pt_3, Curve=crv)  # -> Point, Parameter, Distance
panel_15 = Panel(crv_cp.Parameter)
