# Grasshopper definition ADVANCED_04_Stationary_tool.gh (Grasshopper 1.0.8)
# plug-ins: Robot Components

# ----
# License info
I = Info()
panel = Panel(I)

# ----
# Target planes
crv = Curve(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)
divide = DivideCurve(Curve=crv, Count="20", Kinks=False)  # -> Points, Tangents, Parameters
xy = XYPlane(Origin=divide.Points)
flip_plane_y = FlipPlaneY(Plane=xy)
item = ListItem(List=flip_plane_y, Index=0, Wrap=True)  # -> Item1, Item

# ----
# Reference plane
pt = Point(Point(1017.507692, -2654.13505, 0))
xy_2 = XYPlane(Origin=pt)
rectangle = Rectangle(Plane=xy_2, XSize="0 To 400", YSize="0 To 800", Radius=0)  # -> Rectangle, Length
pv = PlaneVisualizer(Plane=xy_2)

# ----
# Work object
pt_2 = Point(Point(1476.993394, -107.4220576, 637.8185072))
xy_3 = XYPlane(Origin=pt_2)
flip_plane_y_2 = FlipPlaneY(Plane=xy_3)
brep = Brep([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])
workobj = WorkObject(Name="stationary_tool", Plane=flip_plane_y_2)
preview = CustomPreview(Geometry=brep, Material=ColourSwatch(SwatchColor=RGB(143, 143, 143)))
pv_2 = PlaneVisualizer(Plane=workobj)

# ----
# Robot tool
pt_3 = Point(Point(1002.507661, -1149.834676, 191.5000054))
yz = YZPlane(Origin=pt_3)
pt_4 = Point(Point(1017.507692, -1549.834683, 0))
prot = RotatePlane(Plane=yz, Angle=degrees("-90"))
xy_4 = XYPlane(Origin=pt_4)
brep_2 = Brep([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])
pv_3 = PlaneVisualizer(Plane=xy_4)
robtool = RobotTool(Name="holding_wobj", Mesh=brep_2, AttachmentPlane=prot, ToolPlane=xy_4)
robpres = RobotPreset(PositionPlane=PlaneXY(0, 0, 0), RobotTool=robtool, Robot_Preset_Number=13)

# ----
# Robot instructions
panel_2 = Panel("-50")
pl_offset = PlaneOffset(BasePlane=item.Item, Offset=panel_2)
pl_offset_2 = PlaneOffset(BasePlane=item.Item1, Offset="-50")
pt_5 = Point(Point(757.7543791, -836.6812543, 419.3093393))
rt = RobotTarget(Plane=xy_2, ReferencePlane=pl_offset, Set_External_Joint_Position=False, Set_Reference_Plane=True)
rt_2 = RobotTarget(Plane=xy_2, ReferencePlane=flip_plane_y, Set_External_Joint_Position=False, Set_Reference_Plane=True)
rt_3 = RobotTarget(Plane=xy_2, ReferencePlane=pl_offset_2, Set_External_Joint_Position=False, Set_Reference_Plane=True)
xy_5 = XYPlane(Origin=pt_5)
list = ValueList({"MoveAbsJ": 0, "MoveL": 1, "MoveJ": 2}, selected="MoveAbsJ")
list_2 = ValueList({"MoveAbsJ": 0, "MoveL": 1, "MoveJ": 2}, selected="MoveJ")
list_3 = ValueList({"MoveAbsJ": 0, "MoveL": 1, "MoveJ": 2}, selected="MoveL")
list_4 = ValueList({"MoveAbsJ": 0, "MoveL": 1, "MoveJ": 2}, selected="MoveL")
list_5 = ValueList({"MoveAbsJ": 0, "MoveL": 1, "MoveJ": 2}, selected="MoveJ")
list_6 = ValueList({"v5": 5, "v10": 10, "v20": 20, "v30": 30, "v40": 40, "v50": 50, "v60": 60, "v80": 80, "v100": 100, "v150": 150, "v200": 200, "v300": 300, "v400": 400, "v500": 500, "v600": 600, "v800": 800, "v1000": 1000, "v1500": 1500, "v2000": 2000, "v2500": 2500, "v3000": 3000, "v4000": 4000, "v5000": 5000, "v6000": 6000, "v7000": 7000}, selected="v100")
list_7 = ValueList({"v5": 5, "v10": 10, "v20": 20, "v30": 30, "v40": 40, "v50": 50, "v60": 60, "v80": 80, "v100": 100, "v150": 150, "v200": 200, "v300": 300, "v400": 400, "v500": 500, "v600": 600, "v800": 800, "v1000": 1000, "v1500": 1500, "v2000": 2000, "v2500": 2500, "v3000": 3000, "v4000": 4000, "v5000": 5000, "v6000": 6000, "v7000": 7000}, selected="v100")
list_8 = ValueList({"v5": 5, "v10": 10, "v20": 20, "v30": 30, "v40": 40, "v50": 50, "v60": 60, "v80": 80, "v100": 100, "v150": 150, "v200": 200, "v300": 300, "v400": 400, "v500": 500, "v600": 600, "v800": 800, "v1000": 1000, "v1500": 1500, "v2000": 2000, "v2500": 2500, "v3000": 3000, "v4000": 4000, "v5000": 5000, "v6000": 6000, "v7000": 7000}, selected="v100")
list_9 = ValueList({"v5": 5, "v10": 10, "v20": 20, "v30": 30, "v40": 40, "v50": 50, "v60": 60, "v80": 80, "v100": 100, "v150": 150, "v200": 200, "v300": 300, "v400": 400, "v500": 500, "v600": 600, "v800": 800, "v1000": 1000, "v1500": 1500, "v2000": 2000, "v2500": 2500, "v3000": 3000, "v4000": 4000, "v5000": 5000, "v6000": 6000, "v7000": 7000}, selected="v100")
list_10 = ValueList({"v5": 5, "v10": 10, "v20": 20, "v30": 30, "v40": 40, "v50": 50, "v60": 60, "v80": 80, "v100": 100, "v150": 150, "v200": 200, "v300": 300, "v400": 400, "v500": 500, "v600": 600, "v800": 800, "v1000": 1000, "v1500": 1500, "v2000": 2000, "v2500": 2500, "v3000": 3000, "v4000": 4000, "v5000": 5000, "v6000": 6000, "v7000": 7000}, selected="v100")
slcc = SetLinearConfigurationControl(IsActive=Toggle(False))
sjcc = SetJointConfigurationControl(IsActive=Toggle(False))
M = Move(
    Type=list_2,
    Target=rt,
    SpeedData=list_7,
    WorkObject=workobj,
    Override_Robot_Tool=False,
    Override_Work_Object=True,
    Set_Circular_Point=False,
    Set_Digital_Output=False,
    Set_Movement_Time=False)
M_2 = Move(
    Type=list_3,
    Target=rt_2,
    SpeedData=list_8,
    WorkObject=workobj,
    Override_Robot_Tool=False,
    Override_Work_Object=True,
    Set_Circular_Point=False,
    Set_Digital_Output=False,
    Set_Movement_Time=False)
M_3 = Move(
    Type=list_4,
    Target=rt_3,
    SpeedData=list_9,
    WorkObject=workobj,
    Override_Robot_Tool=False,
    Override_Work_Object=True,
    Set_Circular_Point=False,
    Set_Digital_Output=False,
    Set_Movement_Time=False)
M_4 = Move(
    Type=list,
    Target=xy_5,
    SpeedData=list_6,
    Override_Robot_Tool=False,
    Override_Work_Object=False,
    Set_Circular_Point=False,
    Set_Digital_Output=False,
    Set_Movement_Time=False)
M_5 = Move(
    Type=list_5,
    Target=xy_5,
    SpeedData=list_10,
    Override_Robot_Tool=False,
    Override_Work_Object=False,
    Set_Circular_Point=False,
    Set_Digital_Output=False,
    Set_Movement_Time=False)

merge = Merge(
    Data1=flatten(sjcc),
    Data2=flatten(slcc),
    Data3=flatten(M_4),
    Data4=flatten(M),
    Data5=flatten(M_2),
    Data6=flatten(M_3),
    Data7=flatten(M_5))
pg = PathGenerator(
    Robot=robpres,
    Action=merge,
    Interpolations=5,
    AnimationSlider=Slider(0.347, range=0..1),
    Update=True,
    Output_Configuration_Data=False,
    Output_Configuration_Datas=False,
    Output_Error_Messages=False,
    Output_External_Axis_Planes=False,
    Output_External_Joint_Position=False,
    Output_External_Joint_Positions=False,
    Output_Movement=False,
    Output_Movements=False,
    Output_Path=True,
    Output_Posed_Meshes=False,
    Output_Program_Time=False,
    Output_Robot_End_Plane=True,
    Output_Robot_End_Planes=False,
    Output_Robot_Joint_Position=False,
    Output_Robot_Joint_Positions=False,
    Preview_Path=True,
    Preview_Posed_Meshes=True)  # -> Path, RobotEndPlane
rg = RAPIDGenerator(
    Robot=robpres,
    Action=merge,
    Add_loaddata=False,
    Add_tooldata=False,
    Add_wobjdata=False,
    Module_Name=False,
    Output_loaddata=False,
    Output_tooldata=False,
    Output_wobjdata=False,
    Routine_Name=False)
orient = Orient(Geometry=crv, Source=xy_2, Target=pg.RobotEndPlane)  # -> Geometry, Transform
panel_3 = Panel(rg)
