# Grasshopper definition CALIBRATION_02_External_rotational_axis.gh (Grasshopper 1.0.8)
# plug-ins: Robot Components

# ----
# License info
I = Info()
panel = Panel(I)

# ----
# World coordinate space
xy = XYPlane(Origin=Point(0, 0, 0))
pv = PlaneVisualizer(Plane=xy)

# ----
# (1) Setup a real-time connection and get calibration positions
button = Button()
getcont = GetController(Update=button, From_Menu=False)
list = ValueList({"World": 1, "Base": 2, "Workbobject": 4}, selected="World")
timer = Timer(Interval=20, TimerInterval=20, Target=grep)  # disabled
grep = GetRobotToolPlanes(Controller=getcont, CoordinateSystem=list)  # -> Name, Plane
item = ListItem(List=grep.Plane, Index="0", Wrap=True)
pv_2 = PlaneVisualizer(Plane=item)
pt = Point(item)

# ----
# (2) Define the center and the x-axis of the axis plane
# Jog to three points on the edge of the plate and internalise the data.
# First point defines the x-axis of the axis plane
pt_2 = Point(Point(1784.063232, -2199.978027, 856.0205688))
pt_3 = Point(Point(1608.965088, -2199.0271, 1030.062988))
pt_4 = Point(Point(1454.96875, -2198.67334, 775.9737549))
fcircle = CircleFit(Points=[pt_3, pt_2, pt_4])  # -> Circle, Radius, Deviation

# ----
# (3) Define the orientation of the z-axis
# Jog to three points on the edge of end plate and internalise the data.
# (or take one point that is the center)
pt_5 = Point(Point(1597.709839, 1817.25769, 790.9990845))
pt_6 = Point(Point(1597.703003, 1817.375244, 897.0130005))
pt_7 = Point(Point(1684.688354, 1816.773682, 846.9468994))
fcircle_2 = CircleFit(Points=[pt_5, pt_6, pt_7])  # -> Circle, Radius, Deviation

# ----
# X-axis
vec2pt = Vector2Pt(PointA=fcircle.Circle, PointB=pt_3, Unitize=False)  # -> Vector, Length

# ----
# Center (start)
pt_8 = Point(fcircle.Circle)

# ----
# Center end
pt_9 = Point(fcircle_2.Circle)

# ----
# (4) Construct the axis plane
vec2pt_2 = Vector2Pt(PointA=pt_8, PointB=pt_9, Unitize=False)  # -> Vector, Length
pl = PlaneNormal(Origin=pt_8, ZAxis=vec2pt_2.Vector)
align = AlignPlane(Plane=pl, Direction=vec2pt.Vector)  # -> Plane, Angle
pln = Plane(align.Plane)
pv_3 = PlaneVisualizer(Plane=pln)

# ----
# Axis curve
ln = Line(StartPoint=pt_8, EndPoint=pt_9)

# ----
# (5) Update the position and orientation in the controller
ptoq = PlaneToQuaternion(Plane=pln, ReferencePlane=PlaneXY(0, 0, 0))  # -> CoordX, CoordY, CoordZ, QuaternionA, QuaternionB, QuaternionC, QuaternionD
panel_2 = Panel(ptoq.QuaternionB)
panel_3 = Panel(ptoq.CoordX)
panel_4 = Panel(ptoq.CoordY)
panel_5 = Panel(ptoq.CoordZ)
panel_6 = Panel(ptoq.QuaternionA)
panel_7 = Panel(ptoq.QuaternionC)
panel_8 = Panel(ptoq.QuaternionD)

# ----
# ALTERNATIVE:
# Or if you used the calibration procedure
# of ABB and you defined the axis position
# through the flex pendant you can convert
# the obtained values to a plane.
panel_9 = Panel("0.501025")
qtop = QuaternionToPlane(
    CoordX="1609.828051",
    CoordY="-2199.237275",
    CoordZ="855.82839",
    QuaternionA="-0.497072",
    QuaternionB="0.500446",
    QuaternionC=panel_9,
    QuaternionD="0.501445")

# ----
# External axis in axis coordinate space
panel_10 = Panel("-3600 To 3600")
xy_2 = XYPlane(Origin=Point(0, 0, 0))
mesh = Mesh(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)
mesh_2 = Mesh(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)
external_rotational_axis = ExternalRotationalAxis(
    Name="STN1",
    AxisPlane=xy_2,
    AxisLimits=panel_10,
    BaseMesh=mesh,
    LinkMesh=mesh_2,
    AxisLogicNumber="A",
    MovesRobot=Toggle(False),
    Set_Axis_Logic_Number=True,
    Set_Moves_Robot=True)

# ----
# Orient to calibrated axis position
orient = Orient(Geometry=external_rotational_axis, Source=xy_2, Target=pln)  # -> Geometry, Transform
era = ExternalRotationalAxis(orient.Geometry)

# ----
# (6) Construct the robot cell
robpres = RobotPreset(PositionPlane=PlaneXY(0, 0, 0), ExternalAxis=era, Robot_Preset_Number=25)

# ----
# Movable work object
xy_3 = XYPlane(Origin=Point(0, 0, 0))
workobj = WorkObject(Name="wobj1", Plane=xy_3, ExternalAxis=era)

# ----
# Target in work object coordinate space
number_slider = Slider(100, range=-1000..1000)
pt_10 = ConstructPoint(XCoordinate=number_slider, YCoordinate=Slider(100, range=-1000..1000), ZCoordinate=Slider(50, range=0..4000))
xy_4 = XYPlane(Origin=pt_10)
flip_plane_x = FlipPlaneX(Plane=xy_4)
rt = RobotTarget(
    Plane=flip_plane_x,
    ExternalJointPosition=Slider(-464, range=-1000..1000),
    Set_External_Joint_Position=True,
    Set_Reference_Plane=False)

list_2 = ValueList({"MoveAbsJ": 0, "MoveL": 1, "MoveJ": 2}, selected="MoveJ")

# ----
# Example (playground)
list_3 = ValueList({"v5": 5, "v10": 10, "v20": 20, "v30": 30, "v40": 40, "v50": 50, "v60": 60, "v80": 80, "v100": 100, "v150": 150, "v200": 200, "v300": 300, "v400": 400, "v500": 500, "v600": 600, "v800": 800, "v1000": 1000, "v1500": 1500, "v2000": 2000, "v2500": 2500, "v3000": 3000, "v4000": 4000, "v5000": 5000, "v6000": 6000, "v7000": 7000}, selected="v200")
M = Move(
    Type=list_2,
    Target=rt,
    SpeedData=list_3,
    WorkObject=workobj,
    Override_Robot_Tool=False,
    Override_Work_Object=True,
    Set_Circular_Point=False,
    Set_Digital_Output=False,
    Set_Movement_Time=False)
ik = InverseKinematics(
    Robot=robpres,
    Movement=M,
    Closest_Robot_Joint_Position=False,
    Output_Configuration_Data=False,
    Output_Posed_Meshes=False,
    Set_Hide_Mesh=False)  # -> RobotJointPosition, ExternalJointPosition
fk = ForwardKinematics(
    Robot=robpres,
    RobotJointPosition=ik.RobotJointPosition,
    ExternalJointPosition=ik.ExternalJointPosition,
    Hide_Posed_Meshes=False,
    Output_Posed_Meshes=False)  # -> EndPlane, ExternalAxisPlanes
pv_4 = PlaneVisualizer(Plane=fk.EndPlane)
pv_5 = PlaneVisualizer(Plane=fk.ExternalAxisPlanes)
