# Grasshopper definition BASIC_03_Simple movements.gh (Grasshopper 1.0.8)
# plug-ins: Robot Components

# ----
# License info
I = Info()
panel = Panel(I)

# ----
# Robot end-effector
number_slider = Slider(300, range=0..300)
xy = XYPlane(Origin=Point(0, 0, 0))
cone = Cone(Base=xy, Radius=Slider(90, range=0..200), Length=number_slider)  # -> Cone, Tip
Z = UnitZ(Factor=number_slider)
mesh = Mesh(cone.Cone)
move = Move(Geometry=xy, Motion=Z)  # -> Geometry, Transform
robtool = RobotTool(Name="example_tool", Mesh=mesh, AttachmentPlane=xy, ToolPlane=move.Geometry)

# ----
# Input curves
crv = Curve([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])

# ----
# Create target planes
# Start
# Plane above start
# Planes for joint movement
# End
# Plane above end
# Planes for linear movement
disc = Discontinuity(Curve=crv, Level=1)  # -> Points, Parameters
xy_2 = XYPlane(Origin=disc.Points)
flip_plane_x = FlipPlaneX(Plane=xy_2)
item = ListItem(List=flip_plane_x, Index=0, Wrap=True)
item_2 = ListItem(List=flip_plane_x, Index="-1", Wrap=True)
neg = Negative(Value=Slider(150, range=0..200))
pl_offset = PlaneOffset(BasePlane=item, Offset=neg)
pl_offset_2 = PlaneOffset(BasePlane=item_2, Offset=neg)
merge = Merge(Data1=flip_plane_x, Data2=pl_offset_2)
pln = Plane(pl_offset)

# ----
# Robot definition
robpres = RobotPreset(PositionPlane=PlaneXY(0, 0, 0), RobotTool=robtool, Robot_Preset_Number=25)

# ----
# Plane vizualizer
pv = PlaneVisualizer(Plane=[pln, merge])

# ----
# Custom speeddata
# If using one of the default speeds (e.g. v100) defined on the controller,
# you can simply plug a number slider with the speed in the  Movement
# component. If you want to define a custom speed instead, you can use
# the Action: Speed Data component.
number_slider_2 = Slider(46, range=0..250)
sd = SpeedData(Name="speed1", TCPVelocity=number_slider_2, ORIVelocity=500, LEAXVelocity=5000, REAXVelocity=1000)

# ----
# Configuration Control
# If disabled the robot will move to the
# closest axis configuration. This will only be
# done for MoveJ (use ConfJ) and MoveL
# (use ConfL) move instructions.
toggle = BooleanToggle(False)
slcc = SetLinearConfigurationControl(IsActive=toggle)
sjcc = SetJointConfigurationControl(IsActive=Toggle(True))

# ----
# Comment line
# You can add comment lines to document your
# Rapid code. These lines will appear in the generated
# code, but will be ignored during execution.
panel_2 = Panel("new line")
list = ValueList({"Instruction": 0, "Declaration": 1}, selected="Instruction")
C = Comment(Text=panel_2, Type=list)

list_2 = ValueList({"MoveAbsJ": 0, "MoveL": 1, "MoveJ": 2, "MoveC": 3}, selected="MoveJ")

# ----
# Targets and Movements
# Each Target must have a unique naming. When using structured data trees in the Plane input,
# the Target Naming component can be used to automatically generate unique target names.
# RobotComponents enables the creation of multiple Movement types:
# - MoveAbsJ is a movement defined in absolute joint coordinates. Robot will always reach the target,
#   but motion will not be linear. All other data (Work object, tool offset) will be ignored.
# - MoveL is a movement defined in a straight line from start to end. Robot might not be able to
#   perform the motion in certain configurations.
# - MoveJ is non-straight movement between two point, which still accounts for tool and workobject offsets.
panel_3 = Panel("45")
rj = RobotJointPosition(
    RobotJointPosition1=0,
    RobotJointPosition2=0,
    RobotJointPosition3=0,
    RobotJointPosition4=0,
    RobotJointPosition5=panel_3,
    RobotJointPosition6=0)
rt = RobotTarget(Name="targets_joint", Plane=pln, Set_External_Joint_Position=False, Set_Reference_Plane=False)
rt_2 = RobotTarget(Name="targets_linear", Plane=merge, Set_External_Joint_Position=False, Set_Reference_Plane=False)
jt = JointTarget(Name="home_target", RobotJointPosition=rj)
list_3 = ValueList({"MoveAbsJ": 0, "MoveL": 1, "MoveJ": 2}, selected="MoveAbsJ")
list_4 = ValueList({"MoveAbsJ": 0, "MoveL": 1, "MoveJ": 2}, selected="MoveL")
list_5 = ValueList({"v5": 5, "v10": 10, "v20": 20, "v30": 30, "v40": 40, "v50": 50, "v60": 60, "v80": 80, "v100": 100, "v150": 150, "v200": 200, "v300": 300, "v400": 400, "v500": 500, "v600": 600, "v800": 800, "v1000": 1000, "v1500": 1500, "v2000": 2000, "v2500": 2500, "v3000": 3000, "v4000": 4000, "v5000": 5000, "v6000": 6000, "v7000": 7000}, selected="v200")
list_6 = ValueList({"v5": 5, "v10": 10, "v20": 20, "v30": 30, "v40": 40, "v50": 50, "v60": 60, "v80": 80, "v100": 100, "v150": 150, "v200": 200, "v300": 300, "v400": 400, "v500": 500, "v600": 600, "v800": 800, "v1000": 1000, "v1500": 1500, "v2000": 2000, "v2500": 2500, "v3000": 3000, "v4000": 4000, "v5000": 5000, "v6000": 6000, "v7000": 7000}, selected="v200")
M = Move(
    Type=list_3,
    Target=jt,
    SpeedData=list_5,
    Override_Robot_Tool=False,
    Override_Work_Object=False,
    Set_Circular_Point=False,
    Set_Digital_Output=False,
    Set_Movement_Time=False)
M_2 = Move(
    Type=list_2,
    Target=rt,
    SpeedData=list_6,
    Override_Robot_Tool=False,
    Override_Work_Object=False,
    Set_Circular_Point=False,
    Set_Digital_Output=False,
    Set_Movement_Time=False)
M_3 = Move(
    Type=list_4,
    Target=rt_2,
    SpeedData=sd,
    Override_Robot_Tool=False,
    Override_Work_Object=False,
    Set_Circular_Point=False,
    Set_Digital_Output=False,
    Set_Movement_Time=False)

# ----
# Combine actions here
weave = Weave(Pattern=[0, 1, 2], Stream0=C, Stream1=M_2, Stream2=M_3, NullGaps=False)
merge_2 = Merge(Data1=flatten(slcc), Data2=flatten(sjcc), Data3=flatten(M), Data4=flatten(weave), Data5=flatten(M))

# ----
# Code generator
# If you want to save the
# RAPID code to a file
# you can right-click on
# the component and
# select one of the menu
# items.
rg = RAPIDGenerator(
    Robot=robpres,
    Action=merge_2,
    Add_loaddata=False,
    Add_tooldata=False,
    Add_wobjdata=False,
    Module_Name=False,
    Output_loaddata=False,
    Output_tooldata=False,
    Output_wobjdata=False,
    Routine_Name=False)
main_module = Panel(rg)

# ----
# Path Generator
# It allows to compute the robot path and simulate its execution. For programs
# with large number of targets, a button can be plugged in the U input, to avoid
# recomputing the toolpath at every stage.
# 
# !!! WARNING !!!
# While RobotComponents toolpath generator is fairly accurate, there is no
# provided guarantee that the simulated toolpath will not differ when executing
# on a real robot. Always use a suitable simulation engine (e.g. RobotStudio)
# before uploading code to a real robot.
number_slider_3 = Slider(0.786, range=0..1)
# Right-click on the component to add more
# output parameters via the menu-items.
pg = PathGenerator(
    Robot=robpres,
    Action=merge_2,
    Interpolations=Slider(5, range=0..100),
    AnimationSlider=number_slider_3,
    Update=Button(),
    Output_Configuration_Data=False,
    Output_Configuration_Datas=False,
    Output_Error_Messages=False,
    Output_External_Axis_Planes=False,
    Output_External_Joint_Position=False,
    Output_External_Joint_Positions=False,
    Output_Movement=False,
    Output_Movements=False,
    Output_Path=True,
    Output_Posed_Meshes=False,
    Output_Program_Time=False,
    Output_Robot_End_Plane=False,
    Output_Robot_End_Planes=False,
    Output_Robot_Joint_Position=False,
    Output_Robot_Joint_Positions=True,
    Preview_Path=True,
    Preview_Posed_Meshes=True)  # -> Path, RobotJointPosition

# ----
# Display robot joint positions of the whole path
deconrobjoint = DeconstructRobotJointPosition(RobotJointPosition=pg.RobotJointPosition)  # -> Name, RobotJointPosition1, RobotJointPosition2, RobotJointPosition3, RobotJointPosition4, RobotJointPosition5, RobotJointPosition6
graph = QuickGraph(deconrobjoint.RobotJointPosition1, SortOrder=0)
graph_2 = QuickGraph(deconrobjoint.RobotJointPosition2, SortOrder=0)
graph_3 = QuickGraph(deconrobjoint.RobotJointPosition3, SortOrder=0)
graph_4 = QuickGraph(deconrobjoint.RobotJointPosition4, SortOrder=0)
graph_5 = QuickGraph(deconrobjoint.RobotJointPosition5, SortOrder=0)
graph_6 = QuickGraph(deconrobjoint.RobotJointPosition6, SortOrder=0)
