# Grasshopper definition BASIC_05_Setup_of_robot_info_IRB120.gh (Grasshopper 1.0.8)
# plug-ins: Robot Components

# ----
# License info
I = Info()
panel = Panel(I)

# ----
# Name
# Robot mesh
panel_2 = Panel("IRB120-3/0.58")

# ----
# Robot tool
number_slider = Slider(60, range=0..200)
xy = XYPlane(Origin=Point(0, 0, 0))
cone = Cone(Base=xy, Radius=Slider(20, range=0..200), Length=number_slider)  # -> Cone, Tip
Z = UnitZ(Factor=number_slider)
mesh = Mesh(cone.Cone)
move = Move(Geometry=xy, Motion=Z)  # -> Geometry, Transform
robtool = RobotTool(Name="debug_tool", Mesh=mesh, AttachmentPlane=xy, ToolPlane=move.Geometry)

# ----
# Position plane
xy_2 = XYPlane(Origin=Point(0, 0, 0))

# ----
# Axis limits
panel_3 = Panel("-165")
dom = ConstructDomain(DomainStart=panel_3, DomainEnd="165")
dom_2 = ConstructDomain(DomainStart="-110", DomainEnd="110")
dom_3 = ConstructDomain(DomainStart="-110", DomainEnd="70")
dom_4 = ConstructDomain(DomainStart="-160", DomainEnd="160")
dom_5 = ConstructDomain(DomainStart="-120", DomainEnd="120")
dom_6 = ConstructDomain(DomainStart="-400", DomainEnd="400")
merge = Merge(Data1=dom, Data2=dom_2, Data3=dom_3, Data4=dom_4, Data5=dom_5, Data6=dom_6)  # -> flatten(Result)

# ----
# Kinematic parameters
panel_4 = Panel("72")
rokipa = RobotKinematicParameters(A1="0", A2="-70", A3="0", B="0", C1="290", C2="270", C3="302", C4=panel_4)

# ----
# Mesh settings
number_slider_2 = Slider(1, range=0..20)
custom_mesh_settings = SettingsCustom(
    StitchSeams=True,
    SimplePlanes=Toggle(True),
    Refine=True,
    MinCount=16,
    MaxCount=400,
    AspectRatio=20,
    MaxDistance=0,
    MaxAngle=20,
    MinEdge=number_slider_2,
    MaxEdge=0)

pipeline = GeometryPipeline(
    GroupByLayer=False,
    GroupByType=False,
    IncludeHidden=True,
    IncludeLocked=True,
    LayerFilter="0",
    NameFilter="*",
    SublayerFiltering=True,
    TypeFilter=1073741848)
pipeline_2 = GeometryPipeline(
    GroupByLayer=False,
    GroupByType=False,
    IncludeHidden=True,
    IncludeLocked=True,
    LayerFilter="1",
    NameFilter="*",
    SublayerFiltering=True,
    TypeFilter=1073741848)
pipeline_3 = GeometryPipeline(
    GroupByLayer=False,
    GroupByType=False,
    IncludeHidden=True,
    IncludeLocked=True,
    LayerFilter="2",
    NameFilter="*",
    SublayerFiltering=True,
    TypeFilter=1073741848)
pipeline_4 = GeometryPipeline(
    GroupByLayer=False,
    GroupByType=False,
    IncludeHidden=True,
    IncludeLocked=True,
    LayerFilter="3",
    NameFilter="*",
    SublayerFiltering=True,
    TypeFilter=1073741848)
pipeline_5 = GeometryPipeline(
    GroupByLayer=False,
    GroupByType=False,
    IncludeHidden=True,
    IncludeLocked=True,
    LayerFilter="4",
    NameFilter="*",
    SublayerFiltering=True,
    TypeFilter=1073741848)
pipeline_6 = GeometryPipeline(
    GroupByLayer=False,
    GroupByType=False,
    IncludeHidden=True,
    IncludeLocked=True,
    LayerFilter="5",
    NameFilter="*",
    SublayerFiltering=True,
    TypeFilter=1073741848)
pipeline_7 = GeometryPipeline(
    GroupByLayer=False,
    GroupByType=False,
    IncludeHidden=True,
    IncludeLocked=True,
    LayerFilter="6",
    NameFilter="*",
    SublayerFiltering=True,
    TypeFilter=1073741848)
brep = Brep(pipeline)
brep_2 = Brep(pipeline_2)
brep_3 = Brep(pipeline_4)
brep_4 = Brep(pipeline_6)
brep_5 = Brep(pipeline_7)
brep_6 = Brep(pipeline_3)
brep_7 = Brep(pipeline_5)
mesh_2 = MeshBrep(Brep=brep, Settings=custom_mesh_settings)  # -> flatten(Mesh)
mesh_3 = MeshBrep(Brep=brep_2, Settings=custom_mesh_settings)  # -> flatten(Mesh)
mesh_4 = MeshBrep(Brep=brep_6, Settings=custom_mesh_settings)  # -> flatten(Mesh)
mesh_5 = MeshBrep(Brep=brep_3, Settings=custom_mesh_settings)  # -> flatten(Mesh)
mesh_6 = MeshBrep(Brep=brep_7, Settings=custom_mesh_settings)  # -> flatten(Mesh)
mesh_7 = MeshBrep(Brep=brep_4, Settings=custom_mesh_settings)  # -> flatten(Mesh)
mesh_8 = MeshBrep(Brep=brep_5, Settings=custom_mesh_settings)  # -> flatten(Mesh)
mjoin = MeshJoin(Meshes=mesh_2)
mjoin_2 = MeshJoin(Meshes=mesh_3)
mjoin_3 = MeshJoin(Meshes=mesh_4)
mjoin_4 = MeshJoin(Meshes=mesh_5)
mjoin_5 = MeshJoin(Meshes=mesh_6)
mjoin_6 = MeshJoin(Meshes=mesh_7)
mjoin_7 = MeshJoin(Meshes=mesh_8)
merge_2 = Merge(Data1=mjoin, Data2=mjoin_2, Data3=mjoin_3, Data4=mjoin_4, Data5=mjoin_5, Data6=mjoin_6, Data7=mjoin_7)  # -> flatten(Result)

# ----
# Robot info
robot = Robot(Name=panel_2, Meshes=merge_2, RobotKinematicParameters=rokipa, AxisLimits=merge, PositionPlane=xy_2, RobotTool=robtool)

# ----
# Deconstruct robot info and show axis planes
derob = DeconstructRobot(Robot=robot)  # -> Name, Meshes, RobotKinematicParameters, AxisLimits, PositionPlane, RobotTool, ExternalAxis
kipa2axpl = GetAxisPlanesFromRobotKinematicsParameters(PositionPlane=derob.PositionPlane, RobotKinematicParameters=derob.RobotKinematicParameters)  # -> AxisPlanes, MountingFrame
pv = PlaneVisualizer(Plane=kipa2axpl.AxisPlanes)

# ----
# Inverse kinematics
pt = Point(Point(214.8529475, -255.5395708, 162.8396895))
flip_plane_x = FlipPlaneX(Plane=pt)
rt = RobotTarget(
    Plane=flip_plane_x,
    ConfigurationData=Slider(0, range=0..7),
    Set_External_Joint_Position=False,
    Set_Reference_Plane=False)
ik = InverseKinematics(
    Robot=robot,
    Movement=rt,
    Closest_Robot_Joint_Position=False,
    Output_Configuration_Data=False,
    Output_Posed_Meshes=False,
    Set_Hide_Mesh=False)  # -> RobotJointPosition, ExternalJointPosition

# ----
# Forward kinematics
number_slider_3 = Slider(44, range=-180..180)

rj = RobotJointPosition(
    RobotJointPosition1=number_slider_3,
    RobotJointPosition2=Slider(50, range=-180..180),
    RobotJointPosition3=Slider(-9, range=-180..180),
    RobotJointPosition4=Slider(68, range=-180..180),
    RobotJointPosition5=Slider(55, range=-180..180),
    RobotJointPosition6=Slider(-121, range=-180..180))

fk = ForwardKinematics(Robot=robot, RobotJointPosition=rj, Hide_Posed_Meshes=False, Output_Posed_Meshes=False)  # -> EndPlane, ExternalAxisPlanes
pv_2 = PlaneVisualizer(Plane=fk.EndPlane)
