# Grasshopper definition ADVANCED_02_Work_object_example.gh (Grasshopper 1.0.8)
# plug-ins: Robot Components

# ----
# License info
I = Info()
panel = Panel(I)

# ----
# Realtime connection
# It is possible to use a realtime connection to get the three calibration points.
# Use a calibrated tool (with e.g. the tip of a needle as TCP) to get the three points.
# Jog the robot to the three points, and internalize the calibration points three times.
button = Button()
getcont = GetController(Update=button, From_Menu=False)
list = ValueList({"World": 1, "Base": 2, "Workbobject": 4}, selected="World")
timer = Timer(Interval=20, TimerInterval=20, Target=grep)  # disabled
grep = GetRobotToolPlanes(Controller=getcont, CoordinateSystem=list)  # -> Name, Plane
item = ListItem(List=grep.Plane, Index="0", Wrap=True)
pt = Point(item)

# ----
# Reference plane
pt_2 = Point(Point(183, 1016, 0))
xy = XYPlane(Origin=pt_2)
pv = PlaneVisualizer(Plane=xy)

# ----
# Input geometry
# Curve for tool path
crv = Curve(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)

# ----
# Work object surface
srf = Surface(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)

# ----
# Robot end-effector
number_slider = Slider(100, range=0..200)
xy_2 = XYPlane(Origin=Point(0, 0, 0))
cone = Cone(Base=xy_2, Radius=Slider(25, range=0..200), Length=number_slider)  # -> Cone, Tip
Z = UnitZ(Factor=number_slider)
mesh = Mesh(cone.Cone)
move = Move(Geometry=xy_2, Motion=Z)  # -> Geometry, Transform
robtool = RobotTool(Name="example_tool", Mesh=mesh, AttachmentPlane=xy_2, ToolPlane=move.Geometry)

# ----
# ALTERNATIVE:
# Or if you used the calibration procedure
# of ABB and you defined the work object
# position and orientation through the flex
# pendant you can convert the obtained
# values to a work object plane.
panel_2 = Panel("400")
qtop = QuaternionToPlane(
    CoordX=panel_2,
    CoordY="-346",
    CoordZ="143",
    QuaternionA="-0.999343",
    QuaternionB="-0.006144",
    QuaternionC="0.020229",
    QuaternionD="0.029449")
pln = Plane(qtop)

# ----
# Second calibration point: defines the x-axis orientation
pt_3 = Point(Point(992.0728369, -369.6897886, 158.626591))

# ----
# First calibration point: defines origin of work object
pt_4 = Point(Point(622.1788648, -346.8857475, 143.1679246))

# ----
# Third calibration point
pt_5 = Point(Point(662.6247199, 278.8271633, 148.0121537))

# ----
# Work object creation
pl_3pt = Plane3Pt(PointA=pt_4, PointB=pt_3, PointC=pt_5)
workobj = WorkObject(Name="wobj1", Plane=pl_3pt)

# ----
# Orient geometry
orient = Orient(Geometry=[srf, crv], Source=xy, Target=pl_3pt)  # -> Geometry, Transform

# ----
# Robot definition
robpres = RobotPreset(PositionPlane=PlaneXY(0, 0, 0), RobotTool=robtool, Robot_Preset_Number=8)

# ----
# Target creation
crv_2 = Curve(crv)
divide = DivideCurve(Curve=crv_2, Count=Slider(100, range=0..100), Kinks=False)  # -> Points, Tangents, Parameters
xy_3 = XYPlane(Origin=divide.Points)
align = AlignPlane(Plane=xy_3, Direction=divide.Tangents)  # -> Plane, Angle
flip_plane_y = FlipPlaneY(Plane=align.Plane)

rj = RobotJointPosition(
    RobotJointPosition1=Slider(0, range=-360..360),
    RobotJointPosition2=Slider(20, range=-360..360),
    RobotJointPosition3=Slider(5, range=-360..360),
    RobotJointPosition4=Slider(0, range=-360..360),
    RobotJointPosition5=Slider(65, range=-360..360),
    RobotJointPosition6=Slider(0, range=-360..360))
rt = RobotTarget(Name="targets", Plane=flip_plane_y, ReferencePlane=xy, Set_External_Joint_Position=False, Set_Reference_Plane=True)

jt = JointTarget(Name="initial_target", RobotJointPosition=rj)

# ----
# A target can be casted to a plane.
# This plane is the target plane in work
# object coordinate space.
pln_2 = Plane(rt)
pv_2 = PlaneVisualizer(Plane=pln_2)

split = SplitList(List=rt, Index="1")  # -> ListA, ListB

# ----
# Movement creation
list_2 = ValueList({"MoveAbsJ": 0, "MoveL": 1, "MoveJ": 2}, selected="MoveAbsJ")
list_3 = ValueList({"MoveAbsJ": 0, "MoveL": 1, "MoveJ": 2}, selected="MoveJ")
list_4 = ValueList({"MoveAbsJ": 0, "MoveL": 1, "MoveJ": 2}, selected="MoveL")
list_5 = ValueList({"v5": 5, "v10": 10, "v20": 20, "v30": 30, "v40": 40, "v50": 50, "v60": 60, "v80": 80, "v100": 100, "v150": 150, "v200": 200, "v300": 300, "v400": 400, "v500": 500, "v600": 600, "v800": 800, "v1000": 1000, "v1500": 1500, "v2000": 2000, "v2500": 2500, "v3000": 3000, "v4000": 4000, "v5000": 5000, "v6000": 6000, "v7000": 7000}, selected="v100")
list_6 = ValueList({"v5": 5, "v10": 10, "v20": 20, "v30": 30, "v40": 40, "v50": 50, "v60": 60, "v80": 80, "v100": 100, "v150": 150, "v200": 200, "v300": 300, "v400": 400, "v500": 500, "v600": 600, "v800": 800, "v1000": 1000, "v1500": 1500, "v2000": 2000, "v2500": 2500, "v3000": 3000, "v4000": 4000, "v5000": 5000, "v6000": 6000, "v7000": 7000}, selected="v100")
list_7 = ValueList({"v5": 5, "v10": 10, "v20": 20, "v30": 30, "v40": 40, "v50": 50, "v60": 60, "v80": 80, "v100": 100, "v150": 150, "v200": 200, "v300": 300, "v400": 400, "v500": 500, "v600": 600, "v800": 800, "v1000": 1000, "v1500": 1500, "v2000": 2000, "v2500": 2500, "v3000": 3000, "v4000": 4000, "v5000": 5000, "v6000": 6000, "v7000": 7000}, selected="v100")
slcc = SetLinearConfigurationControl(IsActive=False)
M = Move(
    Type=list_3,
    Target=split.ListA,
    SpeedData=list_6,
    WorkObject=workobj,
    Override_Robot_Tool=False,
    Override_Work_Object=True,
    Set_Circular_Point=False,
    Set_Digital_Output=False,
    Set_Movement_Time=False)
M_2 = Move(
    Type=list_4,
    Target=split.ListB,
    SpeedData=list_7,
    WorkObject=workobj,
    Override_Robot_Tool=False,
    Override_Work_Object=True,
    Set_Circular_Point=False,
    Set_Digital_Output=False,
    Set_Movement_Time=False)
M_3 = Move(
    Type=list_2,
    Target=jt,
    SpeedData=list_5,
    Override_Robot_Tool=False,
    Override_Work_Object=False,
    Set_Circular_Point=False,
    Set_Digital_Output=False,
    Set_Movement_Time=False)

# ----
# A movement can be casted to a plane.
# This plane is the target plane in world
# coordinate space.
pln_3 = Plane(M_2)
pv_3 = PlaneVisualizer(Plane=pln_3)

# ----
# Combine actions
merge = Merge(Data1=flatten(slcc), Data3=flatten(M_3), Data4=flatten(M), Data5=flatten(M_2), Data6=flatten(M_3))

# ----
# Rapid generator
# If you want to save the
# RAPID code to a file
# you can right-click on
# the component and
# select one of the menu
# items.
rg = RAPIDGenerator(
    Robot=robpres,
    Action=merge,
    Add_loaddata=False,
    Add_tooldata=False,
    Add_wobjdata=False,
    Module_Name=False,
    Output_loaddata=False,
    Output_tooldata=False,
    Output_wobjdata=False,
    Routine_Name=False)
panel_3 = Panel(rg)

# ----
# Path generator
# It allows to compute the robot path and simulate its execution. For programs
# with large number of targets, a button can be plugged in the U input, to avoid
# recomputing the toolpath at every stage.
# 
# !!! WARNING !!!
# While RobotComponents toolpath generator is fairly accurate, there is no
# provided guarantee that the simulated toolpath will not differ when executing
# on a real robot. Always use a suitable simulation engine (e.g. RobotStudio)
# before uploading code to a real robot.
number_slider_2 = Slider(0.31, range=0..1)
# Right-click on the component to add more
# output parameters via the menu-items.
pg = PathGenerator(
    Robot=robpres,
    Action=merge,
    Interpolations=Slider(5, range=0..100),
    AnimationSlider=number_slider_2,
    Update=Button(),
    Output_Configuration_Data=False,
    Output_Configuration_Datas=False,
    Output_Error_Messages=False,
    Output_External_Axis_Planes=False,
    Output_External_Joint_Position=False,
    Output_External_Joint_Positions=False,
    Output_Movement=False,
    Output_Movements=False,
    Output_Path=True,
    Output_Posed_Meshes=False,
    Output_Program_Time=False,
    Output_Robot_End_Plane=False,
    Output_Robot_End_Planes=False,
    Output_Robot_Joint_Position=False,
    Output_Robot_Joint_Positions=True,
    Preview_Path=True,
    Preview_Posed_Meshes=True)  # -> Path, RobotJointPosition

# ----
# Display robot joint positions of the whole path
deconrobjoint = DeconstructRobotJointPosition(RobotJointPosition=pg.RobotJointPosition)  # -> Name, RobotJointPosition1, RobotJointPosition2, RobotJointPosition3, RobotJointPosition4, RobotJointPosition5, RobotJointPosition6
graph = QuickGraph(deconrobjoint.RobotJointPosition1, SortOrder=0)
graph_2 = QuickGraph(deconrobjoint.RobotJointPosition2, SortOrder=0)
graph_3 = QuickGraph(deconrobjoint.RobotJointPosition3, SortOrder=0)
graph_4 = QuickGraph(deconrobjoint.RobotJointPosition6, SortOrder=0)
graph_5 = QuickGraph(deconrobjoint.RobotJointPosition4, SortOrder=0)
graph_6 = QuickGraph(deconrobjoint.RobotJointPosition5, SortOrder=0)
