# Grasshopper definition ADVANCED_03_Override_external_axis_values_example.gh (Grasshopper 1.0.8)
# plug-ins: Robot Components

# ----
# License info
I = Info()
panel = Panel(I)

# ----
# Movement direction
X = UnitX(Factor=1)

# ----
# Axis limits
panel_2 = Panel("0")
dom = ConstructDomain(DomainStart=panel_2, DomainEnd="9400")

# ----
# Base mesh
brep = Brep(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)
mesh = Mesh(brep)

# ----
# Link mesh
# defined for axis value 0
brep_2 = Brep(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)
mesh_2 = Mesh(brep_2)

# ----
# Robot attachment plane
# defined for axis value 0
pt = Point(Point(300, 500, 200))
xy = XYPlane(Origin=pt)
prot = RotatePlane(Plane=xy, Angle=degrees("90"))

# ----
# Definition for external linear axis
external_linear_axis = ExternalLinearAxis(
    Name="default_ela",
    AttachmentPlane=prot,
    Axis=X,
    AxisLimits=dom,
    BaseMesh=mesh,
    LinkMesh=mesh_2,
    Set_Axis_Logic_Number=False,
    Set_Moves_Robot=False)

# ----
# Override external axis values (optional)
number_slider = Slider(3500, range=0..10000)
merge = Merge(Data1=number_slider, Data2=Slider(5000, range=0..10000))

# ----
# Robot definition
robpres = RobotPreset(PositionPlane=PlaneXY(0, 0, 0), ExternalAxis=external_linear_axis, Robot_Preset_Number=18)

# ----
# Select this component
# to move the point in Rhino
pt_2 = Point(Point(4425.478622, 1632.482174, 486.9971185))

# ----
# An external linear axis can be casted to a
# curve that represents the movement limits
# and direction. The domain of the curve is
# equal to the axis limits.
crv = Curve(external_linear_axis)

# ----
# Target creation
xy_2 = XYPlane(Origin=pt_2)
flip_plane_x = FlipPlaneX(Plane=xy_2)

num = Number("9e9")

filter = StreamFilter(Gate=Toggle(True), Stream0=num, Stream1=merge)

rt = RobotTarget(
    Name="target",
    Plane=flip_plane_x,
    ConfigurationData=Slider(0, range=0..7),
    ExternalJointPosition=filter,
    Set_External_Joint_Position=True,
    Set_Reference_Plane=False)

# ----
# Movement creation
list = ValueList({"MoveAbsJ": 0, "MoveL": 1, "MoveJ": 2}, selected="MoveAbsJ")
list_2 = ValueList({"MoveAbsJ": 0, "MoveL": 1, "MoveJ": 2}, selected="MoveL")
merge_2 = Merge(Data1=list, Data2=list_2)  # -> graft(Result)
list_3 = ValueList({"v5": 5, "v10": 10, "v20": 20, "v30": 30, "v40": 40, "v50": 50, "v60": 60, "v80": 80, "v100": 100, "v150": 150, "v200": 200, "v300": 300, "v400": 400, "v500": 500, "v600": 600, "v800": 800, "v1000": 1000, "v1500": 1500, "v2000": 2000, "v2500": 2500, "v3000": 3000, "v4000": 4000, "v5000": 5000, "v6000": 6000, "v7000": 7000}, selected="v200")
M = Move(
    Type=merge_2,
    Target=rt,
    SpeedData=list_3,
    Override_Robot_Tool=False,
    Override_Work_Object=False,
    Set_Circular_Point=False,
    Set_Digital_Output=False,
    Set_Movement_Time=False)  # -> flatten(Movement)
split = SplitList(List=M, Index="3")  # -> ListA, ListB

# ----
# A movement can be casted to a point.
# This point is the origin of the plane in
# world coordinate space.
pt_3 = Point(M)

# ----
# This is the default implementation for
# calculating the external linear axis
# value in Robot Components. The robot
# moves to the closest position on the
# external linear axis to reach the target.
crv_cp = CurveClosestPoint(Point=pt_3, Curve=crv)  # -> Point, Parameter, Distance
panel_3 = Panel(crv_cp.Parameter)

# ----
# Rapid generator
rg = RAPIDGenerator(
    Robot=robpres,
    Action=split.ListA,
    Add_loaddata=False,
    Add_tooldata=False,
    Add_wobjdata=False,
    Module_Name=False,
    Output_loaddata=False,
    Output_tooldata=False,
    Output_wobjdata=False,
    Routine_Name=False)
panel_4 = Panel(rg)

# ----
# Path generator
# It allows to compute the robot path and simulate its execution. For programs
# with large number of targets, a button can be plugged in the U input, to avoid
# recomputing the toolpath at every stage.
# 
# !!! WARNING !!!
# While RobotComponents toolpath generator is fairly accurate, there is no
# provided guarantee that the simulated toolpath will not differ when executing
# on a real robot. Always use a suitable simulation engine (e.g. RobotStudio)
# before uploading code to a real robot.
number_slider_2 = Slider(0.432, range=0..1)
pg = PathGenerator(
    Robot=robpres,
    Action=split.ListA,
    Interpolations=Slider(10, range=0..100),
    AnimationSlider=number_slider_2,
    Update=True,
    Output_Configuration_Data=False,
    Output_Configuration_Datas=False,
    Output_Error_Messages=False,
    Output_External_Axis_Planes=False,
    Output_External_Joint_Position=False,
    Output_External_Joint_Positions=False,
    Output_Movement=False,
    Output_Movements=False,
    Output_Path=True,
    Output_Posed_Meshes=False,
    Output_Program_Time=False,
    Output_Robot_End_Plane=False,
    Output_Robot_End_Planes=False,
    Output_Robot_Joint_Position=False,
    Output_Robot_Joint_Positions=False,
    Preview_Path=True,
    Preview_Posed_Meshes=True)
