# Grasshopper definition EXPERT_01_Movable_work_object_example.gh (Grasshopper 1.0.8)
# plug-ins: Robot Components

# ----
# License info
I = Info()
panel = Panel(I)

# ----
# Axis limits
number_slider = Slider(720, range=0..720)
neg = Negative(Value=number_slider)
dom = ConstructDomain(DomainStart=neg, DomainEnd=number_slider)

# ----
# Realtime connection
# It is possible to use a realtime connection to get the three calibration points.
# Use a calibrated tool (with e.g. the tip of a needle as TCP) to get the three points.
# Jog the robot to the three points, and internalize the calibration points three times.
button = Button()
getcont = GetController(Update=button, From_Menu=False)
list = ValueList({"World": 1, "Base": 2, "Workbobject": 4}, selected="World")
timer = Timer(Interval=20, TimerInterval=20, Target=grep)  # disabled
grep = GetRobotToolPlanes(Controller=getcont, CoordinateSystem=list)  # -> Name, Plane
item = ListItem(List=grep.Plane, Index="0", Wrap=True)
pt = Point(item)

# ----
# Axis plane
xy = XYPlane(Origin=Point(0, 0, 0))

# ----
# Link mesh
mesh = Mesh(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)

# ----
# Base mesh
mesh_2 = Mesh(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)

# ----
# Work piece positioner as external rotational axis
panel_2 = Panel("axis_name_as_it_is_definied_in_the_controller")
external_rotational_axis = ExternalRotationalAxis(
    Name=panel_2,
    AxisPlane=xy,
    AxisLimits=dom,
    BaseMesh=mesh_2,
    LinkMesh=mesh,
    Set_Axis_Logic_Number=False,
    Set_Moves_Robot=False)

# ----
# Robot end-effector
number_slider_2 = Slider(25, range=0..200)
number_slider_3 = Slider(100, range=0..200)
xy_2 = XYPlane(Origin=Point(0, 0, 0))
cone = Cone(Base=xy_2, Radius=number_slider_2, Length=number_slider_3)  # -> Cone, Tip
Z = UnitZ(Factor=number_slider_3)
mesh_3 = Mesh(cone.Cone)
move = Move(Geometry=xy_2, Motion=Z)  # -> Geometry, Transform
robtool = RobotTool(Name="example_tool", Mesh=mesh_3, AttachmentPlane=xy_2, ToolPlane=move.Geometry)

# ----
# Orient to calibrated position
# Calibrated axis plane
pt_2 = Point(Point(1161, 102.3869096, 402.4800073))
pt_3 = Point(Point(801, 18, 300))
pt_4 = Point(Point(692, 355, 228.9929861))
pl_3pt = Plane3Pt(PointA=pt_3, PointB=pt_2, PointC=pt_4)
orient = Orient(Geometry=external_rotational_axis, Source=PlaneXY(0, 0, 0), Target=pl_3pt)  # -> Geometry, Transform
era = ExternalRotationalAxis(orient.Geometry)

# ----
# Target creation
# Target planes
crv = Curve(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)
divide = DivideCurve(Curve=crv, Count=Slider(200, range=0..1000), Kinks=False)  # -> Points, Tangents, Parameters
xy_3 = XYPlane(Origin=divide.Points)
align = AlignPlane(Plane=xy_3, Direction=divide.Tangents)  # -> Plane, Angle
flip_plane_y = FlipPlaneY(Plane=align.Plane)

# ----
# Reference plane
rec = Rectangle({Plane=Plane(origin=(1017, 1242, 0), x=(0, 1, 0), y=(-1, 0, 0)), Size=Domain2(u=-400..400, v=-400..400)})
pcen = PolygonCenter(Polyline=rec)  # -> CenterV, CenterE, CenterA
xy_4 = XYPlane(Origin=pcen.CenterV)

# ----
# ALTERNATIVE:
# Or get an already calibrated base frame
# position from the controller and convert
# these values to a plane.
panel_3 = Panel("800")
qtop = QuaternionToPlane(
    CoordX=panel_3,
    CoordY="18",
    CoordZ="300",
    QuaternionA="-1.00",
    QuaternionB="0.00",
    QuaternionC="0.14",
    QuaternionD="-0.10")
pln = Plane(qtop)

# ----
# Convert the axis plane to quarternion:
# This has to match with the base frame
# that is defined in the controller!
ptoq = PlaneToQuaternion(Plane=pl_3pt, ReferencePlane=PlaneXY(0, 0, 0))  # -> CoordX, CoordY, CoordZ, QuaternionA, QuaternionB, QuaternionC, QuaternionD
panel_4 = Panel(ptoq.CoordX)
panel_5 = Panel(ptoq.CoordY)
panel_6 = Panel(ptoq.CoordZ)
panel_7 = Panel(ptoq.QuaternionA)
panel_8 = Panel(ptoq.QuaternionB)
panel_9 = Panel(ptoq.QuaternionC)
panel_10 = Panel(ptoq.QuaternionD)

# ----
# Calculate external axis value for each target
vec2pt = Vector2Pt(PointA=xy_4, PointB=divide.Points, Unitize=False)  # -> Vector, Length
X = UnitX(Factor=1)
neg_2 = Negative(Value=X)
angle = Angle(VectorA=neg_2, VectorB=vec2pt.Vector, Plane=xy_4)  # -> Angle, Reflex
deg = Degrees(Radians=angle.Angle)
python = GhPythonScript(x=deg)  # -> out, a; inputs x: list
# ---------- python: Python ----------
# This python components ensure that that step size 
# between two axes angles is never bigger or smaller
# than 180 degrees. 

def main(_x):
    
    for i in range(len(_x) - 1):
        counter = 0
        difference = _x[i+1] - _x[i]
        
        while ((difference <  -180) & (counter < 10000)):
            x[i+1] += 360
            difference = _x[i+1] - _x[i]
            counter += 1
            
        while ((difference >  180) & (counter < 10000)):
            x[i+1] -= 360
            difference = _x[i+1] - _x[i]
            counter += 1
            
    return _x

a = main(x)
# ---------- end python ----------
neg_3 = Negative(Value=python.a)

# ----
# Work object creation
panel_11 = Panel("wobj1_ext")
xy_5 = XYPlane(Origin=Point(0, 0, 0))
workobj = WorkObject(Name=panel_11, Plane=xy_5, ExternalAxis=era)

# ----
# Robot definition
robpres = RobotPreset(PositionPlane=PlaneXY(0, 0, 0), RobotTool=robtool, ExternalAxis=era, Robot_Preset_Number=4)

# ----
# Initial target
number_slider_4 = Slider(0, range=0..500)
jt = JointTarget(Name="initial_target", ExternalJointPosition=number_slider_4)

# ----
# Targets on movable work object
panel_12 = Panel("targets")
rt = RobotTarget(
    Name=panel_12,
    Plane=flip_plane_y,
    ReferencePlane=xy_4,
    ExternalJointPosition=neg_3,
    Set_External_Joint_Position=True,
    Set_Reference_Plane=True)

pv = PlaneVisualizer(Plane=workobj)

# ----
# A target can be casted to a plane.
# This plane is the target plane in work
# object coordinate space.
pln_2 = Plane(rt)
pv_2 = PlaneVisualizer(Plane=pln_2)

# ----
# Movement creation
panel_13 = Panel("1")
split = SplitList(List=rt, Index=panel_13)  # -> ListA, ListB
list_2 = ValueList({"MoveAbsJ": 0, "MoveL": 1, "MoveJ": 2}, selected="MoveAbsJ")
list_3 = ValueList({"MoveAbsJ": 0, "MoveL": 1, "MoveJ": 2}, selected="MoveJ")
list_4 = ValueList({"MoveAbsJ": 0, "MoveL": 1, "MoveJ": 2}, selected="MoveL")
list_5 = ValueList({"v5": 5, "v10": 10, "v20": 20, "v30": 30, "v40": 40, "v50": 50, "v60": 60, "v80": 80, "v100": 100, "v150": 150, "v200": 200, "v300": 300, "v400": 400, "v500": 500, "v600": 600, "v800": 800, "v1000": 1000, "v1500": 1500, "v2000": 2000, "v2500": 2500, "v3000": 3000, "v4000": 4000, "v5000": 5000, "v6000": 6000, "v7000": 7000}, selected="v100")
list_6 = ValueList({"v5": 5, "v10": 10, "v20": 20, "v30": 30, "v40": 40, "v50": 50, "v60": 60, "v80": 80, "v100": 100, "v150": 150, "v200": 200, "v300": 300, "v400": 400, "v500": 500, "v600": 600, "v800": 800, "v1000": 1000, "v1500": 1500, "v2000": 2000, "v2500": 2500, "v3000": 3000, "v4000": 4000, "v5000": 5000, "v6000": 6000, "v7000": 7000}, selected="v100")
list_7 = ValueList({"v5": 5, "v10": 10, "v20": 20, "v30": 30, "v40": 40, "v50": 50, "v60": 60, "v80": 80, "v100": 100, "v150": 150, "v200": 200, "v300": 300, "v400": 400, "v500": 500, "v600": 600, "v800": 800, "v1000": 1000, "v1500": 1500, "v2000": 2000, "v2500": 2500, "v3000": 3000, "v4000": 4000, "v5000": 5000, "v6000": 6000, "v7000": 7000}, selected="v100")
M = Move(
    Type=list_3,
    Target=split.ListA,
    SpeedData=list_6,
    WorkObject=workobj,
    Override_Robot_Tool=False,
    Override_Work_Object=True,
    Set_Circular_Point=False,
    Set_Digital_Output=False,
    Set_Movement_Time=False)
M_2 = Move(
    Type=list_4,
    Target=split.ListB,
    SpeedData=list_7,
    WorkObject=workobj,
    Override_Robot_Tool=False,
    Override_Work_Object=True,
    Set_Circular_Point=False,
    Set_Digital_Output=False,
    Set_Movement_Time=False)
M_3 = Move(
    Type=list_2,
    Target=jt,
    SpeedData=list_5,
    Override_Robot_Tool=False,
    Override_Work_Object=False,
    Set_Circular_Point=False,
    Set_Digital_Output=False,
    Set_Movement_Time=False)

# ----
# Set Linear Configuration Control
toggle = BooleanToggle(False)
slcc = SetLinearConfigurationControl(IsActive=toggle)

list_8 = ValueList({"MoveAbsJ": 0, "MoveL": 1, "MoveJ": 2, "MoveC": 3}, selected="MoveAbsJ")

# ----
# A movement can be casted to a plane.
# This plane is the target plane in world
# coordinate space. In case of a movable
# work object the this plane is always posed
# for an external axis value of 0.
pln_3 = Plane([M_2, M])
pv_3 = PlaneVisualizer(Plane=pln_3)

# ----
# Combine actions
merge = Merge(Data1=flatten(slcc), Data2=flatten(M_3), Data3=flatten(M), Data4=flatten(M_2), Data5=flatten(M_3))

# ----
# Rapid generator
# If you want to save the
# RAPID code to a file
# you can right-click on
# the component and
# select one of the menu
# items.
rg = RAPIDGenerator(
    Robot=robpres,
    Action=merge,
    Add_loaddata=False,
    Add_tooldata=False,
    Add_wobjdata=False,
    Module_Name=False,
    Output_loaddata=False,
    Output_tooldata=False,
    Output_wobjdata=False,
    Routine_Name=False)
panel_14 = Panel(rg)

# ----
# Path generator
# It allows to compute the robot path and simulate its execution. For programs
# with large number of targets, a button can be plugged in the U input, to avoid
# recomputing the toolpath at every stage.
# 
# !!! WARNING !!!
# While RobotComponents toolpath generator is fairly accurate, there is no
# provided guarantee that the simulated toolpath will not differ when executing
# on a real robot. Always use a suitable simulation engine (e.g. RobotStudio)
# before uploading code to a real robot.
number_slider_5 = Slider(0.701, range=0..1)
pg = PathGenerator(
    Robot=robpres,
    Action=merge,
    Interpolations=Slider(5, range=0..100),
    AnimationSlider=number_slider_5,
    Update=Button(),
    Output_Configuration_Data=False,
    Output_Configuration_Datas=False,
    Output_Error_Messages=False,
    Output_External_Axis_Planes=True,
    Output_External_Joint_Position=False,
    Output_External_Joint_Positions=False,
    Output_Movement=False,
    Output_Movements=False,
    Output_Path=True,
    Output_Posed_Meshes=False,
    Output_Program_Time=False,
    Output_Robot_End_Plane=True,
    Output_Robot_End_Planes=False,
    Output_Robot_Joint_Position=False,
    Output_Robot_Joint_Positions=False,
    Preview_Path=True,
    Preview_Posed_Meshes=True)  # -> Path, RobotEndPlane, ExternalAxisPlanes
pv_4 = PlaneVisualizer(Plane=pg.RobotEndPlane)

orient_2 = Orient(Geometry=crv, Source=xy_4, Target=workobj)  # -> Geometry, Transform
orient_3 = Orient(Geometry=pln_3, Source=pl_3pt, Target=pg.ExternalAxisPlanes)  # -> Geometry, Transform
orient_4 = Orient(Geometry=orient_2.Geometry, Source=pl_3pt, Target=pg.ExternalAxisPlanes)  # -> Geometry, Transform
crv_2 = Curve(orient_4.Geometry)
pv_5 = PlaneVisualizer(Plane=orient_3.Geometry)
