# Grasshopper definition CALIBRATION_03_Multi_move_two_robots.gh (Grasshopper 1.0.8)
# plug-ins: Robot Components

# ----
# World coordinate space
xy = XYPlane(Origin=Point(0, 0, 0))
pv = PlaneVisualizer(Plane=xy)

# ----
# License info
I = Info()
panel = Panel(I)

# ----
# (1) T_ROB1 positioned at world XY
robpres = RobotPreset(PositionPlane=PlaneXY(0, 0, 0), Robot_Preset_Number=14)

# ----
# (2) Get three points in world coordinate space of T_ROB1
# Jog with the robot tcp to three these points and internalize them
getcont = GetController(Update=False, From_Menu=False)
list = ValueList({"World": 1, "Base": 2, "Workbobject": 4}, selected="Base")
timer = Timer(Interval=20, TimerInterval=20, Target=grep)  # disabled
grep = GetRobotToolPlanes(Controller=getcont, CoordinateSystem=list)  # -> Name, Plane
item = ListItem(List=grep.Plane, Index="0", Wrap=True)
pt = Point(item)

# ----
# (3) Get the three points in robot coordinate space of the second robot T_ROB2
# Jog with the second robot tcp to same points and internalize them
panel_2 = Panel("1")
item_2 = ListItem(List=grep.Plane, Index=panel_2, Wrap=True)
pt_2 = Point(item_2)

pt_3 = Point(Point(811.1467156, 500.6426722, 0))
pt_4 = Point(Point(847.2984293, -134.5945818, 0))
pt_5 = Point(Point(1461.877561, 552.2879774, 0))
pl_3pt = Plane3Pt(PointA=pt_3, PointB=pt_4, PointC=pt_5)

pt_6 = Point(Point(1477.436921, -237.1942168, -0.6981222769))
pt_7 = Point(Point(719.1739709, 286.6789492, -11.15588617))
pt_8 = Point(Point(851.6907408, -352.4099077, -0.08295969486))
pl_3pt_2 = Plane3Pt(PointA=pt_8, PointB=pt_6, PointC=pt_7)

# ----
# ALTERNATIVE:
# Or if you used the calibration procedure
# of ABB and you defined the robot position
# through the flex pendant you can convert
# the obtained values to a plane.
panel_3 = Panel("1301.64")
qtop = QuaternionToPlane(
    CoordX="1267.12",
    CoordY=panel_3,
    CoordZ="7.843",
    QuaternionA="-0.661445",
    QuaternionB="-0.006381",
    QuaternionC="0.005628",
    QuaternionD="0.749945")

# ----
# (4) Orient the XY base frame to the real location in the world coordinate space
xy_2 = XYPlane(Origin=Point(0, 0, 0))
orient = Orient(Geometry=xy_2, Source=pl_3pt_2, Target=pl_3pt)  # -> Geometry, Transform
robpres_2 = RobotPreset(PositionPlane=orient.Geometry, Robot_Preset_Number=13)

orient_2 = Orient(Geometry=pl_3pt_2, Source=PlaneXY(0, 0, 0), Target=orient.Geometry)  # -> Geometry, Transform
pv_2 = PlaneVisualizer(Plane=orient_2.Geometry)

# ----
# OPTIONAL: This data can also be used to make a work object
panel_4 = Panel("wobj1")
workobj = WorkObject(Name=panel_4, Plane=pl_3pt)
rec_3pt = Rectangle3Pt(PointA=pt_3, PointB=pt_4, PointC=pt_5)  # -> Rectangle, Length
srf = Surface(rec_3pt.Rectangle)

# ----
# Base frame T_ROB2
ptoq = PlaneToQuaternion(Plane=orient.Geometry, ReferencePlane=PlaneXY(0, 0, 0))  # -> CoordX, CoordY, CoordZ, QuaternionA, QuaternionB, QuaternionC, QuaternionD
panel_5 = Panel(ptoq.QuaternionB)
panel_6 = Panel(ptoq.CoordX)
panel_7 = Panel(ptoq.CoordY)
panel_8 = Panel(ptoq.CoordZ)
panel_9 = Panel(ptoq.QuaternionA)
panel_10 = Panel(ptoq.QuaternionC)
panel_11 = Panel(ptoq.QuaternionD)
