# Grasshopper definition API_02_C#.gh (Grasshopper 1.0.8)
# plug-ins: Robot Components

# ----
# License info
I = Info()
panel = Panel(I)

# ----
# Add/check DLL references!
#     - RobotComponents.ABB.dll
#     - RobotComponents.ABB.Presets.dll
srf = Surface(reparameterize(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))
crv = Curve([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])
c_script = CSharpScript(curves=crv, surface=srf)  # -> out, A, B, C; inputs curves: list of Curve, surface: Surface
# ---------- c_script: C# ----------
// Grasshopper Script Instance
#region Usings
using System;
#r "...\RobotComponents.ABB.dll"
#r "...\RobotComponents.ABB.Presets.dll"
using System.Linq;
using System.Collections;
using System.Collections.Generic;
using System.Drawing;

using Rhino;
using Rhino.Geometry;

using Grasshopper;
using Grasshopper.Kernel;
using Grasshopper.Kernel.Data;
using Grasshopper.Kernel.Types;

using RobotComponents.ABB.Actions;
using RobotComponents.ABB.Actions.Declarations;
using RobotComponents.ABB.Actions.Instructions;
using RobotComponents.ABB.Actions.Dynamic;
using RobotComponents.ABB.Definitions;
using RobotComponents.ABB.Enumerations;
using RobotComponents.ABB.Presets;
using RobotComponents.ABB.Presets.Enumerations;
#endregion

public class Script_Instance : GH_ScriptInstance
{
    #region Notes
    /* 
      Members:
        RhinoDoc RhinoDocument
        GH_Document GrasshopperDocument
        IGH_Component Component
        int Iteration

      Methods (Virtual & overridable):
        Print(string text)
        Print(string format, params object[] args)
        Reflect(object obj)
        Reflect(object obj, string method_name)
    */
    #endregion

    private void RunScript(
		List<Curve> curves,
		Surface surface,
		ref object A,
		ref object B,
		ref object C)
    {
    // Construct a tool
    Plane tcp = new Plane(new Point3d(0, 0, 250), new Vector3d(0, 0, 1));
    Cone cone = new Cone(tcp, -tcp.Origin.Z, 55);
    Mesh coneMesh = Mesh.CreateFromCone(cone, 100, 100);
    RobotTool tool = new RobotTool("tool1", coneMesh, Plane.WorldXY, tcp);

    // Construct a robot preset
    Robot robot = Factory.GetRobotPreset(RobotPreset.IRB4600_40_255, Plane.WorldXY, tool);

    // Fabrication settings
    SpeedData speedLow = new SpeedData("speed_low", 20);
    SpeedData speedHigh = new SpeedData("speed_high", 250);
    ZoneData zonePrecise = ZoneData.GetPredefinedZoneData(PredefinedZoneData.fine);
    ZoneData zoneFlyover = ZoneData.GetPredefinedZoneData(PredefinedZoneData.z10);
    double offset = 100;
    string digitalOutputName = "DO_01";

    // Create actions
    List<RobotComponents.ABB.Actions.IAction> actions = new List<RobotComponents.ABB.Actions.IAction>();

    // Configuration control
    actions.Add(new JointConfigurationControl(true));
    actions.Add(new LinearConfigurationControl(false));

    // Home position
    RobotJointPosition robotJointPosition = new RobotJointPosition(0, 0, 0, 0, 45, 0);
    JointTarget homeTarget = new JointTarget(robotJointPosition);
    Movement goHome = new Movement(MovementType.MoveAbsJ, homeTarget, speedHigh, zoneFlyover);
    actions.Add(goHome);

    // Declare variables
    Vector3d vector = new Vector3d(0, 0, 0);

    // Follow curves
    for (int i = 0; i != curves.Count; i++)
    {
      // Reverse one another
      if (i % 2 == 0)
      {
        curves[i].Reverse();
      }

      // Curve parameters
      double[] t = curves[i].DivideByCount(10, true);

      // Comments
      actions.Add(new CodeLine(" ", CodeType.Instruction));
      actions.Add(new Comment("New curve", CodeType.Instruction));

      // Follow curves with precise linear movements
      for (int j = 0; j != t.Length; j++)
      {
        double u;
        double v;
        Point3d point = curves[i].PointAt(t[j]);
        surface.ClosestPoint(point, out u, out v);

        Vector3d xAxis = curves[i].TangentAt(t[j]);
        Vector3d zAxis = surface.NormalAt(u, v);
        Vector3d yAxis = Vector3d.CrossProduct(xAxis, zAxis);
        Plane plane = new Plane(point, xAxis, yAxis);

        // Above start
        if (j == 0)
        {
          vector = -plane.ZAxis;
          vector.Unitize();
          Plane planeStart = new Plane(plane.Origin, plane.XAxis, plane.YAxis);
          planeStart.Translate(vector * offset);

          RobotTarget targetStart = new RobotTarget(String.Format("curve_{0}_start", i), planeStart);
          Movement movementStart = new Movement(MovementType.MoveJ, targetStart, speedHigh, zoneFlyover);
          actions.Add(movementStart);
        }

        RobotTarget target = new RobotTarget(String.Format("curve_{0}_{1}", i, j), plane);
        Movement movement = new Movement(MovementType.MoveL, target, speedLow, zonePrecise);
        actions.Add(movement);

        // Enable digital output after start
        if (j == 0)
        {
          actions.Add(new SetDigitalOutput(digitalOutputName, true));
        }
          // Disable digital output after last target and offset above end
        else if (j == t.Length - 1)
        {
          // Disable digital output
          actions.Add(new SetDigitalOutput(digitalOutputName, false));

          // Above end
          vector = -plane.ZAxis;
          vector.Unitize();
          Plane planeEnd = new Plane(plane.Origin, plane.XAxis, plane.YAxis);
          planeEnd.Translate(vector * offset);

          RobotTarget targetEnd = new RobotTarget(String.Format("curve_{0}_end", i), planeEnd);
          Movement movementEnd = new Movement(MovementType.MoveL, targetEnd, speedLow, zonePrecise);
          actions.Add(movementEnd);
        }
      }
    }

    // Home position
    actions.Add(goHome);

    // Create the RAPID program
    RAPIDGenerator rapidGenerator = new RAPIDGenerator(robot, "MainModule", "main");
    List<string> program = rapidGenerator.CreateModule(actions);

    // Output
    A = robot;
    B = actions;
    C = program;
    }
}
# ---------- end c_script ----------
pg = PathGenerator(
    Robot=c_script.A,
    Action=c_script.B,
    Interpolations=5,
    AnimationSlider=Slider(0.22, range=0..1),
    Update=True,
    Output_Configuration_Data=False,
    Output_Configuration_Datas=False,
    Output_Error_Messages=False,
    Output_External_Axis_Planes=False,
    Output_External_Joint_Position=False,
    Output_External_Joint_Positions=False,
    Output_Movement=False,
    Output_Movements=False,
    Output_Path=True,
    Output_Posed_Meshes=False,
    Output_Program_Time=False,
    Output_Robot_End_Plane=True,
    Output_Robot_End_Planes=False,
    Output_Robot_Joint_Position=False,
    Output_Robot_Joint_Positions=False,
    Preview_Path=True,
    Preview_Posed_Meshes=True)  # -> Path, RobotEndPlane
panel_2 = Panel(c_script.C)
pv = PlaneVisualizer(Plane=pg.RobotEndPlane)
