# Grasshopper definition robot_preset.gh (Grasshopper 1.0.8)
# plug-ins: RhinoCodePluginGH, Robot Components

# ----
# License info
I = Info()
panel = Panel(I)

# ----
# Name
# Robot mesh
panel_2 = Panel("IRB5720-125/3.00")

# ----
# Axis planes
panel_3 = Panel("320")
kipa2axpl = GetAxisPlanesFromKinematicsParameters(PositionPlane=PlaneXY(0, 0, 0), A1=panel_3, A2="-200", A3="0", B="0", C1="670", C2="1120", C3="1547.5", C4="167")  # -> AxisPlanes, MountingFrame
panel_4 = Panel(kipa2axpl.MountingFrame)
pv = PlaneVisualizer(Plane=kipa2axpl.AxisPlanes)

# ----
# Axis limits
panel_5 = Panel("-170")
dom = ConstructDomain(DomainStart=panel_5, DomainEnd="170")
dom_2 = ConstructDomain(DomainStart="-75", DomainEnd="145")
dom_3 = ConstructDomain(DomainStart="-180", DomainEnd="70")
dom_4 = ConstructDomain(DomainStart="-300", DomainEnd="300")
dom_5 = ConstructDomain(DomainStart="-130", DomainEnd="130")
dom_6 = ConstructDomain(DomainStart="-360", DomainEnd="360")
merge = Merge(Data1=dom, Data2=dom_2, Data3=dom_3, Data4=dom_4, Data5=dom_5, Data6=dom_6)  # -> flatten(Result)

# ----
# Mesh settings
number_slider = Slider(1, range=0..20)
custom_mesh_settings = SettingsCustom(
    StitchSeams=True,
    SimplePlanes=Toggle(True),
    Refine=True,
    MinCount=16,
    MaxCount=400,
    AspectRatio=20,
    MaxDistance=0,
    MaxAngle=20,
    MinEdge=number_slider,
    MaxEdge=0)

pipeline = GeometryPipeline(
    GroupByLayer=False,
    GroupByType=False,
    IncludeHidden=True,
    IncludeLocked=True,
    LayerFilter="4",
    NameFilter="*",
    SublayerFiltering=True,
    TypeFilter=1073741848)
pipeline_2 = GeometryPipeline(
    GroupByLayer=False,
    GroupByType=False,
    IncludeHidden=True,
    IncludeLocked=True,
    LayerFilter="3",
    NameFilter="*",
    SublayerFiltering=True,
    TypeFilter=1073741848)
pipeline_3 = GeometryPipeline(
    GroupByLayer=False,
    GroupByType=False,
    IncludeHidden=True,
    IncludeLocked=True,
    LayerFilter="2",
    NameFilter="*",
    SublayerFiltering=True,
    TypeFilter=1073741848)
pipeline_4 = GeometryPipeline(
    GroupByLayer=False,
    GroupByType=False,
    IncludeHidden=True,
    IncludeLocked=True,
    LayerFilter="5",
    NameFilter="*",
    SublayerFiltering=True,
    TypeFilter=1073741848)
pipeline_5 = GeometryPipeline(
    GroupByLayer=False,
    GroupByType=False,
    IncludeHidden=True,
    IncludeLocked=True,
    LayerFilter="6",
    NameFilter="*",
    SublayerFiltering=True,
    TypeFilter=1073741848)
pipeline_6 = GeometryPipeline(
    GroupByLayer=False,
    GroupByType=False,
    IncludeHidden=True,
    IncludeLocked=True,
    LayerFilter="1",
    NameFilter="*",
    SublayerFiltering=True,
    TypeFilter=1073741848)
pipeline_7 = GeometryPipeline(
    GroupByLayer=False,
    GroupByType=False,
    IncludeHidden=True,
    IncludeLocked=True,
    LayerFilter="0",
    NameFilter="*",
    SublayerFiltering=True,
    TypeFilter=1073741848)
brep = Brep(pipeline_7)
brep_2 = Brep(pipeline_6)
brep_3 = Brep(pipeline_3)
brep_4 = Brep(pipeline)
brep_5 = Brep(pipeline_5)
brep_6 = Brep(pipeline_2)
brep_7 = Brep(pipeline_4)
mesh = MeshBrep(Brep=brep, Settings=custom_mesh_settings)  # -> flatten(Mesh)
mesh_2 = MeshBrep(Brep=brep_2, Settings=custom_mesh_settings)  # -> flatten(Mesh)
mesh_3 = MeshBrep(Brep=brep_3, Settings=custom_mesh_settings)  # -> flatten(Mesh)
mesh_4 = MeshBrep(Brep=brep_6, Settings=custom_mesh_settings)  # -> flatten(Mesh)
mesh_5 = MeshBrep(Brep=brep_4, Settings=custom_mesh_settings)  # -> flatten(Mesh)
mesh_6 = MeshBrep(Brep=brep_7, Settings=custom_mesh_settings)  # -> flatten(Mesh)
mesh_7 = MeshBrep(Brep=brep_5, Settings=custom_mesh_settings)  # -> flatten(Mesh)
mjoin = MeshJoin(Meshes=mesh)
mjoin_2 = MeshJoin(Meshes=mesh_2)
mjoin_3 = MeshJoin(Meshes=mesh_3)
mjoin_4 = MeshJoin(Meshes=mesh_4)
mjoin_5 = MeshJoin(Meshes=mesh_5)
mjoin_6 = MeshJoin(Meshes=mesh_6)
mjoin_7 = MeshJoin(Meshes=mesh_7)
merge_2 = Merge(Data1=mjoin, Data2=mjoin_2, Data3=mjoin_3, Data4=mjoin_4, Data5=mjoin_5, Data6=mjoin_6, Data7=mjoin_7)  # -> flatten(Result)

# ----
# Mesh repair and reduce
number_slider_2 = Slider(5000, range=0..20000)
c_script = CSharpScript(x=merge_2)  # -> out, a; inputs x: Mesh
# ---------- c_script: C# ----------
// Grasshopper Script Instance
#region Usings
using System;
#r "C:\Users\20136527\AppData\Roaming\Grasshopper\Libraries\RobotComponents\RobotComponents.dll"
using System.Linq;
using System.Collections;
using System.Collections.Generic;
using System.Drawing;

using Rhino;
using Rhino.Geometry;

using Grasshopper;
using Grasshopper.Kernel;
using Grasshopper.Kernel.Data;
using Grasshopper.Kernel.Types;

using static RobotComponents.Utils.MeshPreperation;
#endregion

public class Script_Instance : GH_ScriptInstance
{
    #region Notes
    /* 
      Members:
        RhinoDoc RhinoDocument
        GH_Document GrasshopperDocument
        IGH_Component Component
        int Iteration

      Methods (Virtual & overridable):
        Print(string text)
        Print(string format, params object[] args)
        Reflect(object obj)
        Reflect(object obj, string method_name)
    */
    #endregion

    private void RunScript(Mesh x, ref object a)
    {
        Mesh m = x;
        m = Repair(m);
        m = Repair(m);
        m = Repair(m);
    
        a = m;
    }
}
# ---------- end c_script ----------
merge_3 = Merge(
    Data1=number_slider_2,
    Data2=Slider(5000, range=0..20000),
    Data3=Slider(5000, range=0..20000),
    Data4=Slider(5000, range=0..20000),
    Data5=Slider(5000, range=0..20000),
    Data6=Slider(5000, range=0..20000),
    Data7=Slider(5000, range=0..20000))
c_script_2 = CSharpScript(x=c_script.a, n=merge_3)  # -> out, a; inputs x: Mesh, n: Int32
# ---------- c_script_2: C# ----------
// Grasshopper Script Instance
#region Usings
using System;
#r "C:\Users\20136527\AppData\Roaming\Grasshopper\Libraries\RobotComponents\RobotComponents.dll"
using System.Linq;
using System.Collections;
using System.Collections.Generic;
using System.Drawing;

using Rhino;
using Rhino.Geometry;

using Grasshopper;
using Grasshopper.Kernel;
using Grasshopper.Kernel.Data;
using Grasshopper.Kernel.Types;

using static RobotComponents.Utils.MeshPreperation;
#endregion

public class Script_Instance : GH_ScriptInstance
{
    #region Notes
    /* 
      Members:
        RhinoDoc RhinoDocument
        GH_Document GrasshopperDocument
        IGH_Component Component
        int Iteration

      Methods (Virtual & overridable):
        Print(string text)
        Print(string format, params object[] args)
        Reflect(object obj)
        Reflect(object obj, string method_name)
    */
    #endregion

    private void RunScript(Mesh x, int n, ref object a)
    {
        Mesh m = Reduce(x, n);
        a = m;
    }
}
# ---------- end c_script_2 ----------
c_script_3 = CSharpScript(x=c_script_2.a)  # -> out, a; inputs x: Mesh; same code as c_script

# ----
# Binary formatter
# Convert mesh to string
# Convert string to mesh
rep = ReplaceText(Text=panel_2, Find="/", Replace="_", RecursiveReplace=False)
rep_2 = ReplaceText(Text=rep, Find=".", Replace="_", RecursiveReplace=False)
rep_3 = ReplaceText(Text=rep_2, Find="-", Replace="_", RecursiveReplace=False)
panel_6 = Panel(rep_3)
c_script_4 = CSharpScript(meshes=c_script_3.a, name=panel_6, write=Button())  # -> out, text; inputs meshes: list of Mesh, name: String, write: Boolean
# ---------- c_script_4: C# ----------
// Grasshopper Script Instance
#region Usings
using System;
#r "C:\Users\20136527\AppData\Roaming\Grasshopper\Libraries\RobotComponents\RobotComponents.dll"
using System.IO;
using System.Linq;
using System.Collections;
using System.Collections.Generic;
using System.Drawing;

using Rhino;
using Rhino.Geometry;

using Grasshopper;
using Grasshopper.Kernel;
using Grasshopper.Kernel.Data;
using Grasshopper.Kernel.Types;

using static RobotComponents.Utils.Serialization;
#endregion

public class Script_Instance : GH_ScriptInstance
{
    #region Notes
    /* 
      Members:
        RhinoDoc RhinoDocument
        GH_Document GrasshopperDocument
        IGH_Component Component
        int Iteration

      Methods (Virtual & overridable):
        Print(string text)
        Print(string format, params object[] args)
        Reflect(object obj)
        Reflect(object obj, string method_name)
    */
    #endregion

    private void RunScript(
	List<Mesh> meshes,
	string name,
	bool write,
	ref object text)
    {
        // Initialize output list for serialized meshes
        List<string> serializedMeshes = new List<string>();
        string path = Path.GetDirectoryName(GrasshopperDocument.FilePath);

        for (int i = 0; i < meshes.Count; i++)
        {
            // Serialize the mesh to a byte array and then to a Base64 string
            string serializedMesh = Convert.ToBase64String(ObjectToByteArray(meshes[i]));
            serializedMeshes.Add(serializedMesh);

            // If write is true, write the serialized mesh to a text file
            if (write)
            {
                string filename = Path.Combine(path, $"{name}_link_{i}.txt");
                File.WriteAllText(filename, serializedMesh);
            }
        }
    
        text = serializedMeshes;
    }
}
# ---------- end c_script_4 ----------
text = Text(c_script_4.text)
c_script_5 = CSharpScript(text=text)  # -> out, mesh; inputs text: String
# ---------- c_script_5: C# ----------
// Grasshopper Script Instance
#region Usings
using System;
#r "C:\Users\20136527\AppData\Roaming\Grasshopper\Libraries\RobotComponents\RobotComponents.dll"
using System.Linq;
using System.Collections;
using System.Collections.Generic;
using System.Drawing;

using Rhino;
using Rhino.Geometry;

using Grasshopper;
using Grasshopper.Kernel;
using Grasshopper.Kernel.Data;
using Grasshopper.Kernel.Types;

using static RobotComponents.Utils.Serialization;
#endregion

public class Script_Instance : GH_ScriptInstance
{
    #region Notes
    /* 
      Members:
        RhinoDoc RhinoDocument
        GH_Document GrasshopperDocument
        IGH_Component Component
        int Iteration

      Methods (Virtual & overridable):
        Print(string text)
        Print(string format, params object[] args)
        Reflect(object obj)
        Reflect(object obj, string method_name)
    */
    #endregion

    private void RunScript(string text, ref object mesh)
    {
        Mesh a = (Mesh)ByteArrayToObject(System.Convert.FromBase64String(text));
        mesh = a;
    }
}
# ---------- end c_script_5 ----------
mesh_8 = Mesh(c_script_5.mesh)

# ----
# Count mesh faces
demesh = DeconstructMesh(Mesh=c_script_3.a)  # -> Vertices, flatten(Faces), Colours, Normals
lng = ListLength(List=demesh.Faces)
panel_7 = Panel(lng)

# ----
# Robot end-effector: for debugging purposes
number_slider_3 = Slider(70, range=0..200)
number_slider_4 = Slider(200, range=0..200)
xy = XYPlane(Origin=Point(0, 0, 0))
cone = Cone(Base=xy, Radius=number_slider_3, Length=number_slider_4)  # -> Cone, Tip
Z = UnitZ(Factor=number_slider_4)
mesh_9 = Mesh(cone.Cone)
move = Move(Geometry=xy, Motion=Z)  # -> Geometry, Transform
robtool = RobotTool(Name="debug_tool", Mesh=mesh_9, AttachmentPlane=PlaneXY(0, 0, 0), ToolPlane=move.Geometry)

# ----
# Position plane
number_slider_5 = Slider(2000, range=0..4000)
pt = ConstructPoint(XCoordinate=Slider(0, range=0..4000), YCoordinate=number_slider_5, ZCoordinate=Slider(0, range=0..4000))
xy_2 = XYPlane(Origin=pt)

xy_3 = XYPlane(Origin=Point(0, 0, 0))

# ----
# Robot info
robinfo = RobotInfo(
    Name=panel_2,
    Meshes=c_script_3.a,
    AxisPlanes=kipa2axpl.AxisPlanes,
    AxisLimits=merge,
    PositionPlane=xy_3,
    MountingFrame=kipa2axpl.MountingFrame,
    RobotTool=robtool)

# ----
# Predefined robot info
robpres = RobotPreset(PositionPlane=xy_2, RobotTool=robtool, Robot_Preset_Number=43)

list = ValueList({"CUSTOM": 0, "PREDEFINED": 1}, selected="CUSTOM")
filter = StreamFilter(Gate=list, Stream0=robinfo, Stream1=robpres)

# ----
# Deconstruct robot info and show axis planes
derob = DeconstructRobot(Robot=filter)  # -> Name, Meshes, AxisPlanes, AxisLimits, PositionPlane, MountingFrame, RobotTool, ExternalAxis
pv_2 = PlaneVisualizer(Plane=derob.AxisPlanes)

# ----
# Forward kinematics
number_slider_6 = Slider(41, range=-180..180)
rj = RobotJointPosition(
    RobotJointPosition1=Slider(-35, range=-180..180),
    RobotJointPosition2=Slider(41, range=-180..180),
    RobotJointPosition3=Slider(-43, range=-180..180),
    RobotJointPosition4=Slider(119, range=-180..180),
    RobotJointPosition5=number_slider_6,
    RobotJointPosition6=Slider(-105, range=-180..180))

fk = ForwardKinematics(Robot=filter, RobotJointPosition=rj, Hide_Posed_Meshes=False, Output_Posed_Meshes=False)  # -> EndPlane, ExternalAxisPlanes

pv_3 = PlaneVisualizer(Plane=fk.EndPlane)
