# Grasshopper definition IRB6650-125-32.gh (Grasshopper 1.0.7)
# plug-ins: RobotComponents

# ----
# Name
# Robot mesh
panel = Panel("IRB6650-125/3.2")

pt = ConstructPoint(XCoordinate="320", YCoordinate="0", ZCoordinate="780")
vec = VectorXYZ(XComponent=Slider(0, range=0..1), YComponent=Slider(1, range=0..1), ZComponent=Slider(0, range=0..1))  # -> Vector, Length
pl = PlaneNormal(Origin=pt, ZAxis=vec.Vector)

vec_2 = VectorXYZ(XComponent=Slider(0, range=0..1), YComponent=Slider(0, range=0..1), ZComponent=Slider(1, range=0..1))  # -> Vector, Length
pt_2 = ConstructPoint(XCoordinate="0", YCoordinate="0", ZCoordinate="0")
pl_2 = PlaneNormal(Origin=pt_2, ZAxis=vec_2.Vector)

vec_3 = VectorXYZ(XComponent=Slider(1, range=0..1), YComponent=Slider(0, range=0..1), ZComponent=Slider(0, range=0..1))  # -> Vector, Length
pt_3 = ConstructPoint(XCoordinate="550", YCoordinate="0", ZCoordinate="2260")
pl_3 = PlaneNormal(Origin=pt_3, ZAxis=vec_3.Vector)

vec_4 = VectorXYZ(XComponent=Slider(0, range=0..1), YComponent=Slider(1, range=0..1), ZComponent=Slider(0, range=0..1))  # -> Vector, Length
pt_4 = ConstructPoint(XCoordinate="1912", YCoordinate="0", ZCoordinate="2260")
pl_4 = PlaneNormal(Origin=pt_4, ZAxis=vec_4.Vector)

# ----
# Position plane
number_slider = Slider(0, range=0..4000)
pt_5 = ConstructPoint(XCoordinate=number_slider, YCoordinate=Slider(2000, range=0..4000), ZCoordinate=Slider(0, range=0..4000))
xy = XYPlane(Origin=pt_5)

# ----
# Axis limits
panel_2 = Panel("70")
dom = ConstructDomain(DomainStart="-180", DomainEnd="180")
dom_2 = ConstructDomain(DomainStart="-65", DomainEnd="85")
dom_3 = ConstructDomain(DomainStart="-180", DomainEnd=panel_2)
dom_4 = ConstructDomain(DomainStart="-300", DomainEnd="300")
dom_5 = ConstructDomain(DomainStart="-120", DomainEnd="120")
dom_6 = ConstructDomain(DomainStart="-360", DomainEnd="360")
merge = Merge(Data1=dom, Data2=dom_2, Data3=dom_3, Data4=dom_4, Data5=dom_5, Data6=dom_6)  # -> flatten(Result)

pt_6 = ConstructPoint(XCoordinate="320", YCoordinate="0", ZCoordinate="2060")
vec_5 = VectorXYZ(XComponent=Slider(0, range=0..1), YComponent=Slider(1, range=0..1), ZComponent=Slider(0, range=0..1))  # -> Vector, Length
pl_5 = PlaneNormal(Origin=pt_6, ZAxis=vec_5.Vector)

vec_6 = VectorXYZ(XComponent=Slider(1, range=0..1), YComponent=Slider(0, range=0..1), ZComponent=Slider(0, range=0..1))  # -> Vector, Length
pt_7 = ConstructPoint(XCoordinate="2112", YCoordinate="0", ZCoordinate="2260")
pl_6 = PlaneNormal(Origin=pt_7, ZAxis=vec_6.Vector)

# ----
# Tool mounting frame
number_slider_2 = Slider(1, range=0..1)
vec_7 = VectorXYZ(XComponent=number_slider_2, YComponent=Slider(0, range=0..1), ZComponent=Slider(0, range=0..1))  # -> Vector, Length
pt_8 = ConstructPoint(XCoordinate="2112", YCoordinate="0", ZCoordinate="2260")
pl_7 = PlaneNormal(Origin=pt_8, ZAxis=vec_7.Vector)
Z = UnitZ(Factor=1)
neg = Negative(Value=Z)
align = AlignPlane(Plane=pl_7, Direction=neg)  # -> Plane, Angle

# ----
# Mesh settings
number_slider_3 = Slider(0, range=0..500)
custom_mesh_settings = SettingsCustom(
    StitchSeams=True,
    SimplePlanes=Toggle(True),
    Refine=Toggle(False),
    MinCount=Slider(0, range=0..50),
    MaxCount=Slider(16, range=0..50),
    AspectRatio=number_slider_3,
    MaxDistance=Slider(0, range=0..10),
    MaxAngle=Slider(180, range=0..360),
    MinEdge=Slider(5, range=0..20),
    MaxEdge=Slider(0, range=0..500))

pipeline = GeometryPipeline(
    GroupByLayer=False,
    GroupByType=False,
    IncludeHidden=True,
    IncludeLocked=True,
    LayerFilter="4",
    NameFilter="*",
    SublayerFiltering=True,
    TypeFilter=1073741848)
pipeline_2 = GeometryPipeline(
    GroupByLayer=False,
    GroupByType=False,
    IncludeHidden=True,
    IncludeLocked=True,
    LayerFilter="3",
    NameFilter="*",
    SublayerFiltering=True,
    TypeFilter=1073741848)
pipeline_3 = GeometryPipeline(
    GroupByLayer=False,
    GroupByType=False,
    IncludeHidden=True,
    IncludeLocked=True,
    LayerFilter="2",
    NameFilter="*",
    SublayerFiltering=True,
    TypeFilter=1073741848)
pipeline_4 = GeometryPipeline(
    GroupByLayer=False,
    GroupByType=False,
    IncludeHidden=True,
    IncludeLocked=True,
    LayerFilter="5",
    NameFilter="*",
    SublayerFiltering=True,
    TypeFilter=1073741848)
pipeline_5 = GeometryPipeline(
    GroupByLayer=False,
    GroupByType=False,
    IncludeHidden=True,
    IncludeLocked=True,
    LayerFilter="6",
    NameFilter="*",
    SublayerFiltering=True,
    TypeFilter=1073741848)
pipeline_6 = GeometryPipeline(
    GroupByLayer=False,
    GroupByType=False,
    IncludeHidden=True,
    IncludeLocked=True,
    LayerFilter="1",
    NameFilter="*",
    SublayerFiltering=True,
    TypeFilter=1073741848)
pipeline_7 = GeometryPipeline(
    GroupByLayer=False,
    GroupByType=False,
    IncludeHidden=True,
    IncludeLocked=True,
    LayerFilter="0",
    NameFilter="*",
    SublayerFiltering=True,
    TypeFilter=1073741848)
brep = Brep(pipeline_6)
brep_2 = Brep(pipeline_3)
brep_3 = Brep(pipeline_2)
brep_4 = Brep(pipeline)
brep_5 = Brep(pipeline_7)
brep_6 = Brep(pipeline_4)
brep_7 = Brep(pipeline_5)
debrep = DeconstructBrep(Brep=brep_6)  # -> Faces, Edges, Vertices
debrep_2 = DeconstructBrep(Brep=brep_7)  # -> Faces, Edges, Vertices
debrep_3 = DeconstructBrep(Brep=brep_3)  # -> Faces, Edges, Vertices
debrep_4 = DeconstructBrep(Brep=brep_4)  # -> Faces, Edges, Vertices
debrep_5 = DeconstructBrep(Brep=brep_2)  # -> Faces, Edges, Vertices
debrep_6 = DeconstructBrep(Brep=brep_5)  # -> Faces, Edges, Vertices
debrep_7 = DeconstructBrep(Brep=brep)  # -> Faces, Edges, Vertices
mesh = MeshBrep(Brep=debrep_6.Faces, Settings=custom_mesh_settings)  # -> flatten(Mesh)
mesh_2 = MeshBrep(Brep=debrep_7.Faces, Settings=custom_mesh_settings)  # -> flatten(Mesh)
mesh_3 = MeshBrep(Brep=debrep_5.Faces, Settings=custom_mesh_settings)  # -> flatten(Mesh)
mesh_4 = MeshBrep(Brep=debrep_3.Faces, Settings=custom_mesh_settings)  # -> flatten(Mesh)
mesh_5 = MeshBrep(Brep=debrep_4.Faces, Settings=custom_mesh_settings)  # -> flatten(Mesh)
mesh_6 = MeshBrep(Brep=debrep.Faces, Settings=custom_mesh_settings)  # -> flatten(Mesh)
mesh_7 = MeshBrep(Brep=debrep_2.Faces, Settings=custom_mesh_settings)  # -> flatten(Mesh)
mjoin = MeshJoin(Meshes=mesh)
mjoin_2 = MeshJoin(Meshes=mesh_2)
mjoin_3 = MeshJoin(Meshes=mesh_3)
mjoin_4 = MeshJoin(Meshes=mesh_4)
mjoin_5 = MeshJoin(Meshes=mesh_5)
mjoin_6 = MeshJoin(Meshes=mesh_6)
mjoin_7 = MeshJoin(Meshes=mesh_7)
merge_2 = Merge(Data1=mjoin, Data2=mjoin_2, Data3=mjoin_3, Data4=mjoin_4, Data5=mjoin_5, Data6=mjoin_6, Data7=mjoin_7)  # -> flatten(Result)

# ----
# Axis planes
merge_3 = Merge(Data1=pl_2, Data2=pl, Data3=pl_5, Data4=pl_3, Data5=pl_4, Data6=pl_6)  # -> flatten(Result)

# ----
# Binary formatter
# Convert mesh to string
# Convert string to mesh
rep = ReplaceText(Text=panel, Find="/", Replace="_", RecursiveReplace=False)
rep_2 = ReplaceText(Text=rep, Find=".", Replace="_", RecursiveReplace=False)
rep_3 = ReplaceText(Text=rep_2, Find="-", Replace="_", RecursiveReplace=False)
panel_3 = Panel(rep_3)
python = GhPythonScript(meshes=merge_2, name=panel_3, write=Button())  # -> out, text; inputs meshes: list of Mesh, write: Boolean
# ---------- python: Python ----------
import System
import Grasshopper
import os

text = []
path = os.path.dirname(ghenv.Component.Attributes.Owner.OnPingDocument().FilePath)

for i in range(0, len(meshes)):
    text.append(System.Convert.ToBase64String(Grasshopper.Kernel.GH_Convert.CommonObjectToByteArray(meshes[i])))
    if write == True:
        filename = os.path.join(path, "{}_link_{}.txt".format(name, i))
        file = open(filename,'w+') 
        file.write(text[i]) 
        file.close()
# ---------- end python ----------
text = Text(python.text)  # disabled
number_slider_4 = Slider(0, range=0..6)  # disabled
item = ListItem(List=text, Index=number_slider_4, Wrap=True)  # disabled
c_script = CSharpScript(x=item)  # -> out, A; inputs x: String; disabled
# ---------- c_script: C# usings ----------
using System.IO;
using System.Linq;
using System.Data;
using System.Drawing;
using System.Reflection;
using System.Windows.Forms;
using System.Xml;
using System.Xml.Linq;
using System.Runtime.InteropServices;

using Rhino.DocObjects;
using Rhino.Collections;
using GH_IO;
using GH_IO.Serialization;
# ---------- c_script: C# ----------
    string y = "";
    y += x;

    y = y.Replace(" ", "+");
    int modulus = y.Length % 4;

    if(modulus > 0)
    {
      y += new string('=', 4 - modulus);
    }


    A = GH_Convert.ByteArrayToCommonObject<GeometryBase>(System.Convert.FromBase64String(y));
# ---------- end c_script ----------
mesh_8 = Mesh(c_script.A)  # disabled

# ----
# Count mesh faces: goal is < 80.000 faces
demesh = DeconstructMesh(Mesh=merge_2)  # -> Vertices, flatten(Faces), Colours, Normals
lng = ListLength(List=demesh.Faces)
panel_4 = Panel(lng)

# ----
# Robot end-effector: for debugging purposes
number_slider_5 = Slider(80, range=0..200)
number_slider_6 = Slider(200, range=0..200)
xy_2 = XYPlane(Origin=Point(0, 0, 0))
cone = Cone(Base=xy_2, Radius=number_slider_5, Length=number_slider_6)  # -> Cone, Tip
Z_2 = UnitZ(Factor=number_slider_6)
mesh_9 = Mesh(cone.Cone)
move = Move(Geometry=xy_2, Motion=Z_2)  # -> Geometry, Transform
robtoool = RobotToolFromPlanes(Name="debug_tool", Mesh=mesh_9, AttachmentPlane=xy_2, ToolPlane=move.Geometry)  # -> RobotTool, RobotToolCode

# ----
# Predefined robot info
irb6650 = ABB_IRB665012532(PositionPlane=xy, RobotTool=robtoool.RobotTool)

# ----
# Robot info
robinfo = RobotInfo(
    Name=panel,
    Meshes=merge_2,
    AxisPlanes=merge_3,
    AxisLimits=merge,
    PositionPlane=xy,
    MountingFrame=align.Plane,
    RobotTool=robtoool.RobotTool)

list = ValueList({"CUSTOM": 0, "PREDEFINED": 1}, selected="PREDEFINED")
filter = StreamFilter(Gate=list, Stream0=robinfo, Stream1=irb6650)

# ----
# Deconstruct robot info and show axis planes
derobinfo = DeconstructRobotInfo(RobotInfo=filter)  # -> Name, Meshes, AxisPlanes, AxisLimits, PositionPlane, MountingFrame, ToolPlane, RobotTool
pv = PlaneVisualizer(Plane=derobinfo.AxisPlanes)

# ----
# Forward kinematics
number_slider_7 = Slider(-55, range=-180..180)
merge_4 = Merge(
    Data1=Slider(17, range=-180..180),
    Data2=Slider(18, range=-180..180),
    Data3=Slider(5, range=-180..180),
    Data4=Slider(77, range=-180..180),
    Data5=number_slider_7,
    Data6=Slider(-4, range=-180..180))  # -> flatten(Result)
fk = ForwardKinematics(RobotInfo=filter, InternalAxisValues=merge_4, ExternalAxisValues=[0, 0, 0, 0, 0, 0])  # -> RobotMesh, EndPlane, ExternalAxisPlanes
pv_2 = PlaneVisualizer(Plane=fk.EndPlane)
